# Grasshopper definition BinarySubdivisionPlanGeneration.gh (Grasshopper 1.0.8)
# plug-ins: Karamba3D, Human, PlanFinderGH

int = Integer(Slider(4, range=0..10))

dom = ConstructDomain(DomainStart=0, DomainEnd=Slider(20, range=0..100))
rectangle = Rectangle(Plane=PlaneXY(0, 0, 0), XSize=dom, YSize=dom, Radius=0)  # -> Rectangle, Length
int_2 = Integer(Slider(3, range=0..10))
crv = Curve(rectangle.Rectangle)
D = Data(Slider(0.642, range=0..1))
D_2 = Data(Slider(0.448, range=0..1))
D_3 = Data(Slider(1, range=-90..90))
D_4 = Data(Toggle(True))
repeat = RepeatData(Data=D, Length=int_2)
repeat_2 = RepeatData(Data=D_2, Length=int_2)
repeat_3 = RepeatData(Data=D_3, Length=int_2)
repeat_4 = RepeatData(Data=D_4, Length=int_2)
int_3 = Integer(Slider(3, range=0..10))
D_5 = Data(repeat)
int_4 = Integer(int)
D_6 = Data(repeat_2)
D_7 = Data(repeat_3)
D_8 = Data(repeat_4)
crv_2 = Curve(crv)
addition = Addition(A="2", B=int_3)
int_5 = Integer(int)
random = Random(Range="-4 to 4", Number=int_4, Seed=addition)
D_9 = Data(Toggle(True))
int_6 = Integer(int)
repeat_5 = RepeatData(Data=D_9, Length=int)
addition_2 = Addition(A="1", B=int_3)
addition_3 = Addition(A="0", B=int_3)
round = Round(Number=random)  # -> Nearest, Floor, Ceiling
D_10 = Data(repeat_5)
random_2 = Random(Range="0.25 to 0.75", Number=int_5, Seed=addition_2)
multiplication = Multiplication(A=round.Nearest, B="90")
random_3 = Random(Range="0.25 to 0.75", Number=int_6, Seed=addition_3)
py3 = Python3Script(B=crv_2, U=D_5, V=D_6, A=D_7, Active=D_8)  # -> out, Rooms, RoomIDs, Discarded, Cuts, CutIDs, Points, Status, Log; inputs B: Polyline, U: list, V: list, A: list, Active: list
# ---------- py3: Python ----------
"""Binary room subdivision -- paste this entire file into GH Python 3 (Rhino 8).

INPUTS (names are case-sensitive):
 B        Item / Curve: one simple closed planar polyline, without holes.
 U, V     List / float: normalized positions in each CURRENT room's XY bbox.
 A        List / float: cut-line angle in degrees, counterclockwise from +X.
 Active   List / bool: True divides; False terminates this branch.
 Tol      Item / float, optional: model tolerance when omitted or None.
 MinArea  Item / float, optional: minimum retained child area, default Tol^2.
 Flatten U, V, A, Active. All four lists must have identical lengths.
 Empty lists return B unchanged. No singleton broadcasting is performed.

OUTPUTS (create/rename these on the component):
 Rooms      Final closed room polylines (flat list).
 RoomIDs    Heap indices of Rooms, including leaves beyond instruction count.
 Discarded  Disconnected pieces excluded by the selector, not subdivided.
 Cuts       Full bbox-spanning guide lines for successful splits (not walls).
 CutIDs     Instruction indices corresponding to Cuts.
 Points     Actual snapped placement points for successful splits.
 Status     One string per instruction: split/inactive/failed/unreachable.
 Log        Diagnostics, including any snapping or removed area.

TREE: instruction i has children 2*i+1 and 2*i+2 (zero-based, breadth-first).
 Child 2*i+1 is LEFT of the directed cut; 2*i+2 is RIGHT.
 Angle is modulo 360, not 180: adding 180 swaps child identities.
 A node without an instruction is a leaf. Inactive/failed nodes are leaves;
 their descendant instructions remain unreachable, never reassigned.

GEOMETRY: work in one common local plane, restore original plane on output.
 Horizontal boundaries use world X/Y axes; other boundaries use TryGetPlane.
 U/V are clamped to [0,1]. Outside points snap to closest boundary point.
 A tangent or degenerate cut is a no-op, not a forced perturbation.
 Select one component PER SIDE, largest by default. Others go to Discarded.
 Replace choose_region() below to customize component selection.
 Tiny children reject the entire split; parent is retained unchanged.
 No walls, room adjacency constraints, holes, or minimum-width checks.

QUICK EXAMPLE: B = closed 12 x 8 XY rectangle;
 U=[.5,.5,.5], V=[.5,.5,.5], A=[90,0,0], Active=[True]*3.
 Expected: four rooms of area 24; RoomIDs=[3,4,5,6].

Validation: Python syntax and mocked tree logic checked externally.
 Rhino Boolean geometry must be checked in Rhino; not executed here.
"""

import math
import Rhino
import Rhino.Geometry as rg


def area(curve):
    props = rg.AreaMassProperties.Compute(curve)
    if props is None:
        raise ValueError("Cannot compute region area.")
    result = abs(props.Area)
    props.Dispose()
    return result


def choose_region(polylines):
    """Return ONE input polyline, or None to reject the split.

    Called separately for the left and right component lists, in local XY.
    Example alternative: return min(polylines, key=area).
    Input ordering is deterministic: largest area, then bbox centre X/Y.
    """
    return max(polylines, key=area) if polylines else None


def as_polyline(curve):
    ok, poly = curve.TryGetPolyline()
    if not ok:
        raise ValueError("Expected a polyline; curved edges are unsupported.")
    return rg.PolylineCurve(poly)


def component_key(curve):
    centre = curve.GetBoundingBox(True).Center
    return (-area(curve), centre.X, centre.Y)


def split_region(region, u, v, angle, tol, min_area, selector):
    """Return (left, right, discarded, guide, point, snapped), or raise.

    Intersect with two finite half-plane rectangles that fully enclose the
    parent. Rhino Booleans handle multiple components of concave polygons.
    All input/output curves here are local XY closed polylines.
    """
    bb = region.GetBoundingBox(True)
    u, v = max(0.0, min(1.0, u)), max(0.0, min(1.0, v))
    p = rg.Point3d(bb.Min.X + u*(bb.Max.X-bb.Min.X),
                   bb.Min.Y + v*(bb.Max.Y-bb.Min.Y), 0.0)
    snapped = False
    if region.Contains(p, rg.Plane.WorldXY, tol) == rg.PointContainment.Outside:
        ok, t = region.ClosestPoint(p)
        if not ok:
            raise ValueError("Could not snap placement to the boundary.")
        p = region.PointAt(t)
        snapped = True

    a = math.radians(angle % 360.0)
    dx, dy = math.cos(a), math.sin(a)
    nx, ny = -dy, dx
    # Every bbox corner is closer than its diagonal to p, which is in bbox.
    extent = 2.0*bb.Diagonal.Length + 100.0*tol

    def point(s, t):
        return rg.Point3d(p.X+s*dx+t*nx, p.Y+s*dy+t*ny, 0.0)

    def side_components(sign):
        corners = [point(-extent, 0), point(extent, 0),
                   point(extent, sign*extent), point(-extent, sign*extent)]
        corners.append(corners[0])
        mask = rg.PolylineCurve(corners)
        raw = rg.Curve.CreateBooleanIntersection(region, mask, tol)
        if raw is None or len(raw) == 0:
            raise ValueError("One side is empty: tangent cut or Boolean failure.")
        result = []
        for curve in raw:
            if not curve.IsClosed or not curve.IsValid:
                raise ValueError("Boolean returned an invalid/open component.")
            poly = as_polyline(curve)
            if area(poly) <= 0.0:
                raise ValueError("Boolean returned a zero-area component.")
            result.append(poly)
        return sorted(result, key=component_key)

    left_parts, right_parts = side_components(1), side_components(-1)
    original_area = area(region)
    total_area = sum(area(c) for c in left_parts+right_parts)
    area_error = max(10.0*tol*region.GetLength(), original_area*1e-8)
    if abs(total_area-original_area) > area_error:
        raise ValueError("Boolean pieces do not conserve parent area.")

    left, right = selector(left_parts), selector(right_parts)
    if left is None or right is None:
        raise ValueError("Region selector rejected this split.")
    if not any(left is c for c in left_parts) or not any(right is c for c in right_parts):
        raise ValueError("Selector must return one of its input polylines.")
    if min(area(left), area(right)) <= min_area:
        raise ValueError("One retained child is below the minimum area.")
    rejected = [c for c in left_parts+right_parts if c is not left and c is not right]
    guide = rg.LineCurve(point(-extent, 0), point(extent, 0))
    return left, right, rejected, guide, p, snapped


def partition(boundary, us, vs, angles, active, tol, min_area,
              selector=choose_region):
    us, vs, angles, active = map(list, (us, vs, angles, active))
    count = len(us)
    if any(len(values) != count for values in (vs, angles, active)):
        raise ValueError("U, V, A and Active must have identical list lengths.")
    if not math.isfinite(tol) or tol <= 0:
        raise ValueError("Tol must be a finite positive number.")
    if not math.isfinite(min_area) or min_area < 0:
        raise ValueError("MinArea must be a finite non-negative number.")
    for values in (us, vs, angles):
        if any(not math.isfinite(float(x)) for x in values):
            raise ValueError("U, V and A must contain finite numbers.")
    # Active should have the GH bool type hint; do not use strings like 'False'.
    for value in active:
        if str(value) not in ("True", "False"):
            raise ValueError("Active must contain booleans (use the bool hint).")

    if boundary is None:
        raise ValueError("Connect a closed planar polyline to B.")
    if isinstance(boundary, rg.Polyline):
        boundary = rg.PolylineCurve(boundary)
    boundary = as_polyline(boundary)
    if not boundary.IsValid or not boundary.IsClosed:
        raise ValueError("B must be a valid closed polyline.")
    ok, plane = boundary.TryGetPlane(tol)
    if not ok:
        raise ValueError("B must be planar within Tol.")
    box = boundary.GetBoundingBox(True)
    if box.Max.Z-box.Min.Z <= tol:
        plane = rg.Plane(rg.Point3d(0, 0, box.Center.Z), rg.Vector3d.ZAxis)
    to_xy = rg.Transform.PlaneToPlane(plane, rg.Plane.WorldXY)
    to_world = rg.Transform.PlaneToPlane(rg.Plane.WorldXY, plane)
    boundary.Transform(to_xy)
    boundary.Transform(rg.Transform.PlanarProjection(rg.Plane.WorldXY))
    events = rg.Intersect.Intersection.CurveSelf(boundary, tol)
    if events is not None and events.Count > 0:
        raise ValueError("B must be simple, without self-intersections.")
    if area(boundary) <= max(min_area, tol*tol):
        raise ValueError("Boundary area is too small.")

    rooms, ids, discarded, cuts, cut_ids, points, log = [], [], [], [], [], [], []
    status = ["unreachable"]*count

    def visit(region, i):
        if i >= count:
            rooms.append(region)
            ids.append(i)
            return
        if not active[i]:
            status[i] = "inactive"
            rooms.append(region)
            ids.append(i)
            return
        try:
            left, right, rejected, guide, p, snapped = split_region(
                region, float(us[i]), float(vs[i]), float(angles[i]),
                tol, min_area, selector)
        except Exception as exc:
            status[i] = "failed"
            log.append("Node {}: {}; parent retained.".format(i, exc))
            rooms.append(region)
            ids.append(i)
            return
        status[i] = "split"
        cuts.append(guide)
        cut_ids.append(i)
        points.append(p)
        discarded.extend(rejected)
        if snapped:
            log.append("Node {}: placement snapped to boundary.".format(i))
        if rejected:
            log.append("Node {}: excluded {} component(s), area {:.6g}.".format(
                i, len(rejected), sum(area(c) for c in rejected)))
        visit(left, 2*i+1)
        visit(right, 2*i+2)

    visit(boundary, 0)
    # Flat outputs are sorted by heap index, not recursion traversal order.
    ordered_rooms = sorted(zip(ids, rooms), key=lambda pair: pair[0])
    ids = [pair[0] for pair in ordered_rooms]
    rooms = [pair[1] for pair in ordered_rooms]
    ordered_cuts = sorted(zip(cut_ids, cuts, points), key=lambda row: row[0])
    cut_ids = [row[0] for row in ordered_cuts]
    cuts = [row[1] for row in ordered_cuts]
    points = [row[2] for row in ordered_cuts]
    for curve in rooms+discarded+cuts:
        curve.Transform(to_world)
    for point in points:
        point.Transform(to_world)
    skipped = [i for i, state in enumerate(status) if state == "unreachable"]
    if skipped:
        log.append("Unreachable instruction indices: {}".format(skipped))
    return rooms, ids, discarded, cuts, cut_ids, points, status, log


# Grasshopper component entry point; optional inputs may be left unconnected.
doc = Rhino.RhinoDoc.ActiveDoc
default_tol = doc.ModelAbsoluteTolerance if doc is not None else 0.001
tol_value = globals().get("Tol")
tol_value = default_tol if tol_value is None else float(tol_value)
min_value = globals().get("MinArea")
min_value = tol_value**2 if min_value is None else float(min_value)
Rooms, RoomIDs, Discarded, Cuts, CutIDs, Points, Status, Log = partition(
    B, U, V, A, Active, tol_value, min_value)
# ---------- end py3 ----------
int_7 = Integer(multiplication)
num = Number(random_3)
num_2 = Number(random_2)
py3_2 = Python3Script(B=crv, U=num, V=num_2, A=int_7, Active=D_10)  # -> out, Rooms, RoomIDs, Discarded, Cuts, CutIDs, Points, Status, Log; inputs B: Polyline, U: list, V: list, A: list, Active: list; same code as py3
crv_3 = Curve(py3.Rooms)
crv_4 = Curve(py3_2.Rooms)
geo = Geometry(crv_4)
crv_5 = Curve(crv)
explode = Explode(Curve=geo, Recursive=True)  # -> Segments, Vertices
crv_6 = Curve(flatten(explode.Segments))
rdlines = RemoveDuplicateLinesKaramba3D(Line=crv_6, LimitDistance=0.005)  # -> OutLine, Info, Indexes
D_11 = Distance(Slider(0.05, range=0..1))
neg = Negative(Value=D_11)
offset = OffsetCurve(Curve=crv_4, Distance=neg, Corners=1)
crv_7 = Curve(rdlines.OutLine)
llinter = LineLineIntersectionKaramba3D(IntersectingLines=crv_7, LinesToIntersect=crv_7, LimitDistance_m=0.005)  # -> InterSecPoints, LineSubSegments
crv_8 = Curve(flatten(llinter.LineSubSegments))
S = Shader(ColourSwatch(SwatchColor=RGB(0, 0, 0)))
rdlines_2 = RemoveDuplicateLinesKaramba3D(Line=crv_8, LimitDistance=0.005)  # -> OutLine, Info, Indexes
previewlw = CustomPreviewLineweights(Geometry=offset, Shader=S, Thickness=Slider(5, range=0..10), Absolute=False)
crv_9 = Curve(rdlines_2.OutLine)
crv_10 = Curve(crv_9)
neg_2 = Negative(Value=Slider(0.24, range=0..1))
py3_3 = Python3Script(Lines=crv_10)  # -> out, Polylines; inputs Lines: list of Line
# ---------- py3_3: Python ----------
import Rhino.Geometry as rg
from compas.datastructures import Network

# INPUTS:
# Lines     : List of Rhino lines / line curves
# Tolerance : Float (e.g. 0.001)

tol = 0.1 # Tolerance if Tolerance and Tolerance > 0 else 0.001
tol = 0.1
# --------------------------------------------------
# 1. Construct COMPAS network
# --------------------------------------------------

network = Network()
vertex_map = {}

def add_vertex(pt):
    key = (
        round(pt.X / tol),
        round(pt.Y / tol),
        round(pt.Z / tol)
    )

    if key not in vertex_map:
        index = len(vertex_map)

        network.add_node(
            index,
            x=pt.X,
            y=pt.Y,
            z=pt.Z
        )

        vertex_map[key] = index

    return vertex_map[key]


for line in Lines:

    if isinstance(line, rg.Line):
        start = line.From
        end = line.To
    else:
        start = line.PointAtStart
        end = line.PointAtEnd

    u = add_vertex(start)
    v = add_vertex(end)

    if u != v:
        network.add_edge(u, v)


# --------------------------------------------------
# 2. Detect planar faces
# --------------------------------------------------

cycles = network.find_cycles()

# --------------------------------------------------
# 3. Extract face boundaries
# --------------------------------------------------

Faces = []
Polylines = []
FaceEdges = []

for cycle in cycles:

    points = [
        rg.Point3d(*network.node_coordinates(v))
        for v in cycle
    ]

    # Close the polygon
    if points[0] != points[-1]:
        points.append(points[0])

    polyline = rg.Polyline(points)

    # Signed XY area
    area = 0.0

    for i in range(len(points) - 1):
        a = points[i]
        b = points[i + 1]

        area += a.X * b.Y - b.X * a.Y

    area *= 0.5

    # Keep bounded faces only
    # Assumes CCW bounded cycles
    if area <= tol * tol:
        continue

    Faces.append(cycle)
    Polylines.append(polyline.ToNurbsCurve())

    edges = [
        rg.Line(points[i], points[i + 1])
        for i in range(len(points) - 1)
    ]

    FaceEdges.append(edges)


Network = network

import Rhino.Geometry as rg
from compas.datastructures import Network

# INPUTS:
# Lines     : List of Rhino lines / line curves
# Tolerance : Float (e.g. 0.001)

tol = 0.1 # Tolerance if Tolerance and Tolerance > 0 else 0.001

# --------------------------------------------------
# 1. Construct COMPAS network
# --------------------------------------------------

network = Network()
vertex_map = {}

def add_vertex(pt):
    key = (
        round(pt.X / tol),
        round(pt.Y / tol),
        round(pt.Z / tol)
    )

    if key not in vertex_map:
        index = len(vertex_map)

        network.add_node(
            index,
            x=pt.X,
            y=pt.Y,
            z=pt.Z
        )

        vertex_map[key] = index

    return vertex_map[key]


for line in Lines:

    if isinstance(line, rg.Line):
        start = line.From
        end = line.To
    else:
        start = line.PointAtStart
        end = line.PointAtEnd

    u = add_vertex(start)
    v = add_vertex(end)

    if u != v:
        network.add_edge(u, v)


# --------------------------------------------------
# 2. Detect planar faces
# --------------------------------------------------

cycles = network.find_cycles()

# --------------------------------------------------
# 3. Extract face boundaries
# --------------------------------------------------

Faces = []
Polylines = []
FaceEdges = []

for cycle in cycles:

    points = [
        rg.Point3d(*network.node_coordinates(v))
        for v in cycle
    ]

    # Close the polygon
    if points[0] != points[-1]:
        points.append(points[0])

    polyline = rg.Polyline(points)

    # Signed XY area
    area = 0.0

    for i in range(len(points) - 1):
        a = points[i]
        b = points[i + 1]

        area += a.X * b.Y - b.X * a.Y

    area *= 0.5

    # Keep bounded faces only
    # Assumes CCW bounded cycles
    if area <= tol * tol:
        continue

    Faces.append(cycle)
    Polylines.append(polyline.ToNurbsCurve())

    edges = [
        rg.Line(points[i], points[i + 1])
        for i in range(len(points) - 1)
    ]

    FaceEdges.append(edges)


Network = network
# ---------- end py3_3 ----------
crv_11 = Curve(py3_3.Polylines)
offset_2 = OffsetCurve(Curve=crv_11, Distance=neg_2, Corners=1)

unit_curves = Curve(simplify(graft(geo)))
facade_curve = Curve(crv_5)
crv_12 = Curve(facade_curve)
ccx = CurveCurve(CurveA=crv_12, CurveB=unit_curves)  # -> Points, ParamsA, ParamsB
shatter = Shatter(Curve=unit_curves, Parameters=ccx.ParamsB)
curvepoint = PointOnCurve(shatter, parameter=0.5)
crv_cp = CurveClosestPoint(Point=curvepoint, Curve=crv_12)  # -> Point, Parameter, Distance
smaller = SmallerThan(FirstNumber=crv_cp.Distance, SecondNumber=0.1)  # -> SmallerThan, OrEqualTo
cull = CullPattern(List=shatter, CullPattern=smaller.SmallerThan)
join = JoinCurves(Curves=cull, Preserve=False)  # -> simplify(Curves)

fsettings = FitSettings(
    WidthInterior=100,
    WidthExterior=200,
    DownScaling=Slider(0.95, range=0..1),
    UpScaling=Slider(1.1, range=0..10),
    ThresholdScore=0,
    AmountOptions=3,
    UnitSystem=4)
item = ListItem(List=join, Index=0, Wrap=True)
fit = PlanFit(
    Boundary=unit_curves,
    EntranceS=item,
    FacadeS=item,
    Beds=-1,
    Baths=-1,
    Country=26,
    FitSettings=fsettings,
    InHousePlans=False)

item_2 = ListItem(List=fit, Index=Slider(0, range=0..5), Wrap=True)
deconstruct_plan = DeconstructPlan(Plan=item_2)  # -> InteriorWalls, ExteriorWalls, Doors, Glass, WindowFrame, Furniture, Scoring, InternalRoomCurves, DoorBlockInstances, PointBasedFurnitureBlockInstances
