# Grasshopper definition DR_FormFinding.gh (Grasshopper 1.0.8)
# plug-ins: Karamba3D, Human, Weaverbird

# Pure tension net
crv = Curve(<curve referenced from the Rhino model>)
# Tension net + struts
crv_2 = Curve(<curve referenced from the Rhino model>)
boundary = BoundarySurfaces(Edges=crv)
boundary_2 = BoundarySurfaces(Edges=crv_2)
mesh = Mesh(boundary)
mesh_2 = Mesh(boundary_2)
wbcatmullclark = WeaverbirdsCatmullClarkSubdivision(MeshCurves=mesh, Level=Slider(3, range=1..3), SmoothNakedEdges=Slider(0, range=0..3))
wbcatmullclark_2 = WeaverbirdsCatmullClarkSubdivision(MeshCurves=mesh_2, Level=Slider(3, range=1..3), SmoothNakedEdges=Slider(0, range=0..3))
medges = MeshEdges(Mesh=wbcatmullclark)  # -> flatten(NakedEdges), flatten(InteriorEdges), NonManifoldEdges
medges_2 = MeshEdges(Mesh=wbcatmullclark_2)  # -> flatten(NakedEdges), flatten(InteriorEdges), NonManifoldEdges

# ----
# Simple case
# Membrane outline elements
crv_3 = Curve([<curve referenced from the Rhino model> x12])

# ----
# Boundary
pt = Point([<point referenced from the Rhino model> x4])

# ----
# Drag to the right to increase stiffness and prestress
# of outline elements
membrane_outline_elements = Slider(1, range=1..3)

# ----
# Drag to the right to increase stiffness and prestress
# of internal elements
membrane_inner_elements = Slider(1, range=1..3)

# ----
# Membrane inner elements
crv_4 = Curve([<curve referenced from the Rhino model> x12])

# ----
# Feel free to move these points in Rhino!
pt_2 = Point([<point referenced from the Rhino model> x2])

# ----
# Target boundary points
panel = Panel("""1
3""")
replace = ReplaceItems(List=pt, Item=pt_2, Indices=panel, Wrap=False)

# ----
# Tension net + ring
# Membrane outline elements
crv_5 = Curve([<curve referenced from the Rhino model> x64])

# ----
# Membrane inner elements
crv_6 = Curve([<curve referenced from the Rhino model> x418])

# ----
# Tension ring
crv_7 = Curve([<curve referenced from the Rhino model> x28])

# ----
# Isolated struts
crv_8 = Curve(<curve referenced from the Rhino model>)

# ----
# Boundary
pt_3 = Point([<point referenced from the Rhino model> x6])

# ----
# Target boundary points
pt_4 = Point([<point referenced from the Rhino model> x3])
panel_2 = Panel("""0
1
3""")
replace_2 = ReplaceItems(List=pt_3, Item=pt_4, Indices=panel_2, Wrap=False)

# ----
# Boundary
pt_5 = Point([<point referenced from the Rhino model> x6])

# ----
# Target boundary points
pt_6 = Point([<point referenced from the Rhino model> x2])
panel_3 = Panel("""0
1""")
replace_3 = ReplaceItems(List=pt_5, Item=pt_6, Indices=panel_3, Wrap=False)

# ----
# Tension net +
# compression ring
# Membrane outline elements
crv_9 = Curve([<curve referenced from the Rhino model> x64])

# ----
# Membrane inner elements
crv_10 = Curve([<curve referenced from the Rhino model> x418])

# ----
# Compression ring
crv_11 = Curve([<curve referenced from the Rhino model> x28])

# ----
# Isolated struts
crv_12 = Curve([<curve referenced from the Rhino model> x2])

# ----
# Cables connected to struts
crv_13 = Curve([<curve referenced from the Rhino model> x28])

# ----
# Boundary
pt_7 = Point([<point referenced from the Rhino model> x14])

# ----
# Target boundary points
pt_8 = Point([<point referenced from the Rhino model> x2])
panel_4 = Panel("""0
7""")
replace_4 = ReplaceItems(List=pt_7, Item=pt_8, Indices=panel_4, Wrap=False)

# ----
# Membrane outline elements
crv_14 = Curve(medges_2.NakedEdges)

# ----
# Membrane inner elements
crv_15 = Curve(medges_2.InteriorEdges)

# ----
# Struts connected to boundary
crv_16 = Curve([<curve referenced from the Rhino model> x6])

# ----
# Cables connected to boundary
crv_17 = Curve([<curve referenced from the Rhino model> x6])

# ----
# Membrane outline elements
crv_18 = Curve(medges.NakedEdges)

# ----
# Membrane inner elements
crv_19 = Curve(medges.InteriorEdges)

# ----
# Cables connected to boundary
crv_20 = Curve([<curve referenced from the Rhino model> x6])

# ----
# Boundary
pt_9 = Point([<point referenced from the Rhino model> x8])

# ----
# Target boundary points
panel_5 = Panel("""6
7""")
pt_10 = Point([<point referenced from the Rhino model> x2])
replace_5 = ReplaceItems(List=pt_9, Item=pt_10, Indices=panel_5, Wrap=False)

# ----
# Input variables
merge = Merge(Data1=crv_18, Data2=crv_19)
end = EndPoints(Curve=merge)  # -> Start, End
merge_2 = Merge(Data1=merge, Data2=crv_20)  # -> flatten(Result)
pt_11 = Point(flatten([end.Start, end.End]))
end_2 = EndPoints(Curve=merge_2)  # -> Start, End
duppt = RemoveDuplicatePts(Points=[pt_11, pt_9], Tolerance=0.01)
pt_12 = Point(flatten(duppt))
cps = ClosestPointsKaramba3D(Point=pt_9, Cloud=pt_12, NumberOfNeighbours=1, LimitDistance=-1)  # -> Points, Index, Distance
cps_2 = ClosestPointsKaramba3D(Point=end_2.Start, Cloud=pt_12, NumberOfNeighbours=1, LimitDistance=-1)  # -> Points, Index, Distance
cps_3 = ClosestPointsKaramba3D(Point=end_2.End, Cloud=pt_12, NumberOfNeighbours=1, LimitDistance=-1)  # -> Points, Index, Distance
num = Number(simplify(cps_2.Index))
num_2 = Number(simplify(cps_3.Index))
num_3 = Number(flatten(cps.Index))
num_4 = Number(simplify([num, num_2]))

# ----
# Input variables
merge_3 = Merge(Data1=crv_14, Data2=crv_15)
end_3 = EndPoints(Curve=merge_3)  # -> Start, End
merge_4 = Merge(Data1=merge_3, Data2=crv_16, Data3=crv_17)  # -> flatten(Result)
pt_13 = Point(flatten([end_3.Start, end_3.End]))
duppt_2 = RemoveDuplicatePts(Points=[pt_13, pt_7], Tolerance=0.01)
end_4 = EndPoints(Curve=merge_4)  # -> Start, End
pt_14 = Point(flatten(duppt_2))
cps_4 = ClosestPointsKaramba3D(Point=pt_7, Cloud=pt_14, NumberOfNeighbours=1, LimitDistance=-1)  # -> Points, Index, Distance
cps_5 = ClosestPointsKaramba3D(Point=end_4.Start, Cloud=pt_14, NumberOfNeighbours=1, LimitDistance=-1)  # -> Points, Index, Distance
cps_6 = ClosestPointsKaramba3D(Point=end_4.End, Cloud=pt_14, NumberOfNeighbours=1, LimitDistance=-1)  # -> Points, Index, Distance
num_5 = Number(flatten(cps_4.Index))
num_6 = Number(simplify(cps_5.Index))
num_7 = Number(simplify(cps_6.Index))
num_8 = Number(simplify([num_6, num_7]))

# ----
# Input variables
merge_5 = Merge(Data1=crv_3, Data2=crv_4)  # -> flatten(Result)
end_5 = EndPoints(Curve=merge_5)  # -> Start, End
pt_15 = Point(flatten([end_5.Start, end_5.End]))
duppt_3 = RemoveDuplicatePts(Points=[pt_15, pt], Tolerance=0.01)
pt_16 = Point(flatten(duppt_3))
cps_7 = ClosestPointsKaramba3D(Point=pt, Cloud=pt_16, NumberOfNeighbours=1, LimitDistance=-1)  # -> Points, Index, Distance
cps_8 = ClosestPointsKaramba3D(Point=end_5.Start, Cloud=pt_16, NumberOfNeighbours=1, LimitDistance=-1)  # -> Points, Index, Distance
cps_9 = ClosestPointsKaramba3D(Point=end_5.End, Cloud=pt_16, NumberOfNeighbours=1, LimitDistance=-1)  # -> Points, Index, Distance
num_9 = Number(simplify(cps_8.Index))
num_10 = Number(simplify(cps_9.Index))
num_11 = Number(flatten(cps_7.Index))
num_12 = Number(simplify([num_9, num_10]))

# ----
# Input variables
# Set initial length L0 [m]:
# Input length multiplied by a scalar
merge_6 = Merge(Data1=crv_9, Data2=crv_10, Data3=crv_11, Data4=crv_12, Data5=crv_13)  # -> flatten(Result)
end_6 = EndPoints(Curve=crv_10)  # -> Start, End
end_7 = EndPoints(Curve=crv_12)  # -> Start, End
pt_17 = Point(flatten([end_6.Start, end_6.End]))
pt_18 = Point(flatten([end_7.Start, end_7.End]))
duppt_4 = RemoveDuplicatePts(Points=[pt_17, pt_18, pt_5], Tolerance=0.01)
len = Length(Curve=merge_6)  # -> flatten(Length)
pt_19 = Point(flatten(duppt_4))
end_8 = EndPoints(Curve=merge_6)  # -> Start, End
cps_10 = ClosestPointsKaramba3D(Point=pt_5, Cloud=pt_19, NumberOfNeighbours=1, LimitDistance=-1)  # -> Points, Index, Distance
cps_11 = ClosestPointsKaramba3D(Point=end_8.Start, Cloud=pt_19, NumberOfNeighbours=1, LimitDistance=-1)  # -> Points, Index, Distance
cps_12 = ClosestPointsKaramba3D(Point=end_8.End, Cloud=pt_19, NumberOfNeighbours=1, LimitDistance=-1)  # -> Points, Index, Distance
num_13 = Number(flatten(cps_10.Index))
num_14 = Number(simplify(cps_11.Index))
num_15 = Number(simplify(cps_12.Index))
num_16 = Number(simplify([num_14, num_15]))

end_9 = EndPoints(Curve=crv_8)  # -> Start, End
end_10 = EndPoints(Curve=crv_6)  # -> Start, End

# ----
# Set loads [kN]:
# Constant downward load
vertical_load = Slider(-0.1, range=-0.1..0.1)
Z = UnitZ(Factor=vertical_load)
lng = ListLength(List=pt_16)
repeat = RepeatData(Data=Z, Length=lng)  # -> flatten(Data)

pt_20 = Point(flatten([end_9.Start, end_9.End]))
pt_21 = Point(flatten([end_10.Start, end_10.End]))
duppt_5 = RemoveDuplicatePts(Points=[pt_21, pt_20, pt_3], Tolerance=0.01)

# ----
# Input variables
# Set initial length L0 [m]:
# Input length multiplied by a scalar
merge_7 = Merge(Data1=crv_5, Data2=crv_6, Data3=crv_7, Data4=crv_8)  # -> flatten(Result)
len_2 = Length(Curve=merge_7)  # -> flatten(Length)
end_11 = EndPoints(Curve=merge_7)  # -> Start, End
pt_22 = Point(flatten(duppt_5))
cps_13 = ClosestPointsKaramba3D(Point=pt_3, Cloud=pt_22, NumberOfNeighbours=1, LimitDistance=-1)  # -> Points, Index, Distance
cps_14 = ClosestPointsKaramba3D(Point=end_11.Start, Cloud=pt_22, NumberOfNeighbours=1, LimitDistance=-1)  # -> Points, Index, Distance
cps_15 = ClosestPointsKaramba3D(Point=end_11.End, Cloud=pt_22, NumberOfNeighbours=1, LimitDistance=-1)  # -> Points, Index, Distance
num_17 = Number(flatten(cps_13.Index))
num_18 = Number(simplify(cps_14.Index))
num_19 = Number(simplify(cps_15.Index))
num_20 = Number(simplify([num_18, num_19]))

lng_2 = ListLength(List=crv_15)

# ----
# Set element stiffness EA / L0 [1e5 kN/m]
lng_3 = ListLength(List=crv_14)
lng_4 = ListLength(List=crv_16)
lng_5 = ListLength(List=crv_17)
membrane_outline_elements_2 = Slider(45, range=0..50)
membrane_inner_elements_2 = Slider(10, range=0..50)
struts_connected_to_boundary = Slider(60, range=0..100)
cables_connected_to_boundary = Slider(40, range=0..50)
repeat_2 = RepeatData(Data=membrane_outline_elements_2, Length=lng_3)  # -> flatten(Data)
repeat_3 = RepeatData(Data=membrane_inner_elements_2, Length=lng_2)  # -> flatten(Data)
repeat_4 = RepeatData(Data=struts_connected_to_boundary, Length=lng_4)  # -> flatten(Data)
repeat_5 = RepeatData(Data=cables_connected_to_boundary, Length=lng_5)  # -> flatten(Data)
merge_8 = Merge(Data1=repeat_2, Data2=repeat_3, Data3=repeat_4, Data4=repeat_5)

# ----
# Set element stiffness EA / L0 [1e5 kN/m]
lng_6 = ListLength(List=crv_5)
lng_7 = ListLength(List=crv_6)
lng_8 = ListLength(List=crv_7)
lng_9 = ListLength(List=crv_8)
isolated_struts = Slider(50, range=0..50)
membrane_outline_elements_3 = Slider(30, range=0..50)
membrane_inner_elements_3 = Slider(10, range=0..50)
tension_ring_elements = Slider(20, range=0..100)
repeat_6 = RepeatData(Data=membrane_outline_elements_3, Length=lng_6)  # -> flatten(Data)
repeat_7 = RepeatData(Data=membrane_inner_elements_3, Length=lng_7)  # -> flatten(Data)
repeat_8 = RepeatData(Data=tension_ring_elements, Length=lng_8)  # -> flatten(Data)
repeat_9 = RepeatData(Data=isolated_struts, Length=lng_9)  # -> flatten(Data)
merge_9 = Merge(Data1=repeat_6, Data2=repeat_7, Data3=repeat_8, Data4=repeat_9)

# ----
# Set element stiffness EA / L0 [1e5 kN/m]
lng_10 = ListLength(List=crv_18)
lng_11 = ListLength(List=crv_19)
cables_connected_to_boundary_2 = Slider(40, range=0..50)
lng_12 = ListLength(List=crv_20)
membrane_outline_elements_4 = Slider(50, range=0..80)
membrane_inner_elements_4 = Slider(10, range=0..50)
repeat_10 = RepeatData(Data=membrane_outline_elements_4, Length=lng_10)  # -> flatten(Data)
repeat_11 = RepeatData(Data=membrane_inner_elements_4, Length=lng_11)  # -> flatten(Data)
repeat_12 = RepeatData(Data=cables_connected_to_boundary_2, Length=lng_12)  # -> flatten(Data)
merge_10 = Merge(Data1=repeat_10, Data2=repeat_11, Data3=repeat_12)

struts_connected_to_boundary_group_a = Slider(1.2, range=0..1.5)
struts_connected_to_boundary_group_b = Slider(2.15, range=0..4)

# ----
# Loads [kN]:
# Constant downward load
number_slider = Slider(-0.01, range=-0.1..0.1)
Z_2 = UnitZ(Factor=number_slider)
lng_13 = ListLength(List=pt_22)
repeat_13 = RepeatData(Data=Z_2, Length=lng_13)  # -> flatten(Data)

tension_ring_elements_2 = Slider(0.85, range=0..1)
membrane_outline_elements_5 = Slider(0.85, range=0..1)
membrane_inner_elements_5 = Slider(0.7, range=0..1)
isolated_struts_2 = Slider(1.5, range=0..1.5)
addition = Addition(A=lng_7, B=lng_6)
addition_2 = Addition(A=addition, B=lng_8)
series = Series(Start=0, Step=1, Count=lng_7)
series_2 = Series(Start=lng_7, Step=1, Count=lng_6)
series_3 = Series(Start=addition, Step=1, Count=lng_8)
series_4 = Series(Start=addition_2, Step=1, Count=lng_9)
item = ListItem(List=len_2, Index=series, Wrap=True)
item_2 = ListItem(List=len_2, Index=series_2, Wrap=True)
item_3 = ListItem(List=len_2, Index=series_3, Wrap=True)
item_4 = ListItem(List=len_2, Index=series_4, Wrap=True)
multiplication = Multiplication(A=item, B=membrane_outline_elements_5)
multiplication_2 = Multiplication(A=item_2, B=membrane_inner_elements_5)
multiplication_3 = Multiplication(A=item_3, B=tension_ring_elements_2)
multiplication_4 = Multiplication(A=item_4, B=isolated_struts_2)
merge_11 = Merge(Data1=multiplication, Data2=multiplication_2, Data3=multiplication_3, Data4=multiplication_4)  # -> flatten(Result)

# ----
# Loads [kN]:
# Constant downward load
number_slider_2 = Slider(-0.01, range=-0.1..0.1)
Z_3 = UnitZ(Factor=number_slider_2)
lng_14 = ListLength(List=pt_19)
repeat_14 = RepeatData(Data=Z_3, Length=lng_14)  # -> flatten(Data)

membrane_outline_elements_6 = Slider(30, range=0..50)

# ----
# Set element stiffness EA / L0 [1e5 kN/m]
lng_15 = ListLength(List=crv_10)
lng_16 = ListLength(List=crv_9)
lng_17 = ListLength(List=crv_11)
lng_18 = ListLength(List=crv_12)
lng_19 = ListLength(List=crv_13)
membrane_inner_elements_6 = Slider(10, range=0..50)
compression_ring = Slider(80, range=0..100)
isolated_struts_3 = Slider(80, range=0..80)
cables_connected_to_struts = Slider(3, range=0..50)
repeat_15 = RepeatData(Data=membrane_outline_elements_6, Length=lng_16)  # -> flatten(Data)
repeat_16 = RepeatData(Data=membrane_inner_elements_6, Length=lng_15)  # -> flatten(Data)
repeat_17 = RepeatData(Data=compression_ring, Length=lng_17)  # -> flatten(Data)
repeat_18 = RepeatData(Data=isolated_struts_3, Length=lng_18)  # -> flatten(Data)
repeat_19 = RepeatData(Data=cables_connected_to_struts, Length=lng_19)  # -> flatten(Data)
merge_12 = Merge(Data1=repeat_15, Data2=repeat_16, Data3=repeat_17, Data4=repeat_18, Data5=repeat_19)

# ----
# Set loads [kN]:
# Constant downward load
number_slider_3 = Slider(-0.03, range=-0.1..0.1)
Z_4 = UnitZ(Factor=number_slider_3)
lng_20 = ListLength(List=pt_12)
repeat_20 = RepeatData(Data=Z_4, Length=lng_20)  # -> flatten(Data)

# ----
# Set initial forces f0 [kN]:
# Constant pre-stressed value
membrane_outline_elements_7 = Slider(0.1, range=-0.3..0.3)
membrane_inner_elements_7 = Slider(0.1, range=-0.3..0.3)
struts_connected_to_boundary_2 = Slider(-0.1, range=-0.3..0.3)
cables_connected_to_boundary_3 = Slider(0.1, range=-0.3..0.3)
repeat_21 = RepeatData(Data=membrane_outline_elements_7, Length=lng_3)  # -> flatten(Data)
repeat_22 = RepeatData(Data=membrane_inner_elements_7, Length=lng_2)  # -> flatten(Data)
repeat_23 = RepeatData(Data=struts_connected_to_boundary_2, Length=lng_4)  # -> flatten(Data)
repeat_24 = RepeatData(Data=cables_connected_to_boundary_3, Length=lng_5)  # -> flatten(Data)
merge_13 = Merge(Data1=repeat_21, Data2=repeat_22, Data3=repeat_23, Data4=repeat_24)  # -> flatten(Result)

# ----
# Set initial forces f0 [kN]:
# Constant pre-stressed value
membrane_outline_elements_8 = Slider(0.3, range=-0.3..0.3)
membrane_inner_elements_8 = Slider(0.1, range=-0.3..0.3)
tension_ring_elements_3 = Slider(0.1, range=-0.3..0.3)
isolated_struts_4 = Slider(-0.1, range=-0.3..0.3)
repeat_25 = RepeatData(Data=membrane_outline_elements_8, Length=lng_7)  # -> flatten(Data)
repeat_26 = RepeatData(Data=membrane_inner_elements_8, Length=lng_6)  # -> flatten(Data)
repeat_27 = RepeatData(Data=tension_ring_elements_3, Length=lng_8)  # -> flatten(Data)
repeat_28 = RepeatData(Data=isolated_struts_4, Length=lng_9)  # -> flatten(Data)
merge_14 = Merge(Data1=repeat_25, Data2=repeat_26, Data3=repeat_27, Data4=repeat_28)  # -> flatten(Result)

membrane_inner_elements_9 = Slider(0.09, range=0..0.2)

# ----
# Drag to the left to avoid zegzag kinks
# which turns it into tension ring!
compression_ring_2 = Slider(1.65, range=0..1.65)

# ----
# Set initial forces f0 [kN]:
# Constant pre-stressed value
membrane_outline_elements_9 = Slider(0.1, range=-0.3..0.3)
membrane_inner_elements_10 = Slider(0.1, range=-0.3..0.3)
compression_ring_3 = Slider(-2, range=-2..0.3)
isolated_struts_5 = Slider(-0.3, range=-0.3..0.3)
cables_connected_to_struts_2 = Slider(0.3, range=-0.3..0.3)
repeat_29 = RepeatData(Data=membrane_outline_elements_9, Length=lng_16)  # -> flatten(Data)
repeat_30 = RepeatData(Data=membrane_inner_elements_10, Length=lng_15)  # -> flatten(Data)
repeat_31 = RepeatData(Data=compression_ring_3, Length=lng_17)  # -> flatten(Data)
repeat_32 = RepeatData(Data=isolated_struts_5, Length=lng_18)  # -> flatten(Data)
repeat_33 = RepeatData(Data=cables_connected_to_struts_2, Length=lng_19)  # -> flatten(Data)
merge_15 = Merge(Data1=repeat_29, Data2=repeat_30, Data3=repeat_31, Data4=repeat_32, Data5=repeat_33)  # -> flatten(Result)

# ----
# Loads [kN]:
# Constant downward load
number_slider_4 = Slider(-0.01, range=-0.1..0.1)
Z_5 = UnitZ(Factor=number_slider_4)
lng_21 = ListLength(List=pt_14)
repeat_34 = RepeatData(Data=Z_5, Length=lng_21)  # -> flatten(Data)

# ----
# Set initial length L0 [m]:
# Input length multiplied by a scalar
number_slider_5 = Slider(0.7, range=0..1)
len_3 = Length(Curve=merge_2)  # -> flatten(Length)
multiplication_5 = Multiplication(A=len_3, B=number_slider_5)

# ----
# Set initial forces f0 [kN]:
# Constant pre-stressed value
number_slider_6 = Slider(0.1, range=0..0.3)
lng_22 = ListLength(List=len_3)
repeat_35 = RepeatData(Data=number_slider_6, Length=lng_22)  # -> flatten(Data)

repeat_36 = RepeatData(Data=membrane_inner_elements_9, Length=lng_15)

membrane_outline_elements_10 = Slider(0.7, range=0..1)
isolated_struts_6 = Slider(1.05, range=0..1.5)
cables_connected_to_struts_3 = Slider(0.123, range=0..0.5)
addition_3 = Addition(A=lng_16, B=lng_15)
addition_4 = Addition(A=addition_3, B=lng_17)
series_5 = Series(Start=addition_3, Step=1, Count=lng_17)
series_6 = Series(Start=addition_4, Step=1, Count=lng_18)
series_7 = Series(Start=0, Step=1, Count=lng_16)
item_5 = ListItem(List=len, Index=series_5, Wrap=True)
item_6 = ListItem(List=len, Index=series_6, Wrap=True)
item_7 = ListItem(List=len, Index=series_7, Wrap=True)
repeat_37 = RepeatData(Data=cables_connected_to_struts_3, Length=lng_19)
multiplication_6 = Multiplication(A=item_7, B=membrane_outline_elements_10)
multiplication_7 = Multiplication(A=item_5, B=compression_ring_2)
multiplication_8 = Multiplication(A=item_6, B=isolated_struts_6)
merge_16 = Merge(Data1=multiplication_6, Data2=repeat_36, Data3=multiplication_7, Data4=multiplication_8, Data5=repeat_37)  # -> flatten(Result)

# ----
# DR Form Finding
number_slider_7 = Slider(1000, range=0..1000)
dr_solver = Python3Script(
    orig_nodes=pt_19,
    edges_from_node_idx=num_16,
    fixed_nodes_idx=num_13,
    target_fixed_nodes=replace_3,
    loads=repeat_14,
    stiffness=merge_12,
    edges_length=merge_16,
    edges_force=merge_15,
    max_iters=number_slider_7)  # -> out, nodes, edges, forces, reactions; inputs orig_nodes: list of Point3d, edges_from_node_idx: tree of Int32, fixed_nodes_idx: list of Int32, target_fixed_nodes: list of Point3d, loads: list of Vector3d, stiffness: list of Double, edges_length: list of Double, edges_force: list of Double, max_iters: Int32
# ---------- dr_solver: Python ----------
# -*- coding: utf-8 -*-
# Yinan Xiao 2026 02 09 17:53
# https://github.com/Yinan-Xiao

import numpy as np
import rhinoscriptsyntax as rs
import Rhino.Geometry as rg

"""
    Dynamic Relaxation Method (numpy version).
"""

# -------------------------------
# Read input parameters (GH)
# -------------------------------
# Node positions.
node_pos = np.array([[p.X, p.Y, p.Z] for p in orig_nodes], dtype=np.float64)

# Edge from end node indices.
flat = list(edges_from_node_idx.AllData())
edge_list = [[int(flat[i]), int(flat[i+1])] for i in range(0, len(flat), 2)]
edge_idx = np.array(edge_list, dtype=int)  # (m,2)

# Dimensions and distinguish between boundary and free nodes.
n = node_pos.shape[0]
m = edge_idx.shape[0]
fPts_idx = np.array([int(i) for i in fixed_nodes_idx], dtype=int)
nPts_idx = np.array(sorted(list(set(range(n)) - set(fPts_idx.tolist()))), dtype=int)
nPts_num = len(nPts_idx)

# Target positions for fixed nodes.
target_fixed_pos = None 
if 'target_fixed_nodes' in globals() and target_fixed_nodes is not None:
    if hasattr(target_fixed_nodes, "AllData"):
        tf_flat = list(target_fixed_nodes.AllData())
    else:
        tf_flat = list(target_fixed_nodes)

    if len(tf_flat) != len(fPts_idx):
        raise ValueError(
            "target_fixed_nodes must match fixed_nodes_idx length. "
            "len(target_fixed_nodes)=%d, len(fixed_nodes_idx)=%d"
            % (len(tf_flat), len(fPts_idx))
        )
    target_fixed_pos = np.array(
        [[p.X, p.Y, p.Z] for p in tf_flat],
        dtype=np.float64
    )  # (fPts_num,3)
else:
    target_fixed_pos = None

# External loads.
def vectors_to_array(vs, n):
    if vs is None:
        return np.zeros((n, 3), dtype=np.float64)
    # GH DataTree -> flatten
    if hasattr(vs, "AllData"):
        vs_flat = list(vs.AllData())
    else:
        vs_flat = list(vs)
    if len(vs_flat) != n:
        raise ValueError("Loads number must equal to node number n. For the moment n=%d, len(loads)=%d" % (n, len(vs_flat)))

    # Vector3d -> (x,y,z)
    return np.array(
        [[float(v.X), float(v.Y), float(v.Z)] for v in vs_flat],
        dtype=np.float64
    )
P_ext = vectors_to_array(loads if 'loads' in globals() else None, n) # (n,3)
P_ext_free = P_ext[nPts_idx]

# Edges length.
if hasattr(edges_length, "AllData"):
    l0 = np.array([float(v) for v in list(edges_length.AllData())], dtype=np.float64)
else:
    l0 = np.array(edges_length, dtype=np.float64)

# Edges internal forces.
if hasattr(edges_force, "AllData"):
    f0 = np.array([float(v) for v in list(edges_force.AllData())], dtype=np.float64)
else:
    f0 = np.array(edges_force, dtype=np.float64)

# Stiffness.
if 'stiffness' in globals() and stiffness is not None:
    if hasattr(stiffness, "AllData"):
        k_e = np.array([float(v) for v in list(stiffness.AllData())], dtype=np.float64)
    else:
        k_e = np.array(stiffness, dtype=np.float64)
else:
    k_e = np.ones(m, dtype=np.float64)

# Safety check: dimensions should be matched.
if len(l0) != m or len(f0) != m or len(k_e) != m:
    raise ValueError("m=%d, len(l0)=%d, len(f0)=%d, len(k)=%d do not match." %
                     (m, len(l0), len(f0), len(k_e)))

# -------------------------------
# Internal force function.
# -------------------------------
def calculate_internal_force(Node):
    n1 = edge_idx[:, 0]
    n2 = edge_idx[:, 1]

    vec_diff = Node[n2] - Node[n1]                          # (m,3)
    current_l = np.linalg.norm(vec_diff, axis=1)            # (m,)
    unit_vec = vec_diff / (current_l[:, None] + 1e-12)      # (m,3)

    force_mag = k_e * (current_l - l0) + f0                 # (m,)
    force_vec = force_mag[:, None] * unit_vec               # (m,3)

    f_in = np.zeros_like(Node)
    np.add.at(f_in, n1,  force_vec)
    np.add.at(f_in, n2, -force_vec)                         # (n,3)

    return f_in

# -------------------------------
# DR parameters.
# -------------------------------
zeta, h = 0.5, 0.1
c1 = 1.0 / (1.0 + 0.5 * zeta * h)
c2 = 1.0 - 0.5 * zeta * h
tol = 1e-10
mass = 1.0 # Corresponding to high stiffness (e.g. steel).
nmax = max_iters

displacement = np.zeros((nPts_num, 3), dtype=np.float64)
pre1 = np.zeros_like(displacement)
pre2 = np.zeros_like(displacement)

ReturnNode = node_pos.copy()
if target_fixed_pos is not None:
    ReturnNode[fPts_idx] = target_fixed_pos

# -------------------------------
# Iteration
# -------------------------------
for step in range(1, nmax+1):
    Node = ReturnNode.copy()
    Node[nPts_idx] += displacement
    if target_fixed_pos is not None:
        Node[fPts_idx] = target_fixed_pos

    f_in_free = calculate_internal_force(Node)[nPts_idx]  # (nPts_num,3)
    R_free = P_ext_free + f_in_free # R_free = P_ext_free + f_in_free
    loss = 0.5 * np.sum(R_free ** 2)

    if loss.item() < tol:
        break

    if step == 1:
        displacement = (R_free / mass) * (h ** 2 / 2.0)
    else:
        displacement = (R_free / mass) * (c1 * h**2) + 2.0 * pre1 * c1 - pre2 * (c1 * c2)

    pre2 = pre1.copy()
    pre1 = displacement.copy()

print("Iters:", step)
print("Loss:", loss)

# -------------------------------
# Output.
# -------------------------------
nodes = []
for p in Node:
    nodes.append(rs.CreatePoint(float(p[0]), float(p[1]), float(p[2])))

edges = []
for e in range(m):
    a = int(edge_idx[e, 0])
    b = int(edge_idx[e, 1])
    pt_a = (float(Node[a,0]), float(Node[a,1]), float(Node[a,2]))
    pt_b = (float(Node[b,0]), float(Node[b,1]), float(Node[b,2]))
    edges.append(rs.AddLine(pt_a, pt_b))

n1 = edge_idx[:, 0]
n2 = edge_idx[:, 1]
vec = Node[n2] - Node[n1]                      # (m,3)
length = np.linalg.norm(vec, axis=1)           # (m,)
N = k_e * (length - l0) + f0                   # (m,)
forces = [float(v) for v in N]

reactions = []
f_all_final = calculate_internal_force(Node)    # (n,3)
R_all = P_ext + f_all_final                     # (n,3)
for idx in fPts_idx.tolist():   # Fixed node indices.
    rf = -R_all[idx]            # torch tensor, shape (3,).
    reactions.append(rg.Vector3d(float(rf[0]), float(rf[1]), float(rf[2])))
# ---------- end dr_solver ----------
panel_6 = Panel(dr_solver.out)
points = PointList(Points=dr_solver.nodes, Size=Slider(0.03, range=0..1))

# ----
# DR Form Finding
number_slider_8 = Slider(1000, range=0..1000)
dr_solver_2 = Python3Script(
    orig_nodes=pt_12,
    edges_from_node_idx=num_4,
    fixed_nodes_idx=num_3,
    target_fixed_nodes=replace_5,
    loads=repeat_20,
    stiffness=merge_10,
    edges_length=multiplication_5,
    edges_force=repeat_35,
    max_iters=number_slider_8)  # -> out, nodes, edges, forces, reactions; inputs orig_nodes: list of Point3d, edges_from_node_idx: tree of Int32, fixed_nodes_idx: list of Int32, target_fixed_nodes: list of Point3d, loads: list of Vector3d, stiffness: list of Double, edges_length: list of Double, edges_force: list of Double, max_iters: Int32; same code as dr_solver
panel_7 = Panel(dr_solver_2.out)
points_2 = PointList(Points=dr_solver_2.nodes, Size=Slider(0.03, range=0..1))

# ----
# DR Form Finding
number_slider_9 = Slider(1000, range=0..1000)
dr_solver_3 = Python3Script(
    orig_nodes=pt_22,
    edges_from_node_idx=num_20,
    fixed_nodes_idx=num_17,
    target_fixed_nodes=replace_2,
    loads=repeat_13,
    stiffness=merge_9,
    edges_length=merge_11,
    edges_force=merge_14,
    max_iters=number_slider_9)  # -> out, nodes, edges, forces, reactions; inputs orig_nodes: list of Point3d, edges_from_node_idx: tree of Int32, fixed_nodes_idx: list of Int32, target_fixed_nodes: list of Point3d, loads: list of Vector3d, stiffness: list of Double, edges_length: list of Double, edges_force: list of Double, max_iters: Int32; same code as dr_solver
panel_8 = Panel(dr_solver_3.out)
points_3 = PointList(Points=dr_solver_3.nodes, Size=Slider(0.03, range=0..1))

# ----
# Visual thickness of elements
# based on force value
number_slider_10 = Slider(1.5, range=0..5)

# ----
# Visual thickness of loads
# and reaction force vectors
number_slider_11 = Slider(3, range=0..5)

# ----
# Visual thickness of elements
# based on force value
number_slider_12 = Slider(3, range=0..5)

# ----
# Visual thickness of loads
# and reaction force vectors
number_slider_13 = Slider(3, range=0..5)

# ----
# Visual thickness of elements
# based on force value
number_slider_14 = Slider(2, range=0..5)

# ----
# Visual thickness of loads
# and reaction force vectors
number_slider_15 = Slider(3, range=0..5)

# ----
# Visual thickness of elements
# based on force value
number_slider_16 = Slider(3, range=0..5)

# ----
# Visual thickness of loads
# and reaction force vectors
number_slider_17 = Slider(3, range=0..5)

# ----
# Visualization
panel_9 = Panel("0")
line = LineSDL(Start=replace_5, Direction=dr_solver_2.reactions, Length=dr_solver_2.reactions)
data = Data(dr_solver_2.forces)
smaller = SmallerThan(FirstNumber=data, SecondNumber=panel_9)  # -> SmallerThan, OrEqualTo
pt_23 = Point(dr_solver_2.nodes)
line_2 = LineSDL(Start=pt_23, Direction=repeat_20, Length=repeat_20)
crv_21 = Curve(dr_solver_2.edges)
dispatch = Dispatch(List=crv_21, DispatchPattern=smaller.SmallerThan)  # -> ListA, ListB
swatch = ColourSwatch(SwatchColor=RGB(0, 100, 0))
panel_10 = Panel(data)
previewlw = CustomPreviewLineweights(Geometry=line, Shader=swatch, Thickness=number_slider_17, Absolute=False)
previewlw_2 = CustomPreviewLineweights(Geometry=line_2, Shader=swatch, Thickness=number_slider_17, Absolute=False)
py3 = Python3Script(
    G=crv_21,
    S_T=ColourSwatch(SwatchColor=RGB(12, 158, 190)),
    S_C=ColourSwatch(SwatchColor=RGB(225, 32, 40)),
    T=data,
    th=number_slider_16)  # -> out, a; inputs G: list of Curve, T: list of Double, th: Double
# ---------- py3: Python ----------
# -*- coding: utf-8 -*-
# Yinan Xiao 2026 01 30 09:56
# https://github.com/Yinan-Xiao

import System
import Rhino
import Rhino as rc
import Grasshopper
from ghpythonlib.componentbase import executingcomponent as component

import Rhino.Geometry as rg
from System.Drawing import Color
from Rhino.Display import DisplayMaterial


class MyComponent(component):
    def __init__(self):
        super().__init__()

        self.G = []
        self.T = []
        self.color_T = Color.White
        self.color_C = Color.Gray
        self.thickness = 1.0

    # -----------------------------
    # Color / DisplayMaterial input.
    # -----------------------------
    def _get_color(self, S, default):
        if S is None:
            return default
        if isinstance(S, Color):
            return S
        if isinstance(S, DisplayMaterial):
            return S.Diffuse
        try:
            if hasattr(S, "ToColor"):
                return S.ToColor()
        except:
            pass
        return default

    # -----------------------------
    # GH main.
    # -----------------------------
    def RunScript(self,
            G: list[Rhino.Geometry.Curve],
            S_T,
            S_C,
            T: list[float],
            th: float):

        self.G = G if G else []
        self.T = T if T else []

        self.color_T = self._get_color(S_T, Color.White)
        self.color_C = self._get_color(S_C, Color.Gray)
        self.thickness = th

        # return len(self.G)
        return None

    # -----------------------------
    # View lines.
    # -----------------------------
    def DrawViewportWires(self, arg):
        if not self.G or not self.T:
            return
        n = min(len(self.G), len(self.T))
        if n <= 0:
            return

        for i in range(n):
            crv = self.G[i]
            tv = self.T[i]

            if crv is None:
                continue

            col = self.color_C if tv < 0 else self.color_T
            thick = max(1, int(abs(tv) * self.thickness))

            # Draw lines.
            arg.Display.DrawCurve(crv, col, thick)
# ---------- end py3 ----------

# ----
# Visual thickness of elements
# based on force value
number_slider_18 = Slider(5, range=0..5)

# ----
# Visual thickness of loads
# and reaction force vectors
number_slider_19 = Slider(3, range=0..5)

# ----
# Visualization
panel_11 = Panel("0")
line_3 = LineSDL(Start=replace_2, Direction=dr_solver_3.reactions, Length=dr_solver_3.reactions)
data_2 = Data(dr_solver_3.forces)
smaller_2 = SmallerThan(FirstNumber=data_2, SecondNumber=panel_11)  # -> SmallerThan, OrEqualTo
pt_24 = Point(dr_solver_3.nodes)
line_4 = LineSDL(Start=pt_24, Direction=repeat_13, Length=repeat_13)
crv_22 = Curve(dr_solver_3.edges)
dispatch_2 = Dispatch(List=crv_22, DispatchPattern=smaller_2.SmallerThan)  # -> ListA, ListB
swatch_2 = ColourSwatch(SwatchColor=RGB(0, 100, 0))
panel_12 = Panel(data_2)
py3_2 = Python3Script(
    G=crv_22,
    S_T=ColourSwatch(SwatchColor=RGB(12, 158, 190)),
    S_C=ColourSwatch(SwatchColor=RGB(225, 32, 40)),
    T=data_2,
    th=number_slider_12)  # -> out, a; inputs G: list of Curve, T: list of Double, th: Double; same code as py3
previewlw_3 = CustomPreviewLineweights(Geometry=line_3, Shader=swatch_2, Thickness=number_slider_13, Absolute=False)
previewlw_4 = CustomPreviewLineweights(Geometry=line_4, Shader=swatch_2, Thickness=number_slider_13, Absolute=False)

# ----
# Visualization
panel_13 = Panel("0")
line_5 = LineSDL(Start=replace_3, Direction=dr_solver.reactions, Length=dr_solver.reactions)
data_3 = Data(dr_solver.forces)
smaller_3 = SmallerThan(FirstNumber=data_3, SecondNumber=panel_13)  # -> SmallerThan, OrEqualTo
pt_25 = Point(dr_solver.nodes)
line_6 = LineSDL(Start=pt_25, Direction=repeat_14, Length=repeat_14)
crv_23 = Curve(dr_solver.edges)
dispatch_3 = Dispatch(List=crv_23, DispatchPattern=smaller_3.SmallerThan)  # -> ListA, ListB
swatch_3 = ColourSwatch(SwatchColor=RGB(0, 100, 0))
panel_14 = Panel(data_3)
previewlw_5 = CustomPreviewLineweights(Geometry=line_5, Shader=swatch_3, Thickness=number_slider_15, Absolute=False)
previewlw_6 = CustomPreviewLineweights(Geometry=line_6, Shader=swatch_3, Thickness=number_slider_15, Absolute=False)
py3_3 = Python3Script(
    G=crv_23,
    S_T=ColourSwatch(SwatchColor=RGB(12, 158, 190)),
    S_C=ColourSwatch(SwatchColor=RGB(225, 32, 40)),
    T=data_3,
    th=number_slider_14)  # -> out, a; inputs G: list of Curve, T: list of Double, th: Double; same code as py3

# ----
# Evaluation
# Loadpath [kN*m]
len_4 = Length(Curve=dr_solver_2.edges)
abs = Absolute(Value=dr_solver_2.forces)
multiplication_9 = Multiplication(A=len_4, B=abs)
ma = MassAddition(Input=multiplication_9)  # -> Result, PartialResults
panel_15 = Panel(ma.Result)

# ----
# Max abs force value [kN]
abs_2 = Absolute(Value=dr_solver_2.forces)
sort = SortList(Keys=abs_2)  # -> Keys, ValuesA
rev = ReverseList(List=sort.Keys)
item_8 = ListItem(List=rev, Index=0, Wrap=True)
panel_16 = Panel(item_8)

# ----
# Total length [m]
len_5 = Length(Curve=dr_solver_2.edges)
ma_2 = MassAddition(Input=len_5)  # -> Result, PartialResults
panel_17 = Panel(ma_2.Result)

# ----
# Evaluation
# Loadpath [kN*m]
len_6 = Length(Curve=dr_solver_3.edges)
abs_3 = Absolute(Value=dr_solver_3.forces)
multiplication_10 = Multiplication(A=len_6, B=abs_3)
ma_3 = MassAddition(Input=multiplication_10)  # -> Result, PartialResults
panel_18 = Panel(ma_3.Result)

# ----
# Evaluation
# Loadpath [kN*m]
len_7 = Length(Curve=dr_solver.edges)
abs_4 = Absolute(Value=dr_solver.forces)
multiplication_11 = Multiplication(A=len_7, B=abs_4)
ma_4 = MassAddition(Input=multiplication_11)  # -> Result, PartialResults
panel_19 = Panel(ma_4.Result)

# ----
# Max abs force value [kN]
abs_5 = Absolute(Value=dr_solver_3.forces)
sort_2 = SortList(Keys=abs_5)  # -> Keys, ValuesA
rev_2 = ReverseList(List=sort_2.Keys)
item_9 = ListItem(List=rev_2, Index=0, Wrap=True)
panel_20 = Panel(item_9)

# ----
# Max abs force value [kN]
abs_6 = Absolute(Value=dr_solver.forces)
sort_3 = SortList(Keys=abs_6)  # -> Keys, ValuesA
rev_3 = ReverseList(List=sort_3.Keys)
item_10 = ListItem(List=rev_3, Index=0, Wrap=True)
panel_21 = Panel(item_10)

# ----
# Total length [m]
len_8 = Length(Curve=dr_solver_3.edges)
ma_5 = MassAddition(Input=len_8)  # -> Result, PartialResults
panel_22 = Panel(ma_5.Result)

# ----
# Total length [m]
len_9 = Length(Curve=dr_solver.edges)
ma_6 = MassAddition(Input=len_9)  # -> Result, PartialResults
panel_23 = Panel(ma_6.Result)

# ----
# Set element stiffness EA / L0 [1e5 kN/m]
lng_23 = ListLength(List=crv_3)
lng_24 = ListLength(List=crv_4)
membrane_outline_elements_11 = Slider(2, range=0..3)
membrane_inner_elements_11 = Slider(1, range=0..3)

multiplication_12 = Multiplication(A=membrane_outline_elements, B=membrane_outline_elements_11)
multiplication_13 = Multiplication(A=membrane_inner_elements, B=membrane_inner_elements_11)

repeat_38 = RepeatData(Data=multiplication_12, Length=lng_23)  # -> flatten(Data)
repeat_39 = RepeatData(Data=multiplication_13, Length=lng_24)  # -> flatten(Data)
merge_17 = Merge(Data1=repeat_38, Data2=repeat_39)

# ----
# Set initial length L0 [m]:
# Input length multiplied by a scalar
membrane_outline_elements_12 = Slider(0.7, range=0..1)
membrane_inner_elements_12 = Slider(0.7, range=0..1)
len_10 = Length(Curve=crv_3)  # -> flatten(Length)
len_11 = Length(Curve=crv_3)  # -> flatten(Length)

division = Division(A=membrane_outline_elements_12, B=membrane_outline_elements)
division_2 = Division(A=membrane_inner_elements_12, B=membrane_inner_elements)

multiplication_14 = Multiplication(A=len_10, B=division)
multiplication_15 = Multiplication(A=len_11, B=division_2)
merge_18 = Merge(Data1=multiplication_14, Data2=multiplication_15)

# ----
# Set initial forces f0 [kN]:
# Constant pre-stressed value
membrane_outline_elements_13 = Slider(0.1, range=0..0.3)
membrane_inner_elements_13 = Slider(0.1, range=0..0.3)
lng_25 = ListLength(List=len_10)
lng_26 = ListLength(List=len_11)

multiplication_16 = Multiplication(A=membrane_outline_elements, B=membrane_outline_elements_13)
multiplication_17 = Multiplication(A=membrane_inner_elements, B=membrane_inner_elements_13)

repeat_40 = RepeatData(Data=multiplication_17, Length=lng_26)  # -> flatten(Data)
repeat_41 = RepeatData(Data=multiplication_16, Length=lng_25)  # -> flatten(Data)
merge_19 = Merge(Data1=repeat_41, Data2=repeat_40)

# ----
# DR Form Finding
number_slider_20 = Slider(1000, range=0..1000)
dr_solver_4 = Python3Script(
    orig_nodes=pt_16,
    edges_from_node_idx=num_12,
    fixed_nodes_idx=num_11,
    target_fixed_nodes=replace,
    loads=repeat,
    stiffness=merge_17,
    edges_length=merge_18,
    edges_force=merge_19,
    max_iters=number_slider_20)  # -> out, nodes, edges, forces, reactions; inputs orig_nodes: list of Point3d, edges_from_node_idx: tree of Int32, fixed_nodes_idx: list of Int32, target_fixed_nodes: list of Point3d, loads: list of Vector3d, stiffness: list of Double, edges_length: list of Double, edges_force: list of Double, max_iters: Int32; same code as dr_solver
# Dynamic Relaxation (DR) + Membrane Structure v1.0 - Spring 2026
# Autor: Dr.-Ing. Yinan Xiao
# ynxiao@hku.hk
panel_24 = Panel(dr_solver_4.out)
points_4 = PointList(Points=dr_solver_4.nodes, Size=Slider(0.03, range=0..1))

# ----
# Visualization
panel_25 = Panel("0")
line_7 = LineSDL(Start=replace, Direction=dr_solver_4.reactions, Length=dr_solver_4.reactions)
data_4 = Data(dr_solver_4.forces)
smaller_4 = SmallerThan(FirstNumber=data_4, SecondNumber=panel_25)  # -> SmallerThan, OrEqualTo
pt_26 = Point(dr_solver_4.nodes)
line_8 = LineSDL(Start=pt_26, Direction=repeat, Length=repeat)
crv_24 = Curve(dr_solver_4.edges)
dispatch_4 = Dispatch(List=crv_24, DispatchPattern=smaller_4.SmallerThan)  # -> ListA, ListB
swatch_4 = ColourSwatch(SwatchColor=RGB(0, 100, 0))
panel_26 = Panel(data_4)
py3_4 = Python3Script(
    G=crv_24,
    S_T=ColourSwatch(SwatchColor=RGB(12, 158, 190)),
    S_C=ColourSwatch(SwatchColor=RGB(225, 32, 40)),
    T=data_4,
    th=number_slider_18)  # -> out, a; inputs G: list of Curve, T: list of Double, th: Double; same code as py3
previewlw_7 = CustomPreviewLineweights(Geometry=line_7, Shader=swatch_4, Thickness=number_slider_19, Absolute=False)
previewlw_8 = CustomPreviewLineweights(Geometry=line_8, Shader=swatch_4, Thickness=number_slider_19, Absolute=False)

# ----
# Evaluation
# Loadpath [kN*m]
len_12 = Length(Curve=dr_solver_4.edges)
abs_7 = Absolute(Value=data_4)
multiplication_18 = Multiplication(A=len_12, B=abs_7)
ma_7 = MassAddition(Input=multiplication_18)  # -> Result, PartialResults
panel_27 = Panel(ma_7.Result)

# ----
# Max abs force value [kN]
abs_8 = Absolute(Value=data_4)
sort_4 = SortList(Keys=abs_8)  # -> Keys, ValuesA
rev_4 = ReverseList(List=sort_4.Keys)
item_11 = ListItem(List=rev_4, Index=0, Wrap=True)
panel_28 = Panel(item_11)

# ----
# Total length [m]
len_13 = Length(Curve=crv_24)
ma_8 = MassAddition(Input=len_13)  # -> Result, PartialResults
panel_29 = Panel(ma_8.Result)

# ----
# Set initial length L0 [m]:
# Input length multiplied by a scalar
len_14 = Length(Curve=merge_4)  # -> flatten(Length)
addition_5 = Addition(A=lng_3, B=lng_2)
addition_6 = Addition(A=addition_5, B=lng_4)
membrane_inner_elements_14 = Slider(0.9, range=0..1)
cables_connected_to_boundary_4 = Slider(0.95, range=0..1)
membrane_outline_elements_14 = Slider(0.7, range=0..1)
series_8 = Series(Start=0, Step=1, Count=lng_3)
series_9 = Series(Start=lng_3, Step=1, Count=lng_2)
series_10 = Series(Start=addition_6, Step=1, Count=lng_5)
series_11 = Series(Start=addition_5, Step=1, Count=lng_4)
item_12 = ListItem(List=len_14, Index=series_8, Wrap=True)
item_13 = ListItem(List=len_14, Index=series_9, Wrap=True)
item_14 = ListItem(List=len_14, Index=series_11, Wrap=True)
item_15 = ListItem(List=len_14, Index=series_10, Wrap=True)
multiplication_19 = Multiplication(A=item_12, B=membrane_outline_elements_14)
multiplication_20 = Multiplication(A=item_13, B=membrane_inner_elements_14)
multiplication_21 = Multiplication(A=item_15, B=cables_connected_to_boundary_4)

cluster = Cluster(
    L=item_14,
    B=struts_connected_to_boundary_group_b,
    B_2=struts_connected_to_boundary_group_b,
    B_3=struts_connected_to_boundary_group_a,
    B_4=struts_connected_to_boundary_group_a,
    B_5=struts_connected_to_boundary_group_a,
    B_6=struts_connected_to_boundary_group_a)

merge_20 = Merge(Data1=multiplication_19, Data2=multiplication_20, Data3=cluster, Data4=multiplication_21)  # -> flatten(Result)

# ----
# DR Form Finding
number_slider_21 = Slider(1000, range=0..1000)
dr_solver_5 = Python3Script(
    orig_nodes=pt_14,
    edges_from_node_idx=num_8,
    fixed_nodes_idx=num_5,
    target_fixed_nodes=replace_4,
    loads=repeat_34,
    stiffness=merge_8,
    edges_length=merge_20,
    edges_force=merge_13,
    max_iters=number_slider_21)  # -> out, nodes, edges, forces, reactions; inputs orig_nodes: list of Point3d, edges_from_node_idx: tree of Int32, fixed_nodes_idx: list of Int32, target_fixed_nodes: list of Point3d, loads: list of Vector3d, stiffness: list of Double, edges_length: list of Double, edges_force: list of Double, max_iters: Int32; same code as dr_solver
panel_30 = Panel(dr_solver_5.out)
points_5 = PointList(Points=dr_solver_5.nodes, Size=Slider(0.03, range=0..1))

# ----
# Visualization
panel_31 = Panel("0")
line_9 = LineSDL(Start=replace_4, Direction=dr_solver_5.reactions, Length=dr_solver_5.reactions)
data_5 = Data(dr_solver_5.forces)
smaller_5 = SmallerThan(FirstNumber=data_5, SecondNumber=panel_31)  # -> SmallerThan, OrEqualTo
pt_27 = Point(dr_solver_5.nodes)
line_10 = LineSDL(Start=pt_27, Direction=repeat_34, Length=repeat_34)
crv_25 = Curve(dr_solver_5.edges)
dispatch_5 = Dispatch(List=crv_25, DispatchPattern=smaller_5.SmallerThan)  # -> ListA, ListB
swatch_5 = ColourSwatch(SwatchColor=RGB(0, 100, 0))
panel_32 = Panel(data_5)
py3_5 = Python3Script(
    G=crv_25,
    S_T=ColourSwatch(SwatchColor=RGB(12, 158, 190)),
    S_C=ColourSwatch(SwatchColor=RGB(225, 32, 40)),
    T=data_5,
    th=number_slider_10)  # -> out, a; inputs G: list of Curve, T: list of Double, th: Double; same code as py3
previewlw_9 = CustomPreviewLineweights(Geometry=line_9, Shader=swatch_5, Thickness=number_slider_11, Absolute=False)
previewlw_10 = CustomPreviewLineweights(Geometry=line_10, Shader=swatch_5, Thickness=number_slider_11, Absolute=False)

# ----
# Evaluation
# Loadpath [kN*m]
len_15 = Length(Curve=dr_solver_5.edges)
abs_9 = Absolute(Value=dr_solver_5.forces)
multiplication_22 = Multiplication(A=len_15, B=abs_9)
ma_9 = MassAddition(Input=multiplication_22)  # -> Result, PartialResults
panel_33 = Panel(ma_9.Result)

# ----
# Max abs force value [kN]
abs_10 = Absolute(Value=dr_solver_5.forces)
sort_5 = SortList(Keys=abs_10)  # -> Keys, ValuesA
rev_5 = ReverseList(List=sort_5.Keys)
item_16 = ListItem(List=rev_5, Index=0, Wrap=True)
panel_34 = Panel(item_16)

# ----
# Total length [m]
len_16 = Length(Curve=dr_solver_5.edges)
ma_10 = MassAddition(Input=len_16)  # -> Result, PartialResults
panel_35 = Panel(ma_10.Result)

# ==== cluster Cluster
L = ClusterInput()
item = ListItem(List=L, Index=0, Wrap=True)  # -> Item, Item1, Item2, Item3, Item4, Item5
B = ClusterInput()
B_2 = ClusterInput()
B_3 = ClusterInput()
B_4 = ClusterInput()
B_5 = ClusterInput()
B_6 = ClusterInput()
multiplication = Multiplication(A=item.Item, B=B)
multiplication_2 = Multiplication(A=item.Item1, B=B_2)
multiplication_3 = Multiplication(A=item.Item2, B=B_3)
multiplication_4 = Multiplication(A=item.Item3, B=B_4)
multiplication_5 = Multiplication(A=item.Item4, B=B_5)
multiplication_6 = Multiplication(A=item.Item5, B=B_6)
merge = Merge(
    Data1=multiplication,
    Data2=multiplication_2,
    Data3=multiplication_3,
    Data4=multiplication_4,
    Data5=multiplication_5,
    Data6=multiplication_6)
R = ClusterOutput(merge)
