# Grasshopper definition cluster_random_plan.gh (Grasshopper 1.0.8)
# plug-ins: Human, LunchBoxML, PlanFinderGH

fsettings = FitSettings(
    WidthInterior=100,
    WidthExterior=200,
    DownScaling=0.98,
    UpScaling=1.05,
    ThresholdScore=0,
    AmountOptions=Slider(15, range=0..100),
    UnitSystem=4)
dom = ConstructDomain(DomainStart=0, DomainEnd=Slider(7, range=0..100))
rectangle = Rectangle(Plane=PlaneXY(0, 0, 0), XSize=dom, YSize=dom, Radius=0)  # -> Rectangle, Length
crv = Curve(rectangle.Rectangle)

unit_curve = Curve(crv)
area = Area(Geometry=unit_curve)  # -> Area, Centroid
scale_nu = ScaleNU(Geometry=unit_curve, Plane=area.Centroid, ScaleX=Slider(1, range=0.5..1.5), ScaleY=Slider(1.1, range=0.5..1.5), ScaleZ=1)  # -> Geometry, Transform
evaluate_curve = EvaluateCurve(Curve=reparameterize(scale_nu.Geometry), Parameter=Slider(0.58, range=0..1))  # -> Point, Tangent, Angle

# ----
# Create Random Plans
plan_fit = PlanFit(
    Boundary=scale_nu.Geometry,
    EntranceS=evaluate_curve.Point,
    Beds=-1,
    Baths=-1,
    Country=26,
    FitSettings=fsettings,
    InHousePlans=False)
deconstruct_plan = DeconstructPlan(Plan=plan_fit)  # -> InteriorWalls, ExteriorWalls, DoorCurves, Glass, WindowFrames, Furniture, Score, InternalRoomCurves, DoorBlockInstances, PointBasedFurnitureBlockInstances
deconstruct_room = DeconstructRoom(Room=deconstruct_plan.InternalRoomCurves)  # -> Boundary, InteriorBoundary, Function, PointBasedFurnitureBlockInstances
script = Script(Blocks=deconstruct_plan.DoorBlockInstances)  # -> out, Points; inputs Blocks: list
# ---------- script: Python ----------
import Rhino
import Rhino.Geometry as rg

doc = Rhino.RhinoDoc.ActiveDoc

Points = []

for _x in Blocks:

    obj = _x.Value if hasattr(_x, "Value") else _x

    if not isinstance(obj, rg.InstanceReferenceGeometry):
        continue

    # Get actual block definition
    definition = doc.InstanceDefinitions.FindId(
        obj.ParentIdefId
    )

    if definition is None:
        continue

    # Only interior doors, excluding entrance doors
    if definition.Name == "PF_Door_2D":

        # Block insertion point in world coordinates
        pt = rg.Point3d.Origin
        pt.Transform(obj.Xform)

        Points.append(pt)

print("TOTAL POINTS:", len(Points))
# ---------- end script ----------
geo = Geometry(simplify(deconstruct_room.InteriorBoundary))
geo_2 = Geometry(simplify(script.Points))
G = Geometry(geo_2)
G_2 = Geometry(geo)
G_3 = Geometry(geo)
G_4 = Geometry(G_2)
# Apply Clustering
number_slider = Slider(3, range=0..10)
explode = Explode(Curve=G_3, Recursive=True)  # -> Segments, Vertices
# Create Features
area_2 = Area(Geometry=G_4)  # -> Area, Centroid
lng = ListLength(List=explode.Segments)
num = Number(lng)
py3 = Python3Script(x=area_2.Area)  # -> out, res; inputs x: list
# ---------- py3: Python ----------
import statistics

res = statistics.variance(x) / statistics.mean(x)
# ---------- end py3 ----------
num_2 = Number(Slider(20, range=0..100))
integer = Integer(number_slider)
ma = MassAddition(Input=area_2.Area)  # -> Result, PartialResults
trim = TrimTree(Tree=num, Depth=1)
num_3 = Number(simplify(ma.Result))
avr = Average(Input=trim)
num_4 = Number(simplify(py3.res))
ma_2 = MassAddition(Input=avr)  # -> Result, PartialResults
multiplication = Multiplication(A=num_4, B=Slider(1, range=0..1000))
num_5 = Number(ma_2.Result)
# Create Graph
boolean_toggle = BooleanToggle(True)
panel = Panel(num_3)
point = Point(G)
curve = Curve(G_2)
merge = Merge(Data1=num_5)
script_2 = Script(room_crvs=curve, room_funcs=deconstruct_room.Function, door_pts=point, include_wall_adj=boolean_toggle)  # -> out, G, nodes, edges_line, edges_id; inputs room_crvs: list of Curve, room_funcs: list of String, door_pts: list of Point3d
# ---------- script_2: Python ----------
import Rhino.Geometry as rg

class CompasGraph(object):
    def __init__(self):
        self._nodes = {}
        self._edges = {} # (u, v) -> {'type': 'door'/'wall', 'dist': float, 'line': Line}
    def add_node(self, key, **kwargs):
        self._nodes[key] = kwargs
    def add_edge(self, u, v, **kwargs):
        k = tuple(sorted((u, v)))
        # 如果已存在 door 边，则不被 wall 边覆盖
        if k not in self._edges or kwargs.get('edge_type') == 'door':
            self._edges[k] = kwargs
    def nodes(self):
        return list(self._nodes.keys())
    def edges(self):
        return list(self._edges.keys())
    def node_attribute(self, key, name):
        return self._nodes.get(key, {}).get(name, None)
    def edge_attribute(self, u, v, name):
        k = tuple(sorted((u, v)))
        return self._edges.get(k, {}).get(name, None)
    def degree(self, key):
        return sum(1 for u, v in self._edges if u == key or v == key)
    def __repr__(self):
        d_cnt = sum(1 for k, v in self._edges.items() if v.get('edge_type') == 'door')
        w_cnt = sum(1 for k, v in self._edges.items() if v.get('edge_type') == 'wall')
        return "SpatialGraph(Nodes: {}, DoorEdges: {}, WallEdges: {})".format(len(self._nodes), d_cnt, w_cnt)

tol_val = 1.0
add_walls = include_wall_adj if ('include_wall_adj' in locals() and include_wall_adj is not None) else True
crv_list = list(room_crvs) if ('room_crvs' in locals() and room_crvs) else []
func_list = list(room_funcs) if ('room_funcs' in locals() and room_funcs) else []
door_list = list(door_pts) if ('door_pts' in locals() and door_pts) else []

G = CompasGraph()
nodes = []
edges_line = []
edges_id = []

if crv_list:
    valid_indices = []
    # 1. 创建房间节点（自动过滤 FuseBox 或小于 0.8m² 的设备管井，避免重叠）
    for i, crv in enumerate(crv_list):
        if crv is None: continue
        amp = rg.AreaMassProperties.Compute(crv)
        area = amp.Area if amp else 0.0
        func = str(func_list[i]).strip() if i < len(func_list) else "Room_{}".format(i)
        if area < 0.8 or "fuse" in func.lower():
            continue
        pt = amp.Centroid if amp else crv.GetBoundingBox(True).Center
        nid = len(valid_indices)
        valid_indices.append((nid, crv, func, area, pt))
        G.add_node(key=nid, x=pt.X, y=pt.Y, z=pt.Z, func=func, area=area, centroid=pt, boundary=crv)
        nodes.append(pt)

    # 2. 提取门洞连通边 (edge_type = 'door')
    valid_doors = [p for p in door_list if p is not None and p != rg.Point3d.Unset]
    for d_pt in valid_doors:
        dists = []
        for nid, crv, func, area, pt in valid_indices:
            rc, t = crv.ClosestPoint(d_pt)
            if rc:
                dists.append((d_pt.DistanceTo(crv.PointAt(t)), nid))
        dists.sort(key=lambda x: x[0])
        if len(dists) >= 2 and dists[0][0] <= tol_val and dists[1][0] <= tol_val:
            u, v = sorted((dists[0][1], dists[1][1]))
            pu = G.node_attribute(u, 'centroid')
            pv = G.node_attribute(v, 'centroid')
            walk_dist = pu.DistanceTo(d_pt) + d_pt.DistanceTo(pv)
            G.add_edge(u, v, edge_type='door', dist=walk_dist, door_pt=d_pt)

    # 3. 提取共享墙体邻接边 (edge_type = 'wall'，打破单一走廊星型拓扑)
    if add_walls:
        m = len(valid_indices)
        for idx_a in range(m):
            u, crv_u, _, _, pu = valid_indices[idx_a]
            params = crv_u.DivideByCount(36, True)
            s_pts = [crv_u.PointAt(t) for t in params] if params else []
            for idx_b in range(idx_a + 1, m):
                v, crv_v, _, _, pv = valid_indices[idx_b]
                close_cnt = 0
                for p in s_pts:
                    rc, t = crv_v.ClosestPoint(p)
                    if rc and p.DistanceTo(crv_v.PointAt(t)) <= 0.35:
                        close_cnt += 1
                if close_cnt >= 2:
                    G.add_edge(u, v, edge_type='wall', dist=pu.DistanceTo(pv) * 1.25, door_pt=None)

    # 4. 输出边几何与标识
    for u, v in G.edges():
        pu = G.node_attribute(u, 'centroid')
        pv = G.node_attribute(v, 'centroid')
        fu = G.node_attribute(u, 'func')
        fv = G.node_attribute(v, 'func')
        etype = G.edge_attribute(u, v, 'edge_type')
        edges_line.append(rg.Line(pu, pv))
        edges_id.append("{}-{} ({}-{} [{}])".format(u, v, fu, fv, etype))


import scriptcontext as sc
if len(G.nodes()) > 0:
    sc.sticky["LATEST_SPATIAL_GRAPH"] = G
    sc.sticky.setdefault("RECORDED_GRAPHS", []).append(G)
# ---------- end script_2 ----------
data = Data(merge)
data_2 = Data(data)
k_means_clustering = KMeansClustering(TrainingInputs=data_2, OfClusters=integer, RandomSeed=5)  # -> Result, Likelihood, Centroids

data_3 = Data(data_2)
data_4 = Data(k_means_clustering.Result)
py3_2 = Python3Script(values=data_4)  # -> out, result, count; inputs values: list
# ---------- py3_2: Python ----------
"""Grasshopper Script"""
a = "Hello Python 3 in Grasshopper!"

counts = {}
result = []


for x in values:
    index = counts.get(x, 0)
    result.append([x, index])
    counts[x] = index + 1
# ---------- end py3_2 ----------
tstat = TreeStatistics(Tree=data_3)  # -> Paths, Length, Count
py3_3 = Python3Script(x=py3_2.result)  # -> out, simplify(a)
# ---------- py3_3: Python ----------
a=x
# ---------- end py3_3 ----------
num_6 = Number(py3_2.count)
data_5 = Data(simplify(graft(tstat.Paths)))
path = ConstructPath(Indices=py3_3.a)  # -> flatten(Branch)
data_6 = Data(path)
data_7 = Data(tstat.Paths)
replace = ReplacePaths(Data=data_5, Search=data_7, Replace=data_6)
trim_2 = TrimTree(Tree=replace, Depth=1)
data_8 = Data(trim_2)
cluster = Cluster(data=data_8, integer=integer, num=num_2)
data_9 = Data(tstat.Paths)
data_10 = Data(data_6)
vec = Vector(cluster)
vec_2 = Vector(simplify(graft(vec)))
data_11 = Data(data_9)
data_12 = Data(data_10)
replace_2 = ReplacePaths(Data=vec_2, Search=data_12, Replace=data_11)
vec_3 = Vector(replace_2)

data_13 = Data(script_2.G)
panel_2 = Panel(k_means_clustering.Centroids)

# ----
# Score Flats
panel_3 = Panel("""Bath:3.5
WC:1
FuseBox:0.5
Bed:13
Circulation:12
Living:80
Storage:5""")
script_3 = Script(G=data_13, target_rules=panel_3)  # -> out, area_score, area_score_2, details, room_srfs, room_cols; inputs target_rules: list of String
# ---------- script_3: Python ----------
import Rhino.Geometry as rg
import System.Drawing as sd

raw_G = G if ('G' in locals() and G is not None) else None
graph_obj = raw_G.Value if hasattr(raw_G, 'Value') else raw_G
rules_list = list(target_rules) if ('target_rules' in locals() and target_rules) else []


def lerp_color(t):
    t = max(0.0, min(1.0, float(t)))
    if t < 0.5:
        u = t * 2.0
        return sd.Color.FromArgb(200, int(46+(241-46)*u), int(204+(196-204)*u), int(113+(15-113)*u))
    else:
        u = (t - 0.5) * 2.0
        return sd.Color.FromArgb(200, int(241+(231-241)*u), int(196+(76-196)*u), int(15+(60-15)*u))

area_score = 0.0
details = []
room_srfs = []
room_cols = []

if graph_obj and hasattr(graph_obj, 'nodes'):
    target_dict = {}
    for r in rules_list:
        if r and (":" in str(r) or "->" in str(r)):
            sep = "->" if "->" in str(r) else ":"
            p = str(r).split(sep)
            target_dict.setdefault(p[0].strip(), []).append(float(p[1].strip()))

    for k in target_dict:
        target_dict[k].sort(reverse=True)

    func_groups = {}
    for n in graph_obj.nodes():
        func_groups.setdefault(
            str(graph_obj.node_attribute(n, 'func')), []
        ).append(
            (float(graph_obj.node_attribute(n, 'area')), n)
        )

    node_target = {}
    for f, items in func_groups.items():
        items.sort(key=lambda x: x[0], reverse=True)
        t_vals = list(target_dict.get(f, []))

        for idx_rank, (a_val, nid) in enumerate(items):
            if idx_rank < len(t_vals):
                node_target[nid] = t_vals[idx_rank]
                diff = abs(a_val - t_vals[idx_rank])
                area_score += diff
                details.append("[Area] {}: {:.1f}m² vs {:.1f}m² (pen: {:.2f})".format(f, a_val, t_vals[idx_rank], diff))
            elif len(t_vals) > 0:
                node_target[nid] = t_vals[-1]

    xform_down = rg.Transform.Translation(0, 0, -0.02)
    for n in graph_obj.nodes():
        crv = graph_obj.node_attribute(n, 'boundary')
        if crv:
            breps = rg.Brep.CreatePlanarBreps(crv, 0.001)
            if breps:
                srf = breps[0]
                srf.Transform(xform_down)
                room_srfs.append(srf)
                if n in node_target and node_target[n] > 0:
                    rel_err = abs(float(graph_obj.node_attribute(n, 'area')) - node_target[n]) / node_target[n]
                    room_cols.append(lerp_color(min(1.0, rel_err / 0.40)))
                else:
                    room_cols.append(sd.Color.FromArgb(160, 215, 220, 225))
# ---------- end script_3 ----------
custom_preview = CustomPreview(Geometry=script_3.room_srfs, Material=script_3.room_cols)
panel_4 = Panel(script_3.details)
panel_5 = Panel(script_3.area_score_2)

# ----
# Visualisation
number_slider_2 = Slider(5, range=0..10)
T = Motion(vec_3)
data_14 = Data(data_2)
round = Round(Number=data_14)  # -> Nearest, Floor, Ceiling
data_15 = Data(G)
data_16 = Data(G_4)
T_2 = Motion(T)
vec_4 = Vector(T)
move = Move(Geometry=data_16, Motion=T_2)  # -> Geometry, Transform
move_2 = Move(Geometry=data_15, Motion=T_2)  # -> Geometry, Transform
geo_3 = Geometry(move_2.Geometry)
avr_2 = Average(Input=geo_3)
tag = TextTag3D(Location=avr_2, Text=round.Nearest, Size=number_slider_2, Justification=7)
geo_4 = Geometry(move.Geometry)
data_17 = Data(geo_4)
previewlw = CustomPreviewLineweights(Geometry=data_17, Shader=ColourSwatch(SwatchColor=RGB(0, 0, 0)), Thickness=Slider(3, range=0..10), Absolute=False)

# ----
# Compute Centrality Measures
script_4 = Script(G=simplify(data_13))  # -> out, G_out, node_keys, room_funcs, centrality_vals, closeness_vals, degree_vals, betweenness_vals
# ---------- script_4: Python ----------
import Grasshopper.Kernel.Types as gkt

raw_G = G if ('G' in locals() and G is not None) else None
graph_obj = raw_G.Value if hasattr(raw_G, 'Value') else raw_G

node_keys = []
room_funcs = []
closeness_vals = []
degree_vals = []
betweenness_vals = []

if graph_obj and hasattr(graph_obj, 'nodes') and len(graph_obj.nodes()) > 0:

    nodes_list = list(graph_obj.nodes())
    n_cnt = len(nodes_list)

    # 1. Floyd-Warshall shortest path calculation
    dist_mat = {u: {v: 999.0 for v in nodes_list} for u in nodes_list}
    next_node = {u: {v: None for v in nodes_list} for u in nodes_list}

    for u in nodes_list:
        dist_mat[u][u] = 0.0

    for u, v in graph_obj.edges():
        w = float(graph_obj.edge_attribute(u, v, 'dist') or 3.0)
        dist_mat[u][v] = dist_mat[v][u] = w
        next_node[u][v] = v
        next_node[v][u] = u

    for k in nodes_list:
        for i in nodes_list:
            for j in nodes_list:
                if dist_mat[i][k] + dist_mat[k][j] < dist_mat[i][j]:
                    dist_mat[i][j] = dist_mat[i][k] + dist_mat[k][j]
                    next_node[i][j] = next_node[i][k]

    # 2. Compute all three nodal centrality measures
    deg_c = {}
    close_c = {}
    bet_c = {u: 0.0 for u in nodes_list}

    for u in nodes_list:
        deg_c[u] = float(graph_obj.degree(u)) / float(max(n_cnt - 1, 1))

        reach = [
            dist_mat[u][v]
            for v in nodes_list
            if v != u and dist_mat[u][v] < 500.0
        ]

        close_c[u] = (
            float(len(reach) / sum(reach))
            if (reach and sum(reach) > 0)
            else 0.0
        )

    for s in nodes_list:
        for t in nodes_list:
            if s >= t or next_node[s][t] is None:
                continue

            curr = next_node[s][t]

            while curr is not None and curr != t:
                bet_c[curr] += 1.0
                curr = next_node[curr][t]

    denom = max(1.0, (n_cnt - 1) * (n_cnt - 2) * 0.5)

    for u in nodes_list:
        bet_c[u] = float(bet_c[u] / denom)

    # 3. Store all centrality measures as node attributes
    # and output parallel numerical lists
    for u in nodes_list:

        func = str(graph_obj.node_attribute(u, 'func'))

        # Direct dictionary assignment for IronPython compatibility
        if hasattr(graph_obj, 'node') and not callable(graph_obj.node):
            graph_obj.node[u]['closeness'] = close_c[u]
            graph_obj.node[u]['degree_c'] = deg_c[u]
            graph_obj.node[u]['betweenness'] = bet_c[u]

        elif hasattr(graph_obj, 'vertex') and not callable(graph_obj.vertex):
            graph_obj.vertex[u]['closeness'] = close_c[u]
            graph_obj.vertex[u]['degree_c'] = deg_c[u]
            graph_obj.vertex[u]['betweenness'] = bet_c[u]

        elif hasattr(graph_obj, 'nodes') and not callable(graph_obj.nodes):
            graph_obj.nodes[u]['closeness'] = close_c[u]
            graph_obj.nodes[u]['degree_c'] = deg_c[u]
            graph_obj.nodes[u]['betweenness'] = bet_c[u]

        node_keys.append(u)
        room_funcs.append(func)
        closeness_vals.append(close_c[u])
        degree_vals.append(deg_c[u])
        betweenness_vals.append(bet_c[u])

G_out = gkt.GH_ObjectWrapper(graph_obj) if graph_obj is not None else None
# ---------- end script_4 ----------
script_5 = Script(G=script_4.G_out, centrality_vals=script_4.degree_vals)  # -> out, graph_srfs, graph_col, node_pts, node_texts; inputs centrality_vals: list
# ---------- script_5: Python ----------
import Rhino.Geometry as rg
import System.Drawing as sd

raw_G = G if ('G' in locals() and G is not None) else None
graph_obj = raw_G.Value if hasattr(raw_G, 'Value') else raw_G

def make_solid_ribbon(pt_a, pt_b, half_w=0.045, z_off=0.08):
    """生成实心粗线面片（用于门洞连通边）"""
    v = pt_b - pt_a
    if v.Length < 1e-4: return []
    v.Unitize()
    perp = rg.Vector3d(-v.Y, v.X, 0) * half_w
    poly = rg.Polyline([
        rg.Point3d(pt_a.X+perp.X, pt_a.Y+perp.Y, z_off),
        rg.Point3d(pt_b.X+perp.X, pt_b.Y+perp.Y, z_off),
        rg.Point3d(pt_b.X-perp.X, pt_b.Y-perp.Y, z_off),
        rg.Point3d(pt_a.X-perp.X, pt_a.Y-perp.Y, z_off),
        rg.Point3d(pt_a.X+perp.X, pt_a.Y+perp.Y, z_off)
    ]).ToNurbsCurve()
    b = rg.Brep.CreatePlanarBreps(poly, 0.001)
    return [b[0]] if b else []

def make_dashed_ribbon(pt_a, pt_b, dash_len=0.22, gap_len=0.14, half_w=0.026, z_off=0.08):
    """生成分段虚线面片（用于共墙邻接边）"""
    vec = pt_b - pt_a
    total_len = vec.Length
    if total_len < 1e-4: return []
    vec.Unitize()
    perp = rg.Vector3d(-vec.Y, vec.X, 0) * half_w
    dashes = []
    curr = 0.0
    step = dash_len + gap_len
    while curr < total_len:
        end_d = min(curr + dash_len, total_len)
        if end_d - curr > 0.03:
            p_start = pt_a + vec * curr
            p_end = pt_a + vec * end_d
            poly = rg.Polyline([
                rg.Point3d(p_start.X+perp.X, p_start.Y+perp.Y, z_off),
                rg.Point3d(p_end.X+perp.X, p_end.Y+perp.Y, z_off),
                rg.Point3d(p_end.X-perp.X, p_end.Y-perp.Y, z_off),
                rg.Point3d(p_start.X-perp.X, p_start.Y-perp.Y, z_off),
                rg.Point3d(p_start.X+perp.X, p_start.Y+perp.Y, z_off)
            ]).ToNurbsCurve()
            b = rg.Brep.CreatePlanarBreps(poly, 0.001)
            if b: dashes.append(b[0])
        curr += step
    return dashes

def centrality_red_green(norm_val):
    """越边缘(0.0)越绿 -> 中间(0.5)琥珀黄 -> 越中心(1.0)越红"""
    t = max(0.0, min(1.0, float(norm_val)))
    if t < 0.5:
        u = t * 2.0
        r = int(46 + (241 - 46) * u)
        g = int(204 + (196 - 204) * u)
        b = int(113 + (15 - 113) * u)
    else:
        u = (t - 0.5) * 2.0
        r = int(241 + (231 - 241) * u)
        g = int(196 + (60 - 196) * u)
        b = int(15 + (45 - 15) * u)
    return sd.Color.FromArgb(245, r, g, b)

graph_srfs = []
graph_cols = []
node_pts = []
node_texts = []

if graph_obj and hasattr(graph_obj, 'nodes') and len(graph_obj.nodes()) > 0:
    nodes_list = list(graph_obj.nodes())
    
    # 优先使用外部传入的 centrality_vals 列表，若未连线则读取节点内置属性
    use_external = ('centrality_vals' in locals() and centrality_vals and len(centrality_vals) == len(nodes_list))
    active_c = {}
    for idx, u in enumerate(nodes_list):
        if use_external:
            active_c[u] = float(centrality_vals[idx])
        else:
            active_c[u] = float(graph_obj.node_attribute(u, 'active_centrality') or 0.0)
            
    c_min, c_max = min(active_c.values()), max(active_c.values())
    c_span = (c_max - c_min) if (c_max > c_min) else 1.0

    FIXED_RAD = 0.42
    OUTER_RAD = FIXED_RAD + 0.05

    # 1. 绘制边（门连通=粗实线，共墙相连=虚线）
    for u, v in graph_obj.edges():
        pu = graph_obj.node_attribute(u, 'centroid')
        pv = graph_obj.node_attribute(v, 'centroid')
        etype = graph_obj.edge_attribute(u, v, 'edge_type')
        
        vec = pv - pu
        dist = vec.Length
        if dist > OUTER_RAD * 2.05:
            vec.Unitize()
            p_start = pu + vec * OUTER_RAD
            p_end = pv - vec * OUTER_RAD
            if etype == 'door':
                ribs = make_solid_ribbon(p_start, p_end, half_w=0.048, z_off=0.5)
                for r_srf in ribs:
                    graph_srfs.append(r_srf)
                    graph_cols.append(sd.Color.FromArgb(240, 44, 62, 80))
            else:
                dashes = make_dashed_ribbon(p_start, p_end, dash_len=0.22, gap_len=0.14, half_w=0.028, z_off=0.5)
                for d_srf in dashes:
                    graph_srfs.append(d_srf)
                    graph_cols.append(sd.Color.FromArgb(215, 95, 110, 125))

    # 2. 绘制等大圆盘与文字标签
    for u in nodes_list:
        pt = graph_obj.node_attribute(u, 'centroid')
        func = str(graph_obj.node_attribute(u, 'func'))
        val = active_c[u]
        norm_v = (val - c_min) / c_span
        
        c_out = rg.Circle(rg.Point3d(pt.X, pt.Y, 0.05), OUTER_RAD).ToNurbsCurve()
        b_out = rg.Brep.CreatePlanarBreps(c_out, 0.001)
        if b_out:
            graph_srfs.append(b_out[0])
            graph_cols.append(sd.Color.FromArgb(250, 255, 255, 255))
            
        c_in = rg.Circle(rg.Point3d(pt.X, pt.Y, 0.06), FIXED_RAD).ToNurbsCurve()
        b_in = rg.Brep.CreatePlanarBreps(c_in, 0.001)
        if b_in:
            graph_srfs.append(b_in[0])
            graph_cols.append(centrality_red_green(norm_v))
            
        node_pts.append(rg.Point3d(pt.X, pt.Y, 0.10))
        node_texts.append("{}\nC={:.2f}".format(func, val))

graph_col = graph_cols
# ---------- end script_5 ----------

panel_6 = Panel(script_4.closeness_vals)
move_3 = Move(Geometry=script_5.graph_srfs, Motion=vec_4)  # -> simplify(Geometry), Transform
move_4 = Move(Geometry=script_5.node_pts, Motion=vec_4)  # -> simplify(Geometry), Transform

text_tag_3d = TextTag3D(Location=move_4.Geometry, Text=script_5.node_texts, Size=Slider(0.25, range=0..1), Justification=7)
custom_preview_2 = CustomPreview(Geometry=move_3.Geometry, Material=script_5.graph_col)

# ==== cluster Cluster
data = ClusterInput()
num = ClusterInput()
integer = ClusterInput()
data_2 = Data(data)
num_2 = Number(num)
integer_2 = Integer(integer)
lng = ListLength(List=data_2)
integer_3 = Integer(lng)
num_3 = Number(num_2)
series = Series(Start=1, Step=1, Count=integer_3)
series_2 = Series(Start=1, Step=1, Count=integer_2)
multiplication = Multiplication(A=series, B=num_3)
multiplication_2 = Multiplication(A=series_2, B=num_2)
Y = UnitY(Factor=multiplication_2)  # -> graft(UnitVector)
X = UnitX(Factor=multiplication)
addition = Addition(A=X, B=Y)
vec = Vector(addition)
vec_2 = Vector(simplify(graft(vec)))
vec_3 = ClusterOutput(vec_2)
