# Grasshopper definition BlockGenerator_Simulation.gh (Grasshopper 1.0.8)
# plug-ins: Karamba3D, LadybugGrasshopper

button = Button()

# ----
# Export floor geometry
lb_falsestarttoggle = LBFalseStartToggle(False)

# ----
# Export floor geometry
lb_falsestarttoggle_2 = LBFalseStartToggle(False)

number_slider = Slider(1, range=0..10)
number_slider_2 = Slider(1, range=0..10)
number = Number([0, 14])
license = LicenseKaramba3D()

# ----
# Weather files
panel = Panel("HKG_KOW_Hong.Kong.Obs.450050_TMYx.epw")
path = Python3Script(PathToJoin=panel)  # -> out, FolderPath, FilePath, PathNew
# ---------- path: Python ----------
import os

doc = ghenv.Component.OnPingDocument()

FilePath = doc.FilePath
FolderPath = os.path.dirname(FilePath) if FilePath else None

if PathToJoin is not None:
    PathNew = os.path.join(FolderPath, PathToJoin)
# ---------- end path ----------
panel_2 = Panel(path.PathNew)
file_path = FilePath(path.PathNew)
wea = HBWeaFromEPW(epw_file=file_path)  # -> wea; plug-in component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

panel_3 = Panel(license)

# ----
# Check versions
# compatibility:
# 
# lbt_gh: 1.9.4
# python: 3.7.9
# 
# radiance: RADIANCE 5.4a 2021-03-28 LBNL (5.4.947ea88a29)
# 
# openstudio: 3.11.0+241b8abb4d
# 
# energyplus: 25.2.0-cf7368216c
versions = HBCheckVersions()  # -> lbt_gh, python, radiance, openstudio, energyplus; plug-in component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
panel_4 = Panel(versions.energyplus)

# ----
# North Arrow
end_points = EndPoints(Curve=<geometry referenced from the Rhino model>)  # -> Start, End
vector_2pt = Vector2Pt(PointA=end_points.Start, PointB=end_points.End, Unitize=False)  # -> Vector, Length
vector_display = VectorDisplay(Anchor=end_points.Start, Vector=vector_2pt.Vector)

file_path_2 = FilePath(path.PathNew)
vector = Vector(vector_2pt.Vector)

# ----
# Wind Speed
ladybug = Ladybug_Ladybug()  # -> out; plug-in component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
epwmap = LBEPWmap(epw_map=Button())  # -> Output; plug-in component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
importepw = LBImportEPW(epw_file=file_path_2)  # -> location, dry_bulb_temperature, dew_point_temperature, relative_humidity, wind_speed, wind_direction, direct_normal_rad, diffuse_horizontal_rad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; plug-in component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
number_slider_3 = Slider(1, range=0..10)
unit_y = UnitY(Factor=1)
unit_z = UnitZ(Factor=1)
xy_plane = XYPlane(Origin=Point(0, 0, 0))
xdata = LBDeconstructData(data=importepw.wind_direction)  # -> header, values; plug-in component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
windrose = LBWindRose(north=vector, data=importepw.wind_speed, wind_direction=importepw.wind_direction, dir_count=Slider(32, range=0..100))  # -> out, mesh, compass, orient_line, freq_line, windrose_line, legend, title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; plug-in component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
xdata_2 = LBDeconstructData(data=importepw.wind_speed)  # -> header, values; plug-in component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
list_length = ListLength(List=xdata.values)
list_item = ListItem(List=xdata.values, Index=number_slider_3, Wrap=True)
rotate = Rotate(Vector=unit_y, Axis=unit_z, Angle=expr("180-X", degrees(list_item)))
list_item_2 = ListItem(List=xdata_2.values, Index=number_slider_3, Wrap=True)
windvector = Butterfly_WindVector(wind_speed=list_item_2, wind_direction=rotate)  # -> wind_vector; plug-in component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

# ----
# Start Daylight Simulations
lb_falsestarttoggle_3 = LBFalseStartToggle(False)
lb_falsestarttoggle_4 = LBFalseStartToggle(False)
lb_falsestarttoggle_5 = LBFalseStartToggle(False)

vector_2 = Vector(vector_2pt.Vector)
lb_falsestarttoggle_6 = LBFalseStartToggle(False)

# ----
# Start Energy Simulations
lb_falsestarttoggle_7 = LBFalseStartToggle(False)

stream_filter = StreamFilter(Gate=lb_falsestarttoggle_6, Stream0=False, Stream1=True)
file_path_3 = FilePath(path.PathNew)

# ----
# Floor
# Rooms
# Structural elements
# Architectural elements
cluster = Cluster(text="Block_01", run=lb_falsestarttoggle_2, text_2="2F_TYPICAL", refresh=button)  # -> floor_id, fh, rep, floor_vol, floor_massing_r

number_2 = Number(cluster.rep)
number_3 = Number(cluster.fh)

cluster_2 = Cluster_3(
    run=lb_falsestarttoggle_2,
    text_2="Block_01",
    text_3="2F_TYPICAL",
    refresh=button,
    text=cluster.floor_id,
    fh=number_3,
    rep=number_2)  # -> room_id, room_id_r, room_crv, room_volume, room_volume_r
cluster_3 = Cluster_4(
    text="Block_01",
    text_2="2F_TYPICAL",
    refresh=button,
    fh=number_3,
    rep=number_2,
    run=lb_falsestarttoggle_2,
    room_ids=cluster_2.room_id,
    floor_id=cluster.floor_id)  # -> gf_slab, slab, walls_unique_r, separate_wall_extr_r, wall_thickness_r, slab_r
cluster_4 = Cluster_2(
    run=lb_falsestarttoggle_2,
    floor_id=cluster.floor_id,
    room_id=cluster_2.room_id,
    room_crv=cluster_2.room_crv,
    text="Block_01",
    text_2="2F_TYPICAL",
    refresh=button,
    fh=number_3,
    rep=number_2)  # -> windows, windows_r, doors, doors_r, shade_balcony, shade_balcony_r

# ----
# Floor
# Rooms
# Structural elements
# Architectural elements
cluster_5 = Cluster(text="Block_01", run=lb_falsestarttoggle, text_2="GF", refresh=button)  # -> floor_id, fh, rep, floor_vol, floor_massing_r

number_4 = Number(cluster_5.rep)
number_5 = Number(cluster_5.fh)

cluster_6 = Cluster_3(
    run=lb_falsestarttoggle,
    text_2="Block_01",
    text_3="GF",
    refresh=button,
    text=cluster_5.floor_id,
    fh=number_5,
    rep=number_4)  # -> room_id, room_id_r, room_crv, room_volume, room_volume_r
cluster_7 = Cluster_4(
    text="Block_01",
    text_2="GF",
    refresh=button,
    fh=number_5,
    rep=number_4,
    run=lb_falsestarttoggle,
    room_ids=cluster_6.room_id,
    floor_id=cluster_5.floor_id)  # -> gf_slab, slab, walls_unique_r, separate_wall_extr_r, wall_thickness_r, slab_r
cluster_8 = Cluster_2(
    run=lb_falsestarttoggle,
    floor_id=cluster_5.floor_id,
    room_id=cluster_6.room_id,
    room_crv=cluster_6.room_crv,
    text="Block_01",
    text_2="GF",
    refresh=button,
    fh=number_5,
    rep=number_4)  # -> windows, windows_r, doors, doors_r, shade_balcony, shade_balcony_r

# ----
# Doors
brep = Brep(cluster_8.doors_r)
brep_2 = Brep(cluster_4.doors_r)
block_collector = Python3Script(Data=[brep, brep_2])  # -> out, Collected, Debug; inputs Data: tree
# ---------- block_collector: Python ----------
from Grasshopper import DataTree
from Grasshopper.Kernel.Data import GH_Path


# =========================================================
# OUTPUTS
# =========================================================

Collected = DataTree[object]()
Debug = []


# =========================================================
# GET ALL SOURCES CONNECTED TO INPUT 0
# =========================================================

input_param = ghenv.Component.Params.Input[0]

sources = list(
    input_param.Sources
)


# =========================================================
# COLLECT SOURCES
#
# Each incoming source is read separately so Grasshopper
# cannot merge identical branch paths before we process them.
#
# Example:
#
# Source A:
# {0}
#
# Source B:
# {0}
# {1}
# {2}
#
# becomes:
#
# {0}
# {1}
# {2}
# {3}
# =========================================================

new_branch_index = 0
total_items = 0


for source_index, source in enumerate(sources):

    tree = source.VolatileData

    if tree is None:
        continue


    Debug.append(
        "Source {}: {} branches".format(
            source_index,
            tree.PathCount
        )
    )


    # -----------------------------------------------------
    # Read every branch from this source
    # -----------------------------------------------------

    for branch_index in range(
        tree.PathCount
    ):

        old_path = tree.Paths[
            branch_index
        ]

        branch = tree.get_Branch(
            old_path
        )

        new_path = GH_Path(
            new_branch_index
        )

        Collected.EnsurePath(
            new_path
        )


        # -------------------------------------------------
        # Preserve every item in the branch
        # -------------------------------------------------

        for goo in branch:

            if goo is None:
                continue


            # Convert GH_Goo to its underlying Python /
            # Rhino object when possible.
            try:

                value = goo.ScriptVariable()

            except:

                try:
                    value = goo.Value
                except:
                    value = goo


            if value is None:
                continue


            Collected.Add(
                value,
                new_path
            )

            total_items += 1


        Debug.append(
            "Source {} {} -> {}".format(
                source_index,
                old_path,
                new_path
            )
        )


        new_branch_index += 1


# =========================================================
# SUMMARY
# =========================================================

Debug.append(
    "Connected sources: {}".format(
        len(sources)
    )
)

Debug.append(
    "Output branches: {}".format(
        Collected.BranchCount
    )
)

Debug.append(
    "Output items: {}".format(
        total_items
    )
)
# ---------- end block_collector ----------
brep_3 = Brep(block_collector.Collected)
stream_filter_2 = StreamFilter(Gate=number_slider, Stream0=brep_3, Stream1=brep, Stream2=brep_2)

# ----
# Windows
brep_4 = Brep(cluster_4.windows_r)
brep_5 = Brep(cluster_8.windows_r)
block_collector_2 = Python3Script(Data=[brep_5, brep_4])  # -> out, Collected, Debug; inputs Data: tree; same code as block_collector
brep_6 = Brep(block_collector_2.Collected)
stream_filter_3 = StreamFilter(Gate=number_slider, Stream0=brep_6, Stream1=brep_5, Stream2=brep_4)

# ----
# Rooms Massing
brep_7 = Brep(cluster_2.room_volume_r)
brep_8 = Brep(cluster_6.room_volume_r)
block_collector_3 = Python3Script(Data=[brep_8, brep_7])  # -> out, Collected, Debug; inputs Data: tree; same code as block_collector
brep_9 = Brep(block_collector_3.Collected)
stream_filter_4 = StreamFilter(Gate=number_slider, Stream0=brep_9, Stream1=brep_8, Stream2=brep_7)

# ----
# Shades/balconies
brep_10 = Brep(cluster_4.shade_balcony_r)
brep_11 = Brep(cluster_8.shade_balcony_r)
block_collector_4 = Python3Script(Data=[brep_11, brep_10])  # -> out, Collected, Debug; inputs Data: tree; same code as block_collector
brep_12 = Brep(block_collector_4.Collected)
stream_filter_5 = StreamFilter(Gate=number_slider, Stream0=brep_12, Stream1=brep_11, Stream2=brep_10)

# ----
# Rooms IDs
text = Text(cluster_6.room_id_r)
text_2 = Text(cluster_2.room_id_r)
block_collector_5 = Python3Script(Data=[text, text_2])  # -> out, Collected, Debug; inputs Data: tree; same code as block_collector
text_3 = Text(block_collector_5.Collected)
stream_filter_6 = StreamFilter(Gate=number_slider, Stream0=text_3, Stream1=text, Stream2=text_2)

# ----
# Full Block Geometry
brep_13 = Brep(cluster_5.floor_massing_r)
brep_14 = Brep(cluster.floor_massing_r)
block_collector_6 = Python3Script(Data=[brep_13, brep_14])  # -> out, Collected, Debug; inputs Data: tree; same code as block_collector
brep_15 = Brep(block_collector_6.Collected)
stream_filter_7 = StreamFilter(Gate=Slider(0, range=0..10), Stream0=brep_15, Stream1=brep_13, Stream2=brep_14)
solid_union = SolidUnion(Breps=stream_filter_7)
brep_16 = Brep(solid_union)

# ----
# Slabs
brep_17 = Brep(cluster_3.slab_r)
brep_18 = Brep(cluster_7.slab_r)
block_collector_7 = Python3Script(Data=[brep_18, brep_17])  # -> out, Collected, Debug; inputs Data: tree; same code as block_collector
brep_19 = Brep(block_collector_7.Collected)
stream_filter_8 = StreamFilter(Gate=number_slider_2, Stream0=brep_19, Stream1=brep_18, Stream2=brep_17)

# ----
# Walls
curve = Curve(cluster_7.walls_unique_r)
curve_2 = Curve(cluster_3.walls_unique_r)
block_collector_8 = Python3Script(Data=[curve, curve_2])  # -> out, Collected, Debug; inputs Data: tree; same code as block_collector
curve_3 = Curve(block_collector_8.Collected)
stream_filter_9 = StreamFilter(Gate=number_slider_2, Stream0=curve_3, Stream1=curve, Stream2=curve_2)

# ----
# Wall_Thicknesses
number_6 = Number(cluster_7.wall_thickness_r)
number_7 = Number(cluster_3.wall_thickness_r)
block_collector_9 = Python3Script(Data=[number_6, number_7])  # -> out, Collected, Debug; inputs Data: tree; same code as block_collector
number_8 = Number(block_collector_9.Collected)
stream_filter_10 = StreamFilter(Gate=number_slider_2, Stream0=number_8, Stream1=number_6, Stream2=number_7)

number_9 = Number(number_4)
number_10 = Number(number_5)
number_11 = Number(number_2)

number_12 = Number(stream_filter_10)
curve_4 = Curve(stream_filter_9)
brep_20 = Brep(stream_filter_8)

curve_5 = Curve(<curve referenced from the Rhino model>)
unit_z_2 = UnitZ(Factor=number_10)
boundary_surfaces = BoundarySurfaces(Edges=curve_5)
addition = Addition(A=number_9, B=number_11)
linear_array = LinearArray(Geometry=boundary_surfaces, Direction=unit_z_2, Count=addition)  # -> Geometry, Transform
number_13 = Number(1.5)
unit_z_3 = UnitZ(Factor=number_13)
move = Move(Geometry=linear_array.Geometry, Motion=unit_z_3)  # -> Geometry, Transform

# ----
# Structural analysis
boolean_toggle = BooleanToggle(False)
resolution_wall = Slider(0.25, range=0..1)
resolution_slab = Slider(0.5, range=0..1)
build_ceiling_gf = Slider(0, range=0..1)
wall_supported_shell_simu = WallSupportedShellSimu(
    boolean=boolean_toggle,
    slab_res=resolution_slab,
    wall_res=resolution_wall,
    wall_curve=curve_4,
    celiling_switch=build_ceiling_gf,
    floor_heights=number_10,
    wall_thickness=number_12,
    slab_brep=brep_20,
    support_tolerance="0.01",
    ldist="0.01")  # -> mass, maximum_displacement_cm, change_of_elastic_energy_knm, analysed_model
modelview = ModelViewKaramba3D(Model=wall_supported_shell_simu.analysed_model)  # -> Model, DeformedMesh, DeformedAxes, DeformedModel, MaximumDeformation

# ----
# Shades/balconies
brep_21 = Brep(stream_filter_5)

# ----
# Rooms IDs
text_4 = Text(stream_filter_6)

# ----
# Doors
brep_22 = Brep(stream_filter_2)

# ----
# Windows
brep_23 = Brep(stream_filter_3)

# ----
# Rooms
brep_24 = Brep(stream_filter_4)

# ----
# Massing
solid_union_2 = SolidUnion(Breps=flatten(brep_16))

list_item_3 = ListItem(List=brep_24, Index=number, Wrap=True)

# ----
# AirFlow
# Building Massing
brep_25 = Brep(solid_union_2)
# Wind Planes
brep_26 = Brep(move.Geometry)

max_disp_cm = Panel(wall_supported_shell_simu.maximum_displacement_cm)
material_quantity_kg = Panel(wall_supported_shell_simu.mass)
strain_energy_knm = Panel(wall_supported_shell_simu.change_of_elastic_energy_knm)

# ----
# Environment Mesh
panel_5 = Panel("Geo")
createbfgeometry = Butterfly_CreateButterflyGeometry(name=panel_5, geo=flatten(brep_25))  # -> out, BF_geo; plug-in component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
boolean = Boolean(stream_filter)
createcasefromtunnel = Butterfly_CreateCaseFromTunnel(
    name="Tunnel_windfix",
    BF_geo=flatten(createbfgeometry.BF_geo),
    wind_vector=windvector,
    ref_wind_height=10,
    landscape=6,
    run=boolean)  # -> out, block_pts, wind_tunnel, case; plug-in component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
wtgrading = Butterfly_windTunnelGrading(wind_tunnel=createcasefromtunnel.wind_tunnel, cell_size="3", cell_to_cell_ratio=1.2, wake_offset=2, height_offset=5)  # -> out, grad_xyz, cell_count_xyz, cell_count_tot, preview; plug-in component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
panel_6 = Panel(createcasefromtunnel.out)
boolean_2 = Boolean(stream_filter)
boolean_3 = Boolean(stream_filter)
blockmesh = Butterfly_blockMesh(
    case=createcasefromtunnel.case,
    grad_xyz=wtgrading.grad_xyz,
    cell_count=wtgrading.cell_count_xyz,
    overwrite=True,
    write=boolean_3,
    run=boolean_2)  # -> out, case; plug-in component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
boolean_4 = Boolean(stream_filter)
boolean_5 = Boolean(stream_filter)
snappyhexmesh = Butterfly_snappyHexMesh(case=blockmesh.case, glob_refine_level="1,1", write=boolean_5, run=boolean_4)  # -> out, case; plug-in component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
loadmesh = Butterfly_LoadMesh(case=snappyhexmesh.case, inner_mesh=False, load=Toggle(True))  # -> mesh; plug-in component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
custom_preview = CustomPreview(Geometry=loadmesh, Material=ColourSwatch(SwatchColor=RGBA(152, 140, 255, 128)))

# ----
# Solution
trim_solid = TrimSolid(Shape=brep_26, Cutters=brep_25)
genpts = LBGeneratePointGrid(geometry=trim_solid, grid_size=Slider(1, range=0..10))  # -> points, vectors, face_areas, simplify(mesh); plug-in component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
point = Point(flatten(genpts.points))
probes = Butterfly_probes(points=point, fields="U")  # -> probes; plug-in component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
controldict = Butterfly_controlDict(start_time=0, end_time="2500", write_interval=100, write_compression=False, purge_write=0)  # -> control_dict; plug-in component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
solutionparams = Butterfly_SolutionParameters(control_dict=controldict, probes=probes)  # -> solution_par; plug-in component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
steadyincomp = Butterfly_SteadyIncompressibleRecipe()  # -> out, recipe; plug-in component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
boolean_6 = Boolean(stream_filter)
solution = Butterfly_Solution(
    case=snappyhexmesh.case,
    recipe=steadyincomp.recipe,
    solution_par=solutionparams,
    interval=2,
    write=boolean_6,
    run=Toggle(False))  # -> out, solution, is_running, timestep, residual_fields, residual_values, log_files; plug-in component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
loadprobesvalue = Butterfly_LoadProbesValue(solution=solution.solution, field="U")  # -> values; plug-in component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

panel_7 = Panel(solution.log_files)

# ----
# Wind Speed Domain
panel_8 = Panel("1e100")
vector_length = VectorLength(Vector=loadprobesvalue)
smaller_than = SmallerThan(FirstNumber=vector_length, SecondNumber=panel_8)  # -> SmallerThan, OrEqualTo
dispatch = Dispatch(List=loadprobesvalue, DispatchPattern=smaller_than.SmallerThan)  # -> ListA, ListB
vector_3 = Vector(dispatch.ListA)
vector_length_2 = VectorLength(Vector=vector_3)
bounds = Bounds(Numbers=vector_length_2)
panel_9 = Panel(bounds)
deconstruct_domain = DeconstructDomain(Domain=bounds)  # -> Start, End

# ----
# Average Wind Speed
mass_addition = MassAddition(Input=vector_length_2)  # -> Result, PartialResults
list_length_2 = ListLength(List=vector_length_2)
division = Division(A=mass_addition.Result, B=list_length_2)
panel_10 = Panel(division)

# ----
# Max / Average Velocity Ratio
division_2 = Division(A=panel_10, B=deconstruct_domain.End)
panel_11 = Panel(division_2)

# ----
# Visualization
flatten_tree = FlattenTree(Tree=genpts.mesh, Path="{0}")
gradient = Gradient(
    LowerLimit=deconstruct_domain.Start,
    UpperLimit=deconstruct_domain.End,
    Parameter=vector_length_2,
    stops=[0.301: RGB(219, 125, 142), 0.765: RGB(73, 107, 230)])
mesh_join = MeshJoin(Meshes=flatten_tree)
colrange = LBColorRange(index="5")  # -> colors; plug-in component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
construct_domain = ConstructDomain(DomainStart=Slider(0, range=0..100), DomainEnd=Slider(1, range=0..10))
legendpar = LBLegendParameters(colors=colrange)  # -> leg_par; plug-in component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
remap_numbers = RemapNumbers(Value=loadprobesvalue, Source=Domain(0, 1), Target=construct_domain)  # -> Mapped, Clipped
multiplication = Multiplication(A=vector_3, B=Slider(0.1, range=0..1))
vector_display_ex = VectorDisplayEx(Point=point, Vector=multiplication, Colour=gradient, Width=Slider(1, range=0..10))
heatmap = LBSpatialHeatmap(values=remap_numbers.Clipped, mesh=mesh_join, legend_par=legendpar)  # -> mesh, legend, title, colors, legend_par; plug-in component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
face_boundaries = FaceBoundaries(Mesh=heatmap.mesh)
custom_preview_2 = CustomPreview(Geometry=face_boundaries, Shader=heatmap.colors)

# ----
# Daylight and energy
cluster_9 = Cluster_5(brep_6=brep_24, prefix=text_4, brep_3=brep_23, brep=brep_22, brep_4=brep_21)  # -> flatten(hb_obj), shades

# ----
# Visualize model
# Combine HB model
model = HBModel(rooms=flatten(cluster_9.hb_obj), shades=flatten(cluster_9.shades))  # -> out, flatten(model); plug-in component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
vizbytype = HBVisualizeByType(hb_objs=model.model)  # -> walls, interior_walls, roofs, ceilings, exterior_floors, interior_floors, air_walls, apertures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; plug-in component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
mesh = Mesh(vizbytype.walls)
mesh_2 = Mesh(vizbytype.interior_walls)
mesh_3 = Mesh(vizbytype.roofs)
mesh_4 = Mesh(vizbytype.ceilings)
mesh_5 = Mesh(vizbytype.exterior_floors)
mesh_6 = Mesh(vizbytype.apertures)
mesh_7 = Mesh(vizbytype.interior_floors)
mesh_8 = Mesh(vizbytype.doors)
mesh_9 = Mesh(vizbytype.outdoor_shades)
curve_6 = Curve(vizbytype.wire_frame)

mesh_10 = Mesh(vizbytype.indoor_shades)

# ----
# Simulation grid points
number_slider_4 = Slider(0.5, range=0..1)
gridrooms = HBSensorGridFromRooms(rooms=flatten(model.model), grid_size=number_slider_4, dist_floor=Slider(0.7, range=0..2.5))  # -> grid, points, flatten(mesh); plug-in component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
assigngridsviews = HBAssignGridsAndViews(model=model.model, grids=flatten(gridrooms.grid))  # -> model; plug-in component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

# ----
# Check model before sim.
boolean_toggle_2 = BooleanToggle(True)
panel_12 = Panel("Radiance")
validatemodel = HBValidateModel(model=model.model, extension="EnergyPlus", validate=boolean_toggle_2)  # -> out; plug-in component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

# ----
# Export HB model
boolean_toggle_3 = BooleanToggle(False)
file_path_4 = FilePath("E:\HKU\research\simulations\Daylight\simulation results\")
modeltorad = HBModelToRadFolder(model=assigngridsviews, folder=file_path_4, write=boolean_toggle_3)  # -> out, folder; plug-in component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

annualdaylight = HBAnnualDaylight(model=assigngridsviews, wea=wea, north=vector_2, run=lb_falsestarttoggle_5)  # -> out, results, DA, cDA, UDI, UDI_low, UDI_up; plug-in component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
cumulativeradiation = HBCumulativeRadiation(model=assigngridsviews, wea=wea, north=vector_2, run=lb_falsestarttoggle_4)  # -> out, avg_irr, radiation; plug-in component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
panel_13 = Panel("average irradiance")
daylightfactor = HBDaylightFactor(model=assigngridsviews, run=lb_falsestarttoggle_3)  # -> out, results; plug-in component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
panel_14 = Panel("value per space")
ase = HBAnnualSunlightExposure(results=annualdaylight.results)  # -> out, ASE, hrs_above; plug-in component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
sda = HBSpatialDaylightAutonomy(DA=annualdaylight.DA, mesh=gridrooms.mesh)  # -> out, sDA, pass_fail; plug-in component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

annualloads = HBAnnualLoads(
    rooms=flatten(cluster_9.hb_obj),
    shades=flatten(cluster_9.shades),
    epw_file=file_path_3,
    north=vector_2,
    run_bal=lb_falsestarttoggle_7,
    run=lb_falsestarttoggle_7)  # -> out, total_load, cooling, heating, lighting, equip, process, hot_water, balance; plug-in component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
number_14 = Number(annualloads.total_load)
panel_15 = Panel(number_14)

mesh_join_2 = MeshJoin(Meshes=gridrooms.mesh)

panel_16 = Panel(ase.ASE)
panel_17 = Panel(sda.sDA)

# ----
# Visualize
heatmap_2 = LBSpatialHeatmap(values=flatten(cumulativeradiation.avg_irr), mesh=mesh_join_2)  # -> mesh, legend, title, colors, legend_par, vis_set; plug-in component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
heatmap_3 = LBSpatialHeatmap(values=flatten(cumulativeradiation.radiation), mesh=mesh_join_2)  # -> mesh, legend, title, colors, legend_par, vis_set; plug-in component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
heatmap_4 = LBSpatialHeatmap(values=flatten(annualdaylight.UDI), mesh=mesh_join_2)  # -> mesh, legend, title, colors, legend_par, vis_set; plug-in component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
heatmap_5 = LBSpatialHeatmap(values=flatten(annualdaylight.DA), mesh=mesh_join_2)  # -> mesh, legend, title, colors, legend_par, vis_set; plug-in component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
heatmap_6 = LBSpatialHeatmap(values=flatten(daylightfactor.results), mesh=mesh_join_2)  # -> mesh, legend, title, colors, legend_par, vis_set; plug-in component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

# ----
# Export results
lb_falsestarttoggle_8 = LBFalseStartToggle(False)
python_3_script = Python3Script(
    Run=lb_falsestarttoggle_8,
    Room_ID=text_4,
    Meshes=gridrooms.mesh,
    cDA=annualdaylight.cDA,
    sDA=sda.sDA,
    sDA_PassFail=sda.pass_fail,
    UDI=annualdaylight.UDI,
    DF=daylightfactor.results,
    Radiation=cumulativeradiation.radiation,
    ASE=ase.ASE,
    ASE_HoursAbove=ase.hrs_above)  # -> out, Run_ID, Case_ID, File_Path, Debug; inputs Room_ID: list of String, Meshes: list of Mesh, cDA: tree, sDA: list, sDA_PassFail: tree, UDI: tree, DF: tree, Radiation: tree, ASE: list, ASE_HoursAbove: tree
# ---------- python_3_script: Python ----------
# r: numpy

import os
import json
import hashlib
import datetime
import scriptcontext as sc
import Rhino.Geometry as rg
import numpy as np


# =========================================================
# OUTPUTS
# =========================================================

Run_ID = None
Case_ID = None
File_Path = None
Debug = []


# =========================================================
# GENERAL HELPERS
# =========================================================

def unwrap(x):

    if x is None:
        return None

    try:
        return x.ScriptVariable()
    except:
        pass

    try:
        return x.Value
    except:
        pass

    return x


def clean_list(data):

    if data is None:
        return []

    result = []

    for item in data:

        value = unwrap(item)

        if value is not None:
            result.append(value)

    return result


def numeric_list(data):

    if data is None:
        return []

    result = []

    for item in data:

        value = unwrap(item)

        try:
            result.append(float(value))
        except:
            pass

    return result


# =========================================================
# GRASSHOPPER TREE → NUMERIC BRANCHES
# =========================================================

def tree_to_branches(tree):

    """
    Returns:

    [
        [values for Room 0],
        [values for Room 1],
        ...
    ]

    Also handles Ladybug data collections contained
    inside branches.
    """

    result = []

    if tree is None:
        return result

    try:

        for branch in tree.Branches:

            values = []

            for item in branch:

                item = unwrap(item)

                if item is None:
                    continue


                # -----------------------------------------
                # Ladybug data collection
                # -----------------------------------------

                if hasattr(item, "values"):

                    try:

                        for value in item.values:

                            try:
                                values.append(
                                    float(value)
                                )
                            except:
                                pass

                        continue

                    except:
                        pass


                # -----------------------------------------
                # Normal numerical value
                # -----------------------------------------

                try:

                    values.append(
                        float(item)
                    )

                except:
                    pass


            result.append(values)


    except:
        pass


    return result


# =========================================================
# MESH HELPERS
# =========================================================

def get_mesh(x):

    x = unwrap(x)

    if isinstance(x, rg.Mesh):
        return x

    return None


def mesh_vertices(mesh):

    return np.array(
        [
            [v.X, v.Y, v.Z]
            for v in mesh.Vertices
        ],
        dtype=np.float32
    )


def mesh_faces(mesh):

    """
    Faces are stored as 4 integer indices.

    Triangle:
        [A, B, C, -1]

    Quad:
        [A, B, C, D]
    """

    faces = []

    for f in mesh.Faces:

        if f.IsTriangle:

            faces.append([
                f.A,
                f.B,
                f.C,
                -1
            ])

        else:

            faces.append([
                f.A,
                f.B,
                f.C,
                f.D
            ])


    return np.array(
        faces,
        dtype=np.int32
    )


def mesh_sensor_points(mesh):

    """
    Honeybee sensor grids represented by meshes
    generally use mesh-face centers as the sensor
    locations.

    One point is therefore generated per face.
    """

    centers = []

    for f in mesh.Faces:

        ids = [
            f.A,
            f.B,
            f.C
        ]

        if not f.IsTriangle:
            ids.append(f.D)


        x = 0.0
        y = 0.0
        z = 0.0


        for index in ids:

            pt = mesh.Vertices[index]

            x += pt.X
            y += pt.Y
            z += pt.Z


        count = float(
            len(ids)
        )


        centers.append([
            x / count,
            y / count,
            z / count
        ])


    return np.array(
        centers,
        dtype=np.float32
    )


# =========================================================
# DATASET FOLDER
# =========================================================

def get_daylight_folder():

    doc = (
        ghenv.Component.OnPingDocument()
    )

    if doc is None:
        return None


    gh_path = doc.FilePath

    if not gh_path:
        return None


    root = os.path.dirname(
        gh_path
    )


    folder = os.path.join(
        root,
        "Dataset_Results",
        "simulations",
        "daylight"
    )


    if not os.path.exists(folder):

        os.makedirs(folder)


    return folder


# =========================================================
# RUN ID
# =========================================================

def get_next_run_id(folder):

    max_number = 0


    if os.path.exists(folder):

        for name in os.listdir(folder):

            if not name.lower().endswith(
                ".npz"
            ):
                continue


            stem = os.path.splitext(
                name
            )[0]


            if not stem.startswith(
                "DAYLIGHT_"
            ):
                continue


            number_text = stem.replace(
                "DAYLIGHT_",
                "",
                1
            )


            try:

                number = int(
                    number_text
                )

                if number > max_number:
                    max_number = number

            except:
                pass


    return "DAYLIGHT_{:04d}".format(
        max_number + 1
    )


# =========================================================
# CASE ID
# =========================================================

def compute_case_id(
    room_ids,
    meshes
):

    """
    Case ID represents the selected analysis geometry.

    It depends on:

        Room IDs
        mesh vertex coordinates
        mesh topology

    Result values do NOT affect Case_ID.

    Coordinates are rounded to 6 decimals to avoid
    tiny floating-point noise creating a new case.
    """

    hasher = hashlib.sha256()


    pairs = list(
        zip(
            room_ids,
            meshes
        )
    )


    # Make Case_ID independent of Room list order.
    pairs.sort(
        key=lambda x: str(x[0])
    )


    for room_id, mesh_raw in pairs:

        mesh = get_mesh(
            mesh_raw
        )

        if mesh is None:
            continue


        # ---------------------------------------------
        # ROOM ID
        # ---------------------------------------------

        hasher.update(
            str(room_id).encode(
                "utf-8"
            )
        )


        # ---------------------------------------------
        # VERTICES
        # ---------------------------------------------

        vertices = np.array(
            [
                [
                    round(v.X, 6),
                    round(v.Y, 6),
                    round(v.Z, 6)
                ]
                for v in mesh.Vertices
            ],
            dtype=np.float64
        )


        hasher.update(
            vertices.tobytes()
        )


        # ---------------------------------------------
        # FACES
        # ---------------------------------------------

        faces = mesh_faces(
            mesh
        )


        hasher.update(
            faces.tobytes()
        )


    code = (
        hasher
        .hexdigest()
        [:10]
        .upper()
    )


    return "CASE_{}".format(
        code
    )


# =========================================================
# INPUT PREPARATION
# =========================================================

valid = True


if np is None:

    Debug.append(
        "ERROR: NumPy is unavailable."
    )

    Debug.append(
        "Use a Rhino 8 Python 3 component."
    )

    valid = False


room_ids = [
    str(x)
    for x in clean_list(
        Room_ID
    )
]


meshes_raw = clean_list(
    Meshes
)


# =========================================================
# BASIC VALIDATION
# =========================================================

if len(room_ids) == 0:

    Debug.append(
        "ERROR: No Room_ID values."
    )

    valid = False


if len(room_ids) != len(meshes_raw):

    Debug.append(
        "ERROR: Room_ID count = {}, "
        "Mesh count = {}.".format(
            len(room_ids),
            len(meshes_raw)
        )
    )

    valid = False


# Check all meshes
if valid:

    for i, mesh_raw in enumerate(
        meshes_raw
    ):

        mesh = get_mesh(
            mesh_raw
        )

        if mesh is None:

            Debug.append(
                "ERROR: Invalid mesh for Room {}.".format(
                    room_ids[i]
                )
            )

            valid = False


# =========================================================
# POINT / SENSOR METRICS
# =========================================================

point_metrics = {

    "cDA":
        tree_to_branches(
            cDA
        ),

    "UDI":
        tree_to_branches(
            UDI
        ),

    "DF":
        tree_to_branches(
            DF
        ),

    "Radiation":
        tree_to_branches(
            Radiation
        ),

    "sDA_pass_fail":
        tree_to_branches(
            sDA_PassFail
        ),

    "ASE_hours_above":
        tree_to_branches(
            ASE_HoursAbove
        )
}


# =========================================================
# REMOVE COMPLETELY EMPTY METRICS
# =========================================================

active_point_metrics = {}


for name, branches in (
    point_metrics.items()
):

    has_values = any(
        len(branch) > 0
        for branch in branches
    )


    if has_values:

        active_point_metrics[
            name
        ] = branches


# =========================================================
# ROOM / GRID METRICS
# =========================================================

sda_values = numeric_list(
    sDA
)

ase_values = numeric_list(
    ASE
)


active_grid_metrics = {}


if len(sda_values) > 0:

    active_grid_metrics[
        "sDA"
    ] = sda_values


if len(ase_values) > 0:

    active_grid_metrics[
        "ASE"
    ] = ase_values


# =========================================================
# CHECK BRANCH / ROOM COUNTS
# =========================================================

for name, branches in (
    active_point_metrics.items()
):

    if len(branches) != len(room_ids):

        Debug.append(
            "ERROR: {} has {} branches, "
            "but Room_ID has {} items.".format(
                name,
                len(branches),
                len(room_ids)
            )
        )

        valid = False


for name, values in (
    active_grid_metrics.items()
):

    if len(values) != len(room_ids):

        Debug.append(
            "ERROR: {} has {} values, "
            "but Room_ID has {} items.".format(
                name,
                len(values),
                len(room_ids)
            )
        )

        valid = False


# =========================================================
# CASE ID
# =========================================================

current_case_id = None


if valid:

    current_case_id = compute_case_id(
        room_ids,
        meshes_raw
    )

    Case_ID = current_case_id


# =========================================================
# BUILD NPZ CONTENT
# =========================================================

save_data = {}


metadata = {

    "schema_version":
        1,

    "simulation_type":
        "daylight",

    "case_id":
        current_case_id,

    "room_ids":
        room_ids,

    "point_metrics":
        list(
            active_point_metrics.keys()
        ),

    "grid_metrics":
        list(
            active_grid_metrics.keys()
        ),

    "rooms":
        []
}


if valid:

    for i, room_id in enumerate(
        room_ids
    ):

        mesh = get_mesh(
            meshes_raw[i]
        )


        n_vertices = (
            mesh.Vertices.Count
        )

        n_faces = (
            mesh.Faces.Count
        )


        prefix = (
            "room_{:04d}".format(i)
        )


        # =================================================
        # MESH GEOMETRY
        # =================================================

        save_data[
            prefix + "_vertices"
        ] = mesh_vertices(
            mesh
        )


        save_data[
            prefix + "_faces"
        ] = mesh_faces(
            mesh
        )


        save_data[
            prefix + "_sensor_points"
        ] = mesh_sensor_points(
            mesh
        )


        room_meta = {

            "index":
                i,

            "room_id":
                room_id,

            "vertex_count":
                n_vertices,

            "face_count":
                n_faces,

            "point_metrics":
                {},

            "grid_metrics":
                {}
        }


        # =================================================
        # POINT METRICS
        # =================================================

        for metric_name, branches in (
            active_point_metrics.items()
        ):

            values = branches[i]

            count = len(values)


            # ---------------------------------------------
            # Determine result alignment
            # ---------------------------------------------

            if count == n_faces:

                alignment = "faces"


            elif count == n_vertices:

                alignment = "vertices"


            else:

                Debug.append(
                    "ERROR: {} / {} has {} values; "
                    "mesh has {} faces and {} vertices.".format(
                        room_id,
                        metric_name,
                        count,
                        n_faces,
                        n_vertices
                    )
                )

                valid = False
                continue


            # ---------------------------------------------
            # Store values
            # ---------------------------------------------

            save_data[
                prefix
                + "_"
                + metric_name
            ] = np.array(
                values,
                dtype=np.float32
            )


            room_meta[
                "point_metrics"
            ][metric_name] = {

                "count":
                    count,

                "alignment":
                    alignment
            }


        # =================================================
        # ROOM / GRID METRICS
        # =================================================

        for metric_name, values in (
            active_grid_metrics.items()
        ):

            value = float(
                values[i]
            )


            save_data[
                prefix
                + "_"
                + metric_name
            ] = np.array(
                value,
                dtype=np.float32
            )


            room_meta[
                "grid_metrics"
            ][metric_name] = value


        metadata[
            "rooms"
        ].append(
            room_meta
        )


# =========================================================
# GENERAL DEBUG
# =========================================================

if valid:

    total_faces = 0
    total_vertices = 0


    for mesh_raw in meshes_raw:

        mesh = get_mesh(
            mesh_raw
        )

        total_faces += (
            mesh.Faces.Count
        )

        total_vertices += (
            mesh.Vertices.Count
        )


    Debug.append(
        "Rooms: {}".format(
            len(room_ids)
        )
    )


    Debug.append(
        "Case_ID: {}".format(
            current_case_id
        )
    )


    Debug.append(
        "Total sensor faces: {}".format(
            total_faces
        )
    )


    Debug.append(
        "Total mesh vertices: {}".format(
            total_vertices
        )
    )


    Debug.append(
        "Point metrics: {}".format(
            ", ".join(
                active_point_metrics.keys()
            )
            if active_point_metrics
            else "none"
        )
    )


    Debug.append(
        "Grid metrics: {}".format(
            ", ".join(
                active_grid_metrics.keys()
            )
            if active_grid_metrics
            else "none"
        )
    )


# =========================================================
# SAVE-STATE
# =========================================================

state_key = (
    "DAYLIGHT_EXPORT_"
    + str(
        ghenv.Component.InstanceGuid
    )
)


if state_key not in sc.sticky:

    sc.sticky[
        state_key
    ] = {

        "saved":
            False,

        "run_id":
            None,

        "case_id":
            None,

        "file_path":
            None
    }


state = sc.sticky[
    state_key
]


# =========================================================
# RUN = FALSE
# =========================================================

if not Run:

    # Re-arm the component.
    # The next True will create a NEW Run_ID.
    state[
        "saved"
    ] = False

    state[
        "run_id"
    ] = None

    state[
        "case_id"
    ] = None

    state[
        "file_path"
    ] = None


    sc.sticky[
        state_key
    ] = state


    Debug.append(
        "Ready. Set Run = True to save a new run."
    )


# =========================================================
# RUN = TRUE
# =========================================================

else:

    # -----------------------------------------------------
    # Already saved during this True state
    # -----------------------------------------------------

    if state["saved"]:

        Run_ID = state[
            "run_id"
        ]

        Case_ID = state[
            "case_id"
        ]

        File_Path = state[
            "file_path"
        ]


        # Geometry/grid changed after saving
        if (
            current_case_id is not None
            and
            current_case_id
            != state["case_id"]
        ):

            Debug.append(
                "WARNING: Geometry/grid changed while "
                "Run is still True."
            )

            Debug.append(
                "Existing run was NOT overwritten."
            )

            Debug.append(
                "Toggle Run False, then True, "
                "to save a new run."
            )

        else:

            Debug.append(
                "This Run=True state has already "
                "been saved."
            )

            Debug.append(
                "Toggle False then True to create "
                "a new Run_ID."
            )


    # -----------------------------------------------------
    # Not saved yet
    # -----------------------------------------------------

    elif valid:

        folder = (
            get_daylight_folder()
        )


        if folder is None:

            Debug.append(
                "ERROR: Grasshopper file "
                "must be saved first."
            )


        else:

            # =============================================
            # GENERATE NEW RUN ID
            # =============================================

            run_id = (
                get_next_run_id(
                    folder
                )
            )


            Run_ID = run_id
            Case_ID = current_case_id


            # =============================================
            # COMPLETE METADATA
            # =============================================

            metadata[
                "run_id"
            ] = run_id


            metadata[
                "created_utc"
            ] = (
                datetime.datetime
                .now(datetime.timezone.utc)
                .isoformat()
            )


            # =============================================
            # STORE METADATA INSIDE NPZ
            # =============================================

            save_data[
                "metadata_json"
            ] = np.array(
                json.dumps(
                    metadata
                )
            )


            # =============================================
            # FILE PATH
            # =============================================

            File_Path = os.path.join(
                folder,
                "{}.npz".format(
                    run_id
                )
            )


            # =============================================
            # SAVE
            # =============================================

            try:

                np.savez_compressed(
                    File_Path,
                    **save_data
                )


                # Only mark as saved AFTER
                # successful file creation.
                state[
                    "saved"
                ] = True

                state[
                    "run_id"
                ] = run_id

                state[
                    "case_id"
                ] = current_case_id

                state[
                    "file_path"
                ] = File_Path


                sc.sticky[
                    state_key
                ] = state


                Debug.append(
                    "SAVED:"
                )

                Debug.append(
                    File_Path
                )

                Debug.append(
                    "Run_ID: {}".format(
                        run_id
                    )
                )

                Debug.append(
                    "Case_ID: {}".format(
                        current_case_id
                    )
                )


            except Exception as e:

                Debug.append(
                    "ERROR SAVING FILE:"
                )

                Debug.append(
                    str(e)
                )
# ---------- end python_3_script ----------

# ==== cluster Cluster
refresh = ClusterInput()
text = ClusterInput()
text_2 = ClusterInput()
text_3 = Text(text_2)
text_4 = Text(text)
boolean = Boolean(refresh)
# Global Attributes reader
python_3_script = Python3Script(block=text_4, floor=text_3, Refresh=boolean)  # -> out, FloorNode, SiteID, FH, Rep, Debug; inputs block: String
# ---------- python_3_script: Python ----------
import Rhino

doc = Rhino.RhinoDoc.ActiveDoc


# ---------------------------------------------------------
# Outputs
# ---------------------------------------------------------

FloorNode = None

SiteID = None

Rep = 1

FH = None


Debug = []


# ---------------------------------------------------------
# Helpers
# ---------------------------------------------------------

def find_layer(path):

    target = str(path).strip().lower()

    for lyr in doc.Layers:

        if lyr is None or not lyr.FullPath:
            continue

        if lyr.FullPath.lower() == target:
            return lyr

    return None


def get_point_object(layer):

    if layer is None:
        return None

    objs = doc.Objects.FindByLayer(layer) or []

    points = [
        obj for obj in objs
        if isinstance(
            obj,
            Rhino.DocObjects.PointObject
        )
    ]

    if len(points) > 1:

        Debug.append(
            "Multiple points on {}".format(
                layer.FullPath
            )
        )

    return points[0] if points else None


def normalize_key(key):

    return (
        str(key)
        .strip()
        .lower()
        .replace(" ", "")
        .replace("_", "")
        .replace("-", "")
    )


def read(obj, key):

    if obj is None:
        return None

    strings = obj.Attributes.GetUserStrings()

    if not strings:
        return None

    wanted = normalize_key(key)

    for existing_key in strings.AllKeys:

        if normalize_key(existing_key) == wanted:

            value = strings[existing_key]

            if value is None:
                return None

            value = str(value).strip()

            return value if value else None

    return None


def to_number(value):

    if value is None:
        return None

    try:
        return float(value)
    except:
        return None


def to_integer(value):

    if value is None:
        return None

    try:
        return int(float(value))
    except:
        return None


def to_boolean(value):

    if value is None:
        return None

    text = str(value).strip().lower()

    if text in [
        "true",
        "1",
        "yes"
    ]:
        return True

    if text in [
        "false",
        "0",
        "no"
    ]:
        return False

    return None


def resolve(key, kind="number"):
    """
    Resolve one value:

    Floor
      ↓ missing
    Block
      ↓ missing
    Site
    """

    for level_name, obj in [
        ("Floor", floor_obj),
        ("Block", block_obj),
        ("Site", site_obj)
    ]:

        value = read(
            obj,
            key
        )

        if value is None:
            continue


        if kind == "text":

            return value


        elif kind == "integer":

            result = to_integer(
                value
            )


        elif kind == "boolean":

            result = to_boolean(
                value
            )


        else:

            result = to_number(
                value
            )


        if result is not None:
            return result


        Debug.append(
            "Invalid {} on {}: {}".format(
                key,
                level_name,
                value
            )
        )

    return None


# ---------------------------------------------------------
# Build fixed hierarchy paths
# ---------------------------------------------------------

if block is None or floor is None:

    Debug.append(
        "block or floor input is missing"
    )

else:

    block = str(block).strip()
    floor = str(floor).strip()


    site_info_path = (
        "L0_SITE"
        + "::01_Info"
    )


    block_info_path = (
        "L0_SITE"
        + "::L1_BLOCKS::"
        + block
        + "::01_Info"
    )


    floor_info_path = (
        "L0_SITE"
        + "::L1_BLOCKS::"
        + block
        + "::L2_FLOORS::"
        + floor
        + "::01_Info"
    )


    # -----------------------------------------------------
    # Find Info layers
    # -----------------------------------------------------

    site_layer = find_layer(
        site_info_path
    )

    block_layer = find_layer(
        block_info_path
    )

    floor_layer = find_layer(
        floor_info_path
    )


    # -----------------------------------------------------
    # Find node points
    # -----------------------------------------------------

    site_obj = get_point_object(
        site_layer
    )

    block_obj = get_point_object(
        block_layer
    )

    floor_obj = get_point_object(
        floor_layer
    )


    # -----------------------------------------------------
    # Point outputs
    # -----------------------------------------------------


    if floor_obj is not None:
        FloorNode = floor_obj.Geometry.Location


    # =====================================================
    # SITE ONLY
    # =====================================================

    SiteID = read(
        site_obj,
        "SiteID"
    )


    # =====================================================
    # FLOOR ONLY
    # =====================================================

    rep_value = to_integer(
        read(
            floor_obj,
            "Rep"
        )
    )

    if rep_value is not None:
        Rep = rep_value



    # =====================================================
    # FLOOR -> BLOCK -> SITE
    # =====================================================

    # Floor height
    FH = resolve(
        "FH"
    )

    # -----------------------------------------------------
    # Debug
    # -----------------------------------------------------

    Debug.append(
        "Site Info: {}".format(
            site_info_path
            if site_obj is not None
            else "NOT FOUND"
        )
    )

    Debug.append(
        "Block Info: {}".format(
            block_info_path
            if block_obj is not None
            else "NOT FOUND"
        )
    )

    Debug.append(
        "Floor Info: {}".format(
            floor_info_path
            if floor_obj is not None
            else "NOT FOUND"
        )
    )

    Debug.append(
        "SiteID: {}".format(
            SiteID
        )
    )

    Debug.append(
        "Rep={}, FH={}".format(
            Rep,
            FH
        )
    )
# ---------- end python_3_script ----------
concatenate = Concatenate(Block=text_4, A="::", Floor=text_3, B="::", Layer_type="Rooms")
number = Number(python_3_script.Rep)
number_2 = Number(python_3_script.FH)
point = Point(python_3_script.FloorNode)
text_5 = Text(python_3_script.SiteID)
python_3_script_2 = Python3Script(layer=concatenate, Refresh=boolean)  # -> geoms, SH, WH, DH, RT, ShH, ShT; inputs layer: String, Refresh: Boolean
# ---------- python_3_script_2: Python ----------
import Rhino

doc = Rhino.RhinoDoc.ActiveDoc

# ---------------------------------------------------------
# Outputs
# ---------------------------------------------------------

geoms = []
RT = []
Debug = []


# ---------------------------------------------------------
# Input example:
#
# BLOCK_01::GF::Rooms
# BLOCK_01::GF::Windows
# BLOCK_01::GF::Doors
# BLOCK_01::GF::Shades
# ---------------------------------------------------------

if layer is None:

    Debug.append("Layer input is missing")

else:

    path = str(layer).strip()
    parts = path.split("::")

    if len(parts) < 3:

        Debug.append(
            "Expected: BLOCK::FLOOR::GEOMETRY"
        )

    else:

        block = parts[0]
        floor = parts[1]

        # Everything after block + floor
        geometry_parts = parts[2:]

        geometry_path = "::".join(
            geometry_parts
        )


        # -------------------------------------------------
        # Construct actual Rhino path
        # -------------------------------------------------

        full_path = (
            "L0_SITE"
            + "::L1_BLOCKS::"
            + block
            + "::L2_FLOORS::"
            + floor
            + "::02_Geometries::"
            + geometry_path
        )


        # -------------------------------------------------
        # Find layer ignoring capitalization
        # -------------------------------------------------

        root_layer = None

        for lyr in doc.Layers:

            if lyr is None or not lyr.FullPath:
                continue

            if lyr.FullPath.lower() == full_path.lower():

                root_layer = lyr
                break


        if root_layer is None:

            Debug.append(
                "Layer not found: {}".format(
                    full_path
                )
            )

        else:

            root_path = root_layer.FullPath


            # -------------------------------------------------
            # Read selected layer + all descendants
            # -------------------------------------------------

            for lyr in doc.Layers:

                if lyr is None or not lyr.FullPath:
                    continue

                current_path = lyr.FullPath

                if not (
                    current_path == root_path
                    or current_path.startswith(
                        root_path + "::"
                    )
                ):
                    continue


                objs = doc.Objects.FindByLayer(
                    lyr
                ) or []

                if not objs:
                    continue


                # ---------------------------------------------
                # Room type
                #
                # ...::Rooms::Bedroom
                # ...::Rooms::Kitchen
                # ---------------------------------------------

                room_type = None

                layer_parts = current_path.split("::")

                names_lower = [
                    x.lower()
                    for x in layer_parts
                ]

                if "rooms" in names_lower:

                    i = names_lower.index(
                        "rooms"
                    )

                    if len(layer_parts) > i + 1:

                        room_type = layer_parts[
                            i + 1
                        ]


                # ---------------------------------------------
                # Geometry
                # ---------------------------------------------

                for obj in objs:

                    geo = obj.Geometry

                    if geo is None:
                        continue

                    geoms.append(
                        geo
                    )

                    RT.append(
                        room_type
                    )


            Debug.append(
                "Found: {}".format(
                    root_path
                )
            )

            Debug.append(
                "Geometry count: {}".format(
                    len(geoms)
                )
            )
# ---------- end python_3_script_2 ----------
curve = Curve(python_3_script_2.geoms)
text_6 = Text(python_3_script_2.RT)
concatenate_2 = Concatenate(C=text_5, D="_", Block=text_4, A="_", Floor=text_3)
curve_2 = Curve(curve)
unit_z = UnitZ(Factor=number_2)
match_text = MatchText(Text="Core", Pattern=text_6, Case=True)
dispatch = Dispatch(List=curve_2, DispatchPattern=match_text)  # -> ListA, ListB
region_union = RegionUnion(Curves=curve_2)
curve_3 = Curve(dispatch.ListB)
extrude = Extrude(Base=region_union, Direction=unit_z)
region_union_2 = RegionUnion(Curves=curve_3)
cap_holes = CapHoles(Brep=extrude)
brep = Brep(cap_holes)
run = ClusterInput()
point_2 = Point(point)
number_3 = Number(number_2)
number_4 = Number(number)
curve_4 = Curve(region_union_2)
text_7 = Text(concatenate_2)
brep_2 = Brep(cap_holes)
python_3_script_3 = Python3Script(Floor_pt=point_2, FH=number_3, Rep=number_4, Floor_boundary=curve_4, Floor_massing=brep_2)  # -> out, Floor_pt_R, Rep_Index, Floor_boundary_R, Floor_massing_R, DZ, Debug; inputs Floor_boundary: list, Floor_massing: list of Brep
# ---------- python_3_script_3: Python ----------
import Rhino.Geometry as rg

from Grasshopper import DataTree
from Grasshopper.Kernel.Data import GH_Path


# =========================================================
# OUTPUTS
# =========================================================

Floor_pt_R = []
Rep_Index = []

Floor_boundary_R = DataTree[object]()
Floor_massing_R = DataTree[object]()

DZ = []
Debug = []


# =========================================================
# HELPERS
# =========================================================

def flatten_items(x):

    if x is None:
        return []

    if isinstance(x, str):
        return [x]

    # Grasshopper DataTree
    if hasattr(x, "Branches"):

        result = []

        for branch in x.Branches:
            for item in branch:
                result.extend(flatten_items(item))

        return result

    # GH wrapper
    if hasattr(x, "Value"):

        try:
            x = x.Value
        except:
            pass

    # Geometry / point
    if isinstance(
        x,
        (
            rg.GeometryBase,
            rg.Point3d,
            rg.Line,
            rg.Polyline
        )
    ):
        return [x]

    try:

        result = []

        for item in x:
            result.extend(flatten_items(item))

        return result

    except:

        return [x]


def copy_move(g, dz):

    if g is None:
        return None

    if hasattr(g, "Value"):

        try:
            g = g.Value
        except:
            pass

    move = rg.Transform.Translation(
        0,
        0,
        dz
    )

    # Point3d
    if isinstance(g, rg.Point3d):

        c = rg.Point3d(g)
        c.Transform(move)

        return c

    # Line
    if isinstance(g, rg.Line):

        c = rg.Line(
            g.From,
            g.To
        )

        c.Transform(move)

        return c

    # Polyline
    if isinstance(g, rg.Polyline):

        c = rg.Polyline(g)
        c.Transform(move)

        return c

    # Curve / Brep / Mesh / Surface / Point...
    if isinstance(g, rg.GeometryBase):

        try:
            c = g.Duplicate()
        except:
            return None

        c.Transform(move)

        return c

    return None


def instance_id(source_id, i):

    source_id = str(source_id)

    if i == 0:
        return source_id

    return "{}_REP{:02d}".format(
        source_id,
        i + 1
    )


# =========================================================
# INPUTS
# =========================================================

try:
    fh = float(FH)
except:
    fh = None

try:
    rep = int(Rep)
except:
    rep = 1

if rep < 1:
    rep = 1


boundaries = flatten_items(
    Floor_boundary
)

masses = flatten_items(
    Floor_massing
)


# =========================================================
# REPEAT
# =========================================================

if fh is None:

    Debug.append(
        "FH is missing or invalid."
    )

else:

    for i in range(rep):

        dz = i * fh
        path = GH_Path(i)

        Rep_Index.append(i)
        DZ.append(dz)

        # -------------------------------------------------
        # Floor point
        # -------------------------------------------------

        moved_pt = copy_move(
            Floor_pt,
            dz
        )

        if moved_pt is not None:

            Floor_pt_R.append(
                moved_pt
            )


        # -------------------------------------------------
        # Boundary
        # -------------------------------------------------

        Floor_boundary_R.EnsurePath(
            path
        )

        for g in boundaries:

            c = copy_move(
                g,
                dz
            )

            if c is not None:

                Floor_boundary_R.Add(
                    c,
                    path
                )


        # -------------------------------------------------
        # Massing
        # -------------------------------------------------

        Floor_massing_R.EnsurePath(
            path
        )

        for g in masses:

            c = copy_move(
                g,
                dz
            )

            if c is not None:

                Floor_massing_R.Add(
                    c,
                    path
                )


# =========================================================
# DEBUG
# =========================================================


Debug.append(
    "Rep: {}".format(rep)
)

Debug.append(
    "Repeated floor instances: {}".format(
        len(Rep_Index)
    )
)

Debug.append(
    "Floor masses: {}".format(
        Floor_massing_R.DataCount
    )
)
# ---------- end python_3_script_3 ----------
python_3_script_4 = Python3Script(Run=run, Floor_ID=text_7, Floor_pt=point_2, Slab_crv=curve_4, Rep=number_4, FH=number_3)  # -> out, Floor_Data, File_Path, Debug; inputs Run: Boolean, Floor_ID: String, Floor_pt: Point3d, Slab_crv: list of Curve, Rep: Int32, FH: Double
# ---------- python_3_script_4: Python ----------
import os
import json
import Rhino.Geometry as rg


# =========================================================
# OUTPUTS
# =========================================================

Floor_Data = None
File_Path = None
Debug = []


# =========================================================
# HELPERS
# =========================================================
def get_dataset_folder():

    doc = ghenv.Component.OnPingDocument()

    if doc is None:
        return None

    gh_path = doc.FilePath

    if not gh_path:
        return None

    script_folder = os.path.dirname(
        gh_path
    )

    dataset_folder = os.path.join(
        script_folder,
        "Dataset_Results"
    )

    if not os.path.exists(
        dataset_folder
    ):
        os.makedirs(
            dataset_folder
        )

    return dataset_folder

def xyz(pt):
    if pt is None:
        return None

    try:
        return [
            float(pt.X),
            float(pt.Y),
            float(pt.Z)
        ]
    except:
        return None


def unwrap(x):
    if x is None:
        return None

    try:
        return x.ScriptVariable()
    except:
        pass

    try:
        return x.Value
    except:
        pass

    return x


def curve_vertices(crv):
    """
    Export a polygonal floor/slab curve as XYZ vertices.
    """

    crv = unwrap(crv)

    if crv is None:
        return []


    # ---------------------------------------------
    # PolylineCurve / polyline-compatible curve
    # ---------------------------------------------

    try:
        success, polyline = crv.TryGetPolyline()

        if success:

            pts = []

            for pt in polyline:
                pts.append(xyz(pt))

            # Avoid storing the duplicated closing
            # point twice.
            if (
                len(pts) > 1
                and
                pts[0] == pts[-1]
            ):
                pts.pop()

            return pts

    except:
        pass


    # ---------------------------------------------
    # Fallback:
    # use curve discontinuities / endpoints
    # ---------------------------------------------

    try:

        nurbs = crv.ToNurbsCurve()

        pts = []

        for cp in nurbs.Points:
            pts.append(
                xyz(cp.Location)
            )

        return pts

    except:

        return []


# =========================================================
# PREPARE INPUTS
# =========================================================

floor_id = str(Floor_ID).strip() if Floor_ID else ""

floor_pt = unwrap(Floor_pt)
slab_crv = unwrap(Slab_crv)


try:
    rep = int(Rep)
except:
    rep = 1

if rep < 1:
    rep = 1


try:
    fh = float(FH)
except:
    fh = None


# =========================================================
# VALIDATION
# =========================================================

valid = True


if not floor_id:

    Debug.append(
        "ERROR: Floor_ID is missing."
    )

    valid = False


if floor_pt is None:

    Debug.append(
        "ERROR: Floor_pt is missing."
    )

    valid = False


if slab_crv is None:

    Debug.append(
        "ERROR: Slab_crv is missing."
    )

    valid = False


if fh is None:

    Debug.append(
        "ERROR: FH is missing or invalid."
    )

    valid = False


# =========================================================
# BUILD FLOOR DATA
# =========================================================

if valid:

    instances = []

    for i in range(rep):

        instances.append({
            "rep_index": i,
            "dz": i * fh
        })


    Floor_Data = {

        "floor_id":
            floor_id,

        "floor_point":
            xyz(floor_pt),

        "slab_curve":
            curve_vertices(slab_crv),

        "rep":
            rep,

        "floor_height":
            fh,

        "instances":
            instances
    }


    Debug.append(
        "Floor data prepared."
    )

    Debug.append(
        "Floor_ID: {}".format(
            floor_id
        )
    )

    Debug.append(
        "Rep: {}".format(
            rep
        )
    )

    Debug.append(
        "FH: {}".format(
            fh
        )
    )

    Debug.append(
        "Slab vertices: {}".format(
            len(Floor_Data["slab_curve"])
        )
    )


# =========================================================
# SAVE
# =========================================================

# =========================================================
# SAVE
# =========================================================

if Run and valid:

    dataset_folder = get_dataset_folder()

    if dataset_folder is None:

        Debug.append(
            "ERROR: Grasshopper file must be saved first."
        )

    else:

        # ---------------------------------------------
        # Floor dataset folder
        # ---------------------------------------------

        floor_folder = os.path.join(
            dataset_folder,
            "floors"
        )

        if not os.path.exists(
            floor_folder
        ):
            os.makedirs(
                floor_folder
            )


        safe_id = (
            floor_id
            .replace(" ", "_")
            .replace(":", "_")
            .replace("/", "_")
            .replace("\\", "_")
        )


        File_Path = os.path.join(
            floor_folder,
            "{}.json".format(
                safe_id
            )
        )


        with open(
            File_Path,
            "w"
        ) as f:

            json.dump(
                Floor_Data,
                f,
                indent=2
            )


        Debug.append(
            "SAVED:"
        )

        Debug.append(
            File_Path
        )


elif not Run:

    Debug.append(
        "Ready. Set Run = True to save."
    )
# ---------- end python_3_script_4 ----------
brep_3 = Brep(python_3_script_3.Floor_massing_R)
floor_massing_r = ClusterOutput(brep_3)  # union of room volums
floor_vol = ClusterOutput(brep_2)  # union of room volums
floor_id = ClusterOutput(text_7)
rep = ClusterOutput(number_4)  # no. of Repeated floors
fh = ClusterOutput(number_3)  # Floor Height (m)

# ==== cluster Cluster_2
rep = ClusterInput()
refresh = ClusterInput()
fh = ClusterInput()
text = ClusterInput()
text_2 = ClusterInput()
number = Number(rep)
number_2 = Number(fh)
text_3 = Text(text_2)
text_4 = Text(text)
boolean = Boolean(refresh)
concatenate = Concatenate(Block=text_4, A="::", Floor=text_3, B="::", Layer_type="Windows")
concatenate_2 = Concatenate(Block=text_4, A="::", Floor=text_3, B="::", Layer_type="Doors")
concatenate_3 = Concatenate(Block=text_4, A="::", Floor=text_3, B="::", Layer_type="Shades")
# Global Attributes reader
python_3_script = Python3Script(block=text_4, floor=text_3, Refresh=boolean)  # -> out, WH, SH, DH, ShH, ShT, Debug; inputs block: String
# ---------- python_3_script: Python ----------
import Rhino

doc = Rhino.RhinoDoc.ActiveDoc


# ---------------------------------------------------------
# Outputs
# ---------------------------------------------------------


DH = 2.1

SH = 1.0
WH = 1.2

ShH = None
ShT = 0.1

Debug = []

site_obj = None
block_obj = None
floor_obj = None

# ---------------------------------------------------------
# Helpers
# ---------------------------------------------------------

def find_layer(path):

    target = str(path).strip().lower()

    for lyr in doc.Layers:

        if lyr is None or not lyr.FullPath:
            continue

        if lyr.FullPath.lower() == target:
            return lyr

    return None


def get_point_object(layer):

    if layer is None:
        return None

    objs = doc.Objects.FindByLayer(layer) or []

    points = [
        obj for obj in objs
        if isinstance(
            obj,
            Rhino.DocObjects.PointObject
        )
    ]

    if len(points) > 1:

        Debug.append(
            "Multiple points on {}".format(
                layer.FullPath
            )
        )

    return points[0] if points else None


def normalize_key(key):

    return (
        str(key)
        .strip()
        .lower()
        .replace(" ", "")
        .replace("_", "")
        .replace("-", "")
    )


def read(obj, key):

    if obj is None:
        return None

    strings = obj.Attributes.GetUserStrings()

    if not strings:
        return None

    wanted = normalize_key(key)

    for existing_key in strings.AllKeys:

        if normalize_key(existing_key) == wanted:

            value = strings[existing_key]

            if value is None:
                return None

            value = str(value).strip()

            return value if value else None

    return None


def to_number(value):

    if value is None:
        return None

    try:
        return float(value)
    except:
        return None


def to_integer(value):

    if value is None:
        return None

    try:
        return int(float(value))
    except:
        return None


def to_boolean(value):

    if value is None:
        return None

    text = str(value).strip().lower()

    if text in [
        "true",
        "1",
        "yes"
    ]:
        return True

    if text in [
        "false",
        "0",
        "no"
    ]:
        return False

    return None


def resolve(key, kind="number"):
    """
    Resolve one value:

    Floor
      ↓ missing
    Block
      ↓ missing
    Site
    """

    for level_name, obj in [
        ("Floor", floor_obj),
        ("Block", block_obj),
        ("Site", site_obj)
    ]:

        value = read(
            obj,
            key
        )

        if value is None:
            continue


        if kind == "text":

            return value


        elif kind == "integer":

            result = to_integer(
                value
            )


        elif kind == "boolean":

            result = to_boolean(
                value
            )


        else:

            result = to_number(
                value
            )


        if result is not None:
            return result


        Debug.append(
            "Invalid {} on {}: {}".format(
                key,
                level_name,
                value
            )
        )

    return None


# ---------------------------------------------------------
# Build fixed hierarchy paths
# ---------------------------------------------------------

if block is None or floor is None:

    Debug.append(
        "block or floor input is missing"
    )

else:

    block = str(block).strip()
    floor = str(floor).strip()


    site_info_path = (
        "L0_SITE"
        + "::01_Info"
    )


    block_info_path = (
        "L0_SITE"
        + "::L1_BLOCKS::"
        + block
        + "::01_Info"
    )


    floor_info_path = (
        "L0_SITE"
        + "::L1_BLOCKS::"
        + block
        + "::L2_FLOORS::"
        + floor
        + "::01_Info"
    )


    # -----------------------------------------------------
    # Find Info layers
    # -----------------------------------------------------

    site_layer = find_layer(
        site_info_path
    )

    block_layer = find_layer(
        block_info_path
    )

    floor_layer = find_layer(
        floor_info_path
    )


    # -----------------------------------------------------
    # Doors
    # -----------------------------------------------------

    value = resolve(
        "DH"
    )

    if value is not None:
        DH = value


    # -----------------------------------------------------
    # Windows
    # -----------------------------------------------------

    value = resolve(
        "SH"
    )

    if value is not None:
        SH = value


    value = resolve(
        "WH"
    )

    if value is not None:
        WH = value


    # -----------------------------------------------------
    # Shades / balconies
    # -----------------------------------------------------

    value = resolve(
        "ShT"
    )

    if value is not None:
        ShT = value


    ShH = resolve(
        "ShH"
    )


    # -----------------------------------------------------
    # Debug
    # -----------------------------------------------------

    Debug.append(
        "Site Info: {}".format(
            site_info_path
            if site_obj is not None
            else "NOT FOUND"
        )
    )

    Debug.append(
        "Block Info: {}".format(
            block_info_path
            if block_obj is not None
            else "NOT FOUND"
        )
    )

    Debug.append(
        "Floor Info: {}".format(
            floor_info_path
            if floor_obj is not None
            else "NOT FOUND"
        )
    )
# ---------- end python_3_script ----------
boolean_2 = Boolean(boolean)
number_3 = Number(python_3_script.WH)
number_4 = Number(python_3_script.SH)
number_5 = Number(python_3_script.DH)
number_6 = Number(python_3_script.ShH)
number_7 = Number(python_3_script.ShT)
python_3_script_2 = Python3Script(layer=concatenate, Refresh=boolean_2)  # -> geoms, SH, WH, DH, RT, ShH, ShT; inputs layer: String, Refresh: Boolean; same code as python_3_script_2
python_3_script_3 = Python3Script(layer=concatenate_2, Refresh=boolean_2)  # -> geoms, SH, WH, DH, RT, ShH, ShT; inputs layer: String, Refresh: Boolean; same code as python_3_script_2
python_3_script_4 = Python3Script(layer=concatenate_3, Refresh=boolean_2)  # -> geoms, SH, WH, DH, RT, ShH, ShT; inputs layer: String, Refresh: Boolean; same code as python_3_script_2
curve = Curve(python_3_script_2.geoms)
number_8 = Number(python_3_script_2.SH)
number_9 = Number(python_3_script_2.WH)
number_10 = Number(python_3_script_3.DH)
curve_2 = Curve(python_3_script_3.geoms)
curve_3 = Curve(python_3_script_4.geoms)
number_11 = Number(python_3_script_4.ShH)
number_12 = Number(python_3_script_4.ShT)
number_13 = Number(number_11)
number_14 = Number(number_6)
replace_nulls = ReplaceNulls(Items=number_13, Replacements=number_14)  # -> Items, Count
number_15 = Number(number_9)
number_16 = Number(number_8)
number_17 = Number(number_4)
number_18 = Number(number_10)
number_19 = Number(number_5)
number_20 = Number(number_12)
number_21 = Number(number_3)
number_22 = Number(number_2)
number_23 = Number(number_7)
replace_nulls_2 = ReplaceNulls(Items=replace_nulls.Items, Replacements=number_22)  # -> Items, Count
replace_nulls_3 = ReplaceNulls(Items=number_15, Replacements=number_21)  # -> Items, Count
replace_nulls_4 = ReplaceNulls(Items=number_16, Replacements=number_17)  # -> Items, Count
replace_nulls_5 = ReplaceNulls(Items=number_18, Replacements=number_19)  # -> Items, Count
replace_nulls_6 = ReplaceNulls(Items=number_20, Replacements=number_23)  # -> Items, Count
unit_z = UnitZ(Factor=replace_nulls_3.Items)
negative = Negative(Value=replace_nulls_6.Items)
unit_z_2 = UnitZ(Factor=replace_nulls_5.Items)
unit_z_3 = UnitZ(Factor=0.1)
unit_z_4 = UnitZ(Factor=replace_nulls_4.Items)
unit_z_5 = UnitZ(Factor=replace_nulls_2.Items)
unit_z_6 = UnitZ(Factor=negative)
curve_4 = Curve(curve)
curve_5 = Curve(curve_2)
curve_6 = Curve(curve_3)
move = Move(Geometry=curve_4, Motion=unit_z)  # -> Geometry, Transform
move_2 = Move(Geometry=curve_5, Motion=unit_z_3)  # -> Geometry, Transform
move_3 = Move(Geometry=curve_6, Motion=unit_z_5)  # -> Geometry, Transform
extrude = Extrude(Base=move.Geometry, Direction=unit_z_4)
extrude_2 = Extrude(Base=move_2.Geometry, Direction=unit_z_2)
extrude_3 = Extrude(Base=move_3.Geometry, Direction=unit_z_6)
cap_holes = CapHoles(Brep=extrude_3)
room_crv = ClusterInput()
room_id = ClusterInput()
floor_id = ClusterInput()
run = ClusterInput()
python_3_script_5 = Python3Script(Windows=extrude, Doors=extrude_2, Shade_balcony=cap_holes, FH=number_2, Rep=number)  # -> Out, Windows_R, Doors_R, Shade_balcony_R, Rep_Index, DZ, Debug; inputs Windows: list of Brep, Doors: list of Brep, Shade_balcony: list of Brep
# ---------- python_3_script_5: Python ----------
import Rhino.Geometry as rg
from Grasshopper import DataTree
from Grasshopper.Kernel.Data import GH_Path


# =========================================================
# OUTPUTS
# =========================================================

Windows_R = DataTree[object]()
Doors_R = DataTree[object]()
Shade_balcony_R = DataTree[object]()

Rep_Index = []
DZ = []
Debug = []


# =========================================================
# HELPERS
# =========================================================

def flatten_items(x):

    if x is None:
        return []

    if isinstance(x, str):
        return [x]

    if hasattr(x, "Branches"):

        result = []

        for branch in x.Branches:
            for item in branch:
                result.extend(flatten_items(item))

        return result

    if hasattr(x, "Value"):

        try:
            x = x.Value
        except:
            pass

    if isinstance(
        x,
        (
            rg.GeometryBase,
            rg.Point3d,
            rg.Line,
            rg.Polyline
        )
    ):
        return [x]

    try:

        result = []

        for item in x:
            result.extend(flatten_items(item))

        return result

    except:

        return [x]


def copy_move(g, dz):

    if g is None:
        return None

    if hasattr(g, "Value"):

        try:
            g = g.Value
        except:
            pass

    move = rg.Transform.Translation(
        0,
        0,
        dz
    )

    if isinstance(g, rg.Point3d):

        c = rg.Point3d(g)
        c.Transform(move)

        return c

    if isinstance(g, rg.Line):

        c = rg.Line(
            g.From,
            g.To
        )

        c.Transform(move)

        return c

    if isinstance(g, rg.Polyline):

        c = rg.Polyline(g)
        c.Transform(move)

        return c

    if isinstance(g, rg.GeometryBase):

        try:
            c = g.Duplicate()
        except:
            try:
                c = g.DuplicateGeometry()
            except:
                return None

        c.Transform(move)

        return c

    return None


def repeat_geometry(source, output_tree, rep, fh):

    items = flatten_items(source)

    for i in range(rep):

        path = GH_Path(i)
        dz = i * fh

        output_tree.EnsurePath(path)

        for item in items:

            c = copy_move(
                item,
                dz
            )

            if c is not None:

                output_tree.Add(
                    c,
                    path
                )


# =========================================================
# INPUTS
# =========================================================

try:
    fh = float(FH)
except:
    fh = None

try:
    rep = int(Rep)
except:
    rep = 1

if rep < 1:
    rep = 1


# =========================================================
# RUN
# =========================================================

if fh is None:

    Debug.append(
        "FH is missing or invalid."
    )

else:

    for i in range(rep):

        Rep_Index.append(i)
        DZ.append(i * fh)


    repeat_geometry(
        Windows,
        Windows_R,
        rep,
        fh
    )

    repeat_geometry(
        Doors,
        Doors_R,
        rep,
        fh
    )

    repeat_geometry(
        Shade_balcony,
        Shade_balcony_R,
        rep,
        fh
    )


# =========================================================
# DEBUG
# =========================================================

Debug.append(
    "Rep: {}".format(rep)
)

Debug.append(
    "Windows: {}".format(
        Windows_R.DataCount
    )
)

Debug.append(
    "Doors: {}".format(
        Doors_R.DataCount
    )
)

Debug.append(
    "Shades / balconies: {}".format(
        Shade_balcony_R.DataCount
    )
)
Debug.append(
    "Windows_R branches: {}".format(
        Windows_R.BranchCount
    )
)

Debug.append(
    "Windows_R items: {}".format(
        Windows_R.DataCount
    )
)

if Windows_R.DataCount > 0:
    Debug.append(
        "First window type: {}".format(
            type(Windows_R.Branch(0)[0])
        )
    )
# ---------- end python_3_script_5 ----------
python_3_script_6 = Python3Script(Run=run, Floor_ID=floor_id, Room_ID=room_id, Room_crv=room_crv, Windows=extrude, Doors=extrude_2, Shades=cap_holes)  # -> out, Arch_Data, File_Path, Debug; inputs Run: Boolean, Floor_ID: String, Room_ID: list of String, Room_crv: list of Curve, Windows: list of Curve, Doors: list of Curve, Shades: list of Curve
# ---------- python_3_script_6: Python ----------
import os
import json
import Rhino.Geometry as rg


# =========================================================
# OUTPUTS
# =========================================================

Arch_Data = None
File_Path = None
Debug = []


# =========================================================
# HELPERS
# =========================================================

def unwrap(x):

    if x is None:
        return None

    try:
        return x.ScriptVariable()
    except:
        pass

    try:
        return x.Value
    except:
        pass

    return x


def xyz(pt):

    if pt is None:
        return None

    return [
        float(pt.X),
        float(pt.Y),
        float(pt.Z)
    ]


def preserve_list(data):

    if data is None:
        return []

    return [
        unwrap(x)
        for x in data
    ]


def curve_vertices(crv):

    crv = unwrap(crv)

    if crv is None:
        return []

    try:

        success, poly = crv.TryGetPolyline()

        if success:

            pts = [
                xyz(p)
                for p in poly
            ]

            if len(pts) > 1 and pts[0] == pts[-1]:
                pts.pop()

            return pts

    except:
        pass

    try:

        nurbs = crv.ToNurbsCurve()

        return [
            xyz(cp.Location)
            for cp in nurbs.Points
        ]

    except:
        return []


# =========================================================
# REPRESENTATIVE POINT
# =========================================================

def representative_point(g):

    g = unwrap(g)

    if g is None:
        return None


    # Point
    if isinstance(g, rg.Point3d):
        return g


    # Curve
    if isinstance(g, rg.Curve):

        try:
            amp = rg.AreaMassProperties.Compute(g)

            if amp:
                return amp.Centroid
        except:
            pass

        try:
            return g.PointAtNormalizedLength(0.5)
        except:
            pass


    # Brep
    if isinstance(g, rg.Brep):

        try:
            amp = rg.AreaMassProperties.Compute(g)

            if amp:
                return amp.Centroid
        except:
            pass

        try:
            return g.GetBoundingBox(True).Center
        except:
            pass


    # Surface
    if isinstance(g, rg.Surface):

        try:

            b = g.ToBrep()

            amp = rg.AreaMassProperties.Compute(b)

            if amp:
                return amp.Centroid

        except:
            pass


    # Generic fallback
    try:
        return g.GetBoundingBox(True).Center
    except:
        return None


# =========================================================
# ROOM MATCHING
# =========================================================

def match_room(geo, room_ids, room_curves):

    pt = representative_point(geo)

    if pt is None:
        return None, None


    best_id = None
    best_dist = None


    for room_id, room_crv in zip(
        room_ids,
        room_curves
    ):

        crv = unwrap(room_crv)

        if crv is None:
            continue


        try:

            success, t = crv.ClosestPoint(pt)

            if not success:
                continue

            closest = crv.PointAt(t)

            dist = pt.DistanceTo(
                closest
            )


            if (
                best_dist is None
                or
                dist < best_dist
            ):

                best_dist = dist
                best_id = str(room_id)

        except:
            pass


    return best_id, best_dist


# =========================================================
# GEOMETRY SERIALIZATION
# =========================================================

def geometry_data(g):

    g = unwrap(g)

    if g is None:
        return None


    # Curve
    if isinstance(g, rg.Curve):

        return {
            "type": "Curve",
            "vertices": curve_vertices(g)
        }


    # Brep / Surface:
    # store edge loops
    if isinstance(g, rg.Surface):

        try:
            g = g.ToBrep()
        except:
            return None


    if isinstance(g, rg.Brep):

        faces = []

        for face in g.Faces:

            loops = []

            for loop in face.Loops:

                try:

                    crv = loop.To3dCurve()

                    pts = curve_vertices(
                        crv
                    )

                    if pts:
                        loops.append(
                            pts
                        )

                except:
                    pass

            if loops:

                faces.append({
                    "loops": loops
                })


        return {
            "type": "Brep",
            "faces": faces
        }


    return None


# =========================================================
# PATH
# =========================================================

def get_dataset_folder():

    doc = ghenv.Component.OnPingDocument()

    if doc is None:
        return None

    gh_path = doc.FilePath

    if not gh_path:
        return None

    root = os.path.dirname(
        gh_path
    )

    folder = os.path.join(
        root,
        "Dataset_Results"
    )

    if not os.path.exists(folder):
        os.makedirs(folder)

    return folder


def safe_name(text):

    return (
        str(text)
        .replace(" ", "_")
        .replace(":", "_")
        .replace("/", "_")
        .replace("\\", "_")
    )


# =========================================================
# INPUTS
# =========================================================

floor_id = (
    str(Floor_ID).strip()
    if Floor_ID
    else ""
)

windows = preserve_list(
    Windows
)

doors = preserve_list(
    Doors
)

shades = preserve_list(
    Shades
)

room_ids = preserve_list(
    Room_ID
)

room_curves = preserve_list(
    Room_crv
)


# =========================================================
# VALIDATION
# =========================================================

valid = True


if not floor_id:

    Debug.append(
        "ERROR: Floor_ID missing."
    )

    valid = False


if len(room_ids) != len(room_curves):

    Debug.append(
        "ERROR: Room_ID count = {}, "
        "Room_crv count = {}.".format(
            len(room_ids),
            len(room_curves)
        )
    )

    valid = False


# =========================================================
# BUILD ELEMENT RECORDS
# =========================================================

def build_records(
    geometry_list,
    element_name
):

    records = []

    unmatched = 0


    for geo in geometry_list:

        room_id, distance = match_room(
            geo,
            room_ids,
            room_curves
        )


        if room_id is None:
            unmatched += 1


        records.append({

            "geometry":
                geometry_data(
                    geo
                ),

            "room_ids":
                (
                    [room_id]
                    if room_id
                    else []
                ),

            "room_match_distance":
                (
                    float(distance)
                    if distance is not None
                    else None
                )
        })


    Debug.append(
        "{}: {} | unmatched: {}".format(
            element_name,
            len(records),
            unmatched
        )
    )


    return records


# =========================================================
# BUILD DATA
# =========================================================

if valid:

    window_records = build_records(
        windows,
        "Windows"
    )

    door_records = build_records(
        doors,
        "Doors"
    )

    shade_records = build_records(
        shades,
        "Shades"
    )


    Arch_Data = {

        "floor_id":
            floor_id,

        "windows":
            window_records,

        "doors":
            door_records,

        "shades":
            shade_records
    }


# =========================================================
# SAVE
# =========================================================

if Run and valid:

    dataset_folder = (
        get_dataset_folder()
    )


    if dataset_folder is None:

        Debug.append(
            "ERROR: Grasshopper file "
            "must be saved first."
        )


    else:

        folder = os.path.join(
            dataset_folder,
            "architectural"
        )


        if not os.path.exists(folder):
            os.makedirs(folder)


        File_Path = os.path.join(
            folder,
            "{}_architectural.json".format(
                safe_name(floor_id)
            )
        )


        with open(
            File_Path,
            "w"
        ) as f:

            json.dump(
                Arch_Data,
                f,
                indent=2
            )


        Debug.append(
            "SAVED: {}".format(
                File_Path
            )
        )


elif not Run:

    Debug.append(
        "Ready. Set Run = True to save."
    )
# ---------- end python_3_script_6 ----------
brep = Brep(python_3_script_5.Shade_balcony_R)
brep_2 = Brep(python_3_script_5.Windows_R)
brep_3 = Brep(python_3_script_5.Doors_R)
brep_4 = Brep(brep_2)
windows_r = ClusterOutput(brep_4)  # Surface (should overlap wall) default (SH=1.0, WH=1.2)
windows = ClusterOutput(extrude)  # Surface (should overlap wall) default (SH=1.0, WH=1.2)
shade_balcony = ClusterOutput(cap_holes)  # Default thickness=0.1m
shade_balcony_r = ClusterOutput(brep)  # Default thickness=0.1m
doors = ClusterOutput(extrude_2)  # Surface (should overlap wall) default (DH=2.1)
doors_r = ClusterOutput(brep_3)  # Surface (should overlap wall) default (DH=2.1)

# ==== cluster Cluster_3
text = ClusterInput()
refresh = ClusterInput()
fh = ClusterInput()
rep = ClusterInput()
text_2 = ClusterInput()
text_3 = ClusterInput()
text_4 = Text(text_3)
text_5 = Text(text_2)
boolean = Boolean(refresh)
number = Number(rep)
concatenate = Concatenate(Block=text_5, A="::", Floor=text_4, B="::", Layer_type="Rooms")
python_3_script = Python3Script(layer=concatenate, Refresh=boolean)  # -> geoms, SH, WH, DH, RT, ShH, ShT; inputs layer: String, Refresh: Boolean; same code as python_3_script_2
text_6 = Text(python_3_script.RT)
curve = Curve(python_3_script.geoms)
number_2 = Number(fh)
unit_z = UnitZ(Factor=number_2)
curve_2 = Curve(curve)
extrude = Extrude(Base=curve_2, Direction=unit_z)
text_7 = Text(text)
cap_holes = CapHoles(Brep=extrude)
concatenate_2 = Concatenate(Floor_ID=text_7, B="_")
python_3_script_2 = Python3Script(rooms=curve_2, ID_prefix=concatenate_2)  # -> out, RoomCurves, RoomIDs, Debug; inputs rooms: list of Curve, ID_prefix: String
# ---------- python_3_script_2: Python ----------
import Rhino.Geometry as rg

# ---------------------------------------------------------
# Outputs
# ---------------------------------------------------------

RoomCurves = []
RoomIDs = []
Debug = []


# ---------------------------------------------------------
# Helpers
# ---------------------------------------------------------

def ensure_list(x):

    if x is None:
        return []

    if isinstance(x, str):
        return [x]

    try:
        return list(x)
    except:
        return [x]


def unwrap_curve(g):

    if g is None:
        return None

    if hasattr(g, "Value"):
        try:
            g = g.Value
        except:
            pass

    if isinstance(g, rg.Curve):
        return g

    if isinstance(g, rg.Line):
        return rg.LineCurve(g)

    if isinstance(g, rg.Polyline):
        return rg.PolylineCurve(g)

    return None


# ---------------------------------------------------------
# Prefix
# ---------------------------------------------------------

prefix = ""

if ID_prefix is not None:

    prefix = str(ID_prefix).strip()

    # Avoid double underscore
    prefix = prefix.rstrip("_")


# ---------------------------------------------------------
# Check rooms + generate IDs
# ---------------------------------------------------------

input_rooms = ensure_list(rooms)

for i, item in enumerate(input_rooms):

    crv = unwrap_curve(item)

    if crv is None:

        Debug.append(
            "Room {} could not be converted to a curve.".format(i)
        )

        continue


    # Keep original behaviour:
    # warn about open rooms, but don't remove them.
    if not crv.IsClosed:

        Debug.append(
            "Room {} is not closed.".format(i)
        )


    # -------------------------------------
    # Generate ID
    # -------------------------------------

    if prefix:

        rid = "{}_R{:03d}".format(
            prefix,
            i
        )

    else:

        rid = "R_{:03d}".format(i)


    RoomCurves.append(crv)
    RoomIDs.append(rid)


# ---------------------------------------------------------
# Debug
# ---------------------------------------------------------

Debug.append(
    "Input rooms: {}".format(
        len(input_rooms)
    )
)

Debug.append(
    "Valid room curves: {}".format(
        len(RoomCurves)
    )
)

Debug.append(
    "Room IDs: {}".format(
        len(RoomIDs)
    )
)
# ---------- end python_3_script_2 ----------
area = Area(Geometry=curve_2)  # -> Area, Centroid
text_8 = Text(python_3_script_2.RoomIDs)
text_9 = Text(text_6)
curve_3 = Curve(python_3_script_2.RoomCurves)
point = Point(area.Centroid)
brep = Brep(cap_holes)
python_3_script_3 = Python3Script(FH=number_2, Rep=number, Room_pt=point, room_crv=curve_3, Room_volume=brep)  # -> out, Room_pt_R, Rep_Index, room_crv_R, Room_volume_R, DZ, Debug; inputs Room_pt: list of Point3d, room_crv: list of Curve, Room_volume: list of Brep
# ---------- python_3_script_3: Python ----------
import Rhino.Geometry as rg
from Grasshopper import DataTree
from Grasshopper.Kernel.Data import GH_Path


# =========================================================
# OUTPUTS
# =========================================================

Room_pt_R = DataTree[object]()
room_crv_R = DataTree[object]()
Room_volume_R = DataTree[object]()

Rep_Index = []
DZ = []
Debug = []


# =========================================================
# HELPERS
# =========================================================

def flatten_items(x):

    if x is None:
        return []

    if isinstance(x, str):
        return [x]

    if hasattr(x, "Branches"):

        result = []

        for branch in x.Branches:
            for item in branch:
                result.extend(flatten_items(item))

        return result

    if hasattr(x, "Value"):

        try:
            x = x.Value
        except:
            pass

    if isinstance(
        x,
        (
            rg.GeometryBase,
            rg.Point3d,
            rg.Line,
            rg.Polyline
        )
    ):
        return [x]

    try:

        result = []

        for item in x:
            result.extend(flatten_items(item))

        return result

    except:

        return [x]


def copy_move(g, dz):

    if g is None:
        return None

    if hasattr(g, "Value"):

        try:
            g = g.Value
        except:
            pass

    move = rg.Transform.Translation(
        0,
        0,
        dz
    )

    if isinstance(g, rg.Point3d):

        c = rg.Point3d(g)
        c.Transform(move)

        return c

    if isinstance(g, rg.Line):

        c = rg.Line(
            g.From,
            g.To
        )

        c.Transform(move)

        return c

    if isinstance(g, rg.Polyline):

        c = rg.Polyline(g)
        c.Transform(move)

        return c

    if isinstance(g, rg.GeometryBase):

        try:
            c = g.Duplicate()
        except:
            try:
                c = g.DuplicateGeometry()
            except:
                return None

        c.Transform(move)

        return c

    return None


def repeat_geometry(source, output_tree, rep, fh):

    items = flatten_items(source)

    for i in range(rep):

        path = GH_Path(i)
        dz = i * fh

        output_tree.EnsurePath(path)

        for item in items:

            c = copy_move(
                item,
                dz
            )

            if c is not None:

                output_tree.Add(
                    c,
                    path
                )


# =========================================================
# INPUTS
# =========================================================

try:
    fh = float(FH)
except:
    fh = None

try:
    rep = int(Rep)
except:
    rep = 1

if rep < 1:
    rep = 1


# =========================================================
# RUN
# =========================================================

if fh is None:

    Debug.append(
        "FH is missing or invalid."
    )

else:

    for i in range(rep):

        Rep_Index.append(i)
        DZ.append(i * fh)


    repeat_geometry(
        Room_pt,
        Room_pt_R,
        rep,
        fh
    )

    repeat_geometry(
        room_crv,
        room_crv_R,
        rep,
        fh
    )

    repeat_geometry(
        Room_volume,
        Room_volume_R,
        rep,
        fh
    )


# =========================================================
# DEBUG
# =========================================================

Debug.append(
    "Rep: {}".format(rep)
)

Debug.append(
    "Room points: {}".format(
        Room_pt_R.DataCount
    )
)

Debug.append(
    "Room curves: {}".format(
        room_crv_R.DataCount
    )
)

Debug.append(
    "Room volumes: {}".format(
        Room_volume_R.DataCount
    )
)
# ---------- end python_3_script_3 ----------
run = ClusterInput()
concatenate_3 = Concatenate(Fragment_A=graft(text_8), Fragment_B="_", A=python_3_script_3.Rep_Index)
boolean_2 = Boolean(run)
python_3_script_4 = Python3Script(Run=boolean_2, Floor_ID=text_7, Room_ID=text_8, Room_Type=text_9, Room_pt=point, Room_crv=curve_3)  # -> out, Room_Data, File_Path, Debug; inputs Run: Boolean, Floor_ID: String, Room_ID: list of String, Room_Type: list of String, Room_pt: list of Point3d, Room_crv: list of Curve
# ---------- python_3_script_4: Python ----------
import os
import json


# =========================================================
# OUTPUTS
# =========================================================

Room_Data = None
File_Path = None
Debug = []


# =========================================================
# HELPERS
# =========================================================

def unwrap(x):

    if x is None:
        return None

    try:
        return x.ScriptVariable()
    except:
        pass

    try:
        return x.Value
    except:
        pass

    return x


def xyz(pt):

    pt = unwrap(pt)

    if pt is None:
        return None

    try:
        return [
            float(pt.X),
            float(pt.Y),
            float(pt.Z)
        ]
    except:
        return None


def curve_vertices(crv):

    crv = unwrap(crv)

    if crv is None:
        return []


    # Prefer polyline vertices
    try:

        success, polyline = crv.TryGetPolyline()

        if success:

            pts = [
                xyz(pt)
                for pt in polyline
            ]

            # Remove duplicate closing point
            if (
                len(pts) > 1
                and
                pts[0] == pts[-1]
            ):
                pts.pop()

            return pts

    except:
        pass


    # Fallback
    try:

        nurbs = crv.ToNurbsCurve()

        return [
            xyz(cp.Location)
            for cp in nurbs.Points
        ]

    except:
        return []


def clean_list(data):

    if data is None:
        return []

    result = []

    for item in data:

        value = unwrap(item)

        if value is not None:
            result.append(value)

    return result


def get_dataset_folder():

    doc = ghenv.Component.OnPingDocument()

    if doc is None:
        return None

    gh_path = doc.FilePath

    if not gh_path:
        return None

    root = os.path.dirname(
        gh_path
    )

    dataset_folder = os.path.join(
        root,
        "Dataset_Results"
    )

    if not os.path.exists(
        dataset_folder
    ):
        os.makedirs(
            dataset_folder
        )

    return dataset_folder


def safe_name(text):

    return (
        str(text)
        .replace(" ", "_")
        .replace(":", "_")
        .replace("/", "_")
        .replace("\\", "_")
    )


# =========================================================
# INPUTS
# =========================================================

floor_id = (
    str(Floor_ID).strip()
    if Floor_ID
    else ""
)

room_ids = clean_list(
    Room_ID
)

room_types = clean_list(
    Room_Type
)

room_points = clean_list(
    Room_pt
)

room_curves = clean_list(
    Room_crv
)


# =========================================================
# VALIDATION
# =========================================================

valid = True

room_count = len(room_ids)


if not floor_id:

    Debug.append(
        "ERROR: Floor_ID is missing."
    )

    valid = False


if room_count == 0:

    Debug.append(
        "ERROR: No rooms found."
    )

    valid = False


datasets = {
    "Room_Type": len(room_types),
    "Room_pt": len(room_points),
    "Room_crv": len(room_curves)
}


for name, count in datasets.items():

    if count != room_count:

        Debug.append(
            "ERROR: {} count = {}, "
            "Room_ID count = {}.".format(
                name,
                count,
                room_count
            )
        )

        valid = False


# =========================================================
# BUILD ROOM DATA
# =========================================================

if valid:

    rooms = []


    for i in range(room_count):

        room = {

            "room_id":
                str(room_ids[i]),

            "room_type":
                str(room_types[i]),

            "room_point":
                xyz(room_points[i]),

            "boundary":
                curve_vertices(
                    room_curves[i]
                ),

            # Filled later when the other
            # geometry classes are assembled.
            "wall_ids":
                [],

            "window_ids":
                [],

            "door_ids":
                [],

            "shade_ids":
                []
        }


        rooms.append(room)


    Room_Data = {

        "floor_id":
            floor_id,

        "rooms":
            rooms
    }


    Debug.append(
        "Floor: {}".format(
            floor_id
        )
    )

    Debug.append(
        "Rooms exported: {}".format(
            len(rooms)
        )
    )


# =========================================================
# SAVE
# =========================================================

if Run and valid:

    dataset_folder = get_dataset_folder()


    if dataset_folder is None:

        Debug.append(
            "ERROR: Grasshopper file "
            "must be saved first."
        )


    else:

        room_folder = os.path.join(
            dataset_folder,
            "rooms"
        )


        if not os.path.exists(
            room_folder
        ):
            os.makedirs(
                room_folder
            )


        File_Path = os.path.join(
            room_folder,
            "{}_rooms.json".format(
                safe_name(
                    floor_id
                )
            )
        )


        with open(
            File_Path,
            "w"
        ) as f:

            json.dump(
                Room_Data,
                f,
                indent=2
            )


        Debug.append(
            "SAVED:"
        )

        Debug.append(
            File_Path
        )


elif not Run:

    Debug.append(
        "Ready. Set Run = True to save."
    )
# ---------- end python_3_script_4 ----------
flip_matrix = FlipMatrix(Data=concatenate_3)
room_volume = ClusterOutput(brep)
room_volume_r = ClusterOutput(python_3_script_3.Room_volume_R)
room_id_r = ClusterOutput(flip_matrix)
room_crv = ClusterOutput(curve_3)
room_id = ClusterOutput(text_8)

# ==== cluster Cluster_4
refresh = ClusterInput()
text = ClusterInput()
text_2 = ClusterInput()
fh = ClusterInput()
rep = ClusterInput()
text_3 = Text(text)
text_4 = Text(text_2)
number = Number(rep)
number_2 = Number(fh)
boolean = Boolean(refresh)
concatenate = Concatenate(Block=text_3, A="::", Floor=text_4, B="::", Layer_type="Rooms")
concatenate_2 = Concatenate(Block=text_3, A="::", Floor=text_4, B="::", Walls="Walls", C="::", Layer_type="Separate")
# Global Attributes reader
python_3_script = Python3Script(block=text_3, floor=text_4, Refresh=boolean)  # -> out, FH, IsG, Int, Ext, WMt, Csec, CMt, BMt, Debug; inputs block: String
# ---------- python_3_script: Python ----------
import Rhino

doc = Rhino.RhinoDoc.ActiveDoc


# ---------------------------------------------------------
# Outputs
# ---------------------------------------------------------

SitePoint = None
BlockPoint = None
FloorPoint = None

SiteID = None
SiteName = None

Rep = 1
IsG = False
FH = None

WMt = None
Int = 0.115
Ext = 0.225

CSec = None
CMt = None
BMt = None

DH = 2.1

SH = 1.0
WH = 1.2

ShH = None
ShT = 0.1

Debug = []


# ---------------------------------------------------------
# Helpers
# ---------------------------------------------------------

def find_layer(path):

    target = str(path).strip().lower()

    for lyr in doc.Layers:

        if lyr is None or not lyr.FullPath:
            continue

        if lyr.FullPath.lower() == target:
            return lyr

    return None


def get_point_object(layer):

    if layer is None:
        return None

    objs = doc.Objects.FindByLayer(layer) or []

    points = [
        obj for obj in objs
        if isinstance(
            obj,
            Rhino.DocObjects.PointObject
        )
    ]

    if len(points) > 1:

        Debug.append(
            "Multiple points on {}".format(
                layer.FullPath
            )
        )

    return points[0] if points else None


def normalize_key(key):

    return (
        str(key)
        .strip()
        .lower()
        .replace(" ", "")
        .replace("_", "")
        .replace("-", "")
    )


def read(obj, key):

    if obj is None:
        return None

    strings = obj.Attributes.GetUserStrings()

    if not strings:
        return None

    wanted = normalize_key(key)

    for existing_key in strings.AllKeys:

        if normalize_key(existing_key) == wanted:

            value = strings[existing_key]

            if value is None:
                return None

            value = str(value).strip()

            return value if value else None

    return None


def to_number(value):

    if value is None:
        return None

    try:
        return float(value)
    except:
        return None


def to_integer(value):

    if value is None:
        return None

    try:
        return int(float(value))
    except:
        return None


def to_boolean(value):

    if value is None:
        return None

    text = str(value).strip().lower()

    if text in [
        "true",
        "1",
        "yes"
    ]:
        return True

    if text in [
        "false",
        "0",
        "no"
    ]:
        return False

    return None


def resolve(key, kind="number"):
    """
    Resolve one value:

    Floor
      ↓ missing
    Block
      ↓ missing
    Site
    """

    for level_name, obj in [
        ("Floor", floor_obj),
        ("Block", block_obj),
        ("Site", site_obj)
    ]:

        value = read(
            obj,
            key
        )

        if value is None:
            continue


        if kind == "text":

            return value


        elif kind == "integer":

            result = to_integer(
                value
            )


        elif kind == "boolean":

            result = to_boolean(
                value
            )


        else:

            result = to_number(
                value
            )


        if result is not None:
            return result


        Debug.append(
            "Invalid {} on {}: {}".format(
                key,
                level_name,
                value
            )
        )

    return None


# ---------------------------------------------------------
# Build fixed hierarchy paths
# ---------------------------------------------------------

if block is None or floor is None:

    Debug.append(
        "block or floor input is missing"
    )

else:

    block = str(block).strip()
    floor = str(floor).strip()


    site_info_path = (
        "L0_SITE"
        + "::01_Info"
    )


    block_info_path = (
        "L0_SITE"
        + "::L1_BLOCKS::"
        + block
        + "::01_Info"
    )


    floor_info_path = (
        "L0_SITE"
        + "::L1_BLOCKS::"
        + block
        + "::L2_FLOORS::"
        + floor
        + "::01_Info"
    )


    # -----------------------------------------------------
    # Find Info layers
    # -----------------------------------------------------

    site_layer = find_layer(
        site_info_path
    )

    block_layer = find_layer(
        block_info_path
    )

    floor_layer = find_layer(
        floor_info_path
    )


    # -----------------------------------------------------
    # Find node points
    # -----------------------------------------------------

    site_obj = get_point_object(
        site_layer
    )

    block_obj = get_point_object(
        block_layer
    )

    floor_obj = get_point_object(
        floor_layer
    )


    # -----------------------------------------------------
    # Point outputs
    # -----------------------------------------------------

    if site_obj is not None:
        SitePoint = site_obj.Geometry.Location

    if block_obj is not None:
        BlockPoint = block_obj.Geometry.Location

    if floor_obj is not None:
        FloorPoint = floor_obj.Geometry.Location


    # =====================================================
    # SITE ONLY
    # =====================================================

    SiteID = read(
        site_obj,
        "SiteID"
    )

    SiteName = read(
        site_obj,
        "SiteName"
    )


    # =====================================================
    # FLOOR ONLY
    # =====================================================

    rep_value = to_integer(
        read(
            floor_obj,
            "Rep"
        )
    )

    if rep_value is not None:
        Rep = rep_value


    isg_value = to_boolean(
        read(
            floor_obj,
            "IsG"
        )
    )

    if isg_value is not None:
        IsG = isg_value


    # =====================================================
    # FLOOR -> BLOCK -> SITE
    # =====================================================

    # Floor height
    FH = resolve(
        "FH"
    )


    # -----------------------------------------------------
    # Walls
    # -----------------------------------------------------

    WMt = resolve(
        "WMt",
        "text"
    )

    value = resolve(
        "Int"
    )

    if value is not None:
        Int = value


    value = resolve(
        "Ext"
    )

    if value is not None:
        Ext = value


    # -----------------------------------------------------
    # Columns
    # -----------------------------------------------------

    CSec = resolve(
        "CSec",
        "text"
    )

    CMt = resolve(
        "CMt",
        "text"
    )


    # -----------------------------------------------------
    # Beams
    # -----------------------------------------------------

    BMt = resolve(
        "BMt",
        "text"
    )


    # -----------------------------------------------------
    # Doors
    # -----------------------------------------------------

    value = resolve(
        "DH"
    )

    if value is not None:
        DH = value


    # -----------------------------------------------------
    # Windows
    # -----------------------------------------------------

    value = resolve(
        "SH"
    )

    if value is not None:
        SH = value


    value = resolve(
        "WH"
    )

    if value is not None:
        WH = value


    # -----------------------------------------------------
    # Shades / balconies
    # -----------------------------------------------------

    value = resolve(
        "ShT"
    )

    if value is not None:
        ShT = value


    ShH = resolve(
        "ShH"
    )

    # Default = Floor Height
    if ShH is None:
        ShH = FH


    # -----------------------------------------------------
    # Debug
    # -----------------------------------------------------

    Debug.append(
        "Site Info: {}".format(
            site_info_path
            if site_obj is not None
            else "NOT FOUND"
        )
    )

    Debug.append(
        "Block Info: {}".format(
            block_info_path
            if block_obj is not None
            else "NOT FOUND"
        )
    )

    Debug.append(
        "Floor Info: {}".format(
            floor_info_path
            if floor_obj is not None
            else "NOT FOUND"
        )
    )

    Debug.append(
        "SiteID: {}".format(
            SiteID
        )
    )

    Debug.append(
        "Rep={}, IsG={}, FH={}".format(
            Rep,
            IsG,
            FH
        )
    )
# ---------- end python_3_script ----------
concatenate_3 = Concatenate(Block=text_3, A="::", Floor=text_4, B="::", Layer_type="Beams")
concatenate_4 = Concatenate(Block=text_3, A="::", Floor=text_4, B="::", Layer_type="Columns")
boolean_2 = Boolean(boolean)
number_3 = Number(python_3_script.Int)
number_4 = Number(python_3_script.Ext)

concatenate_5 = Concatenate(Block=text_3, A="::", Floor=text_4, B="::", Walls="Walls", C="::", Layer_type="Thickness")
python_3_script_2 = Python3Script(layer=concatenate_5, Refresh=boolean_2)  # -> out, geoms, Debug; inputs layer: String, Refresh: Boolean
# ---------- python_3_script_2: Python ----------
import Rhino
import Rhino.Geometry as rg

doc = Rhino.RhinoDoc.ActiveDoc

# ---------------------------------------------------------
# Outputs
# ---------------------------------------------------------

geoms = []
WallThickness = []
SeparateWalls = []
Debug = []


# ---------------------------------------------------------
# Find layer
# ---------------------------------------------------------

def find_layer_ci(path):

    target = str(path).strip().lower()

    for lyr in doc.Layers:

        if lyr is None or not lyr.FullPath:
            continue

        if lyr.FullPath.lower() == target:
            return lyr

    return None


# ---------------------------------------------------------
# Read curves
# ---------------------------------------------------------

def get_curves(lyr):

    curves = []

    if lyr is None:
        return curves

    objs = doc.Objects.FindByLayer(lyr) or []

    for obj in objs:

        geo = obj.Geometry

        if isinstance(geo, rg.Curve):
            curves.append(geo)

    return curves


# ---------------------------------------------------------
# Run
# ---------------------------------------------------------

if layer is None:

    Debug.append("Layer input is missing")

else:

    path = str(layer).strip()

    parts = path.split("::")

    # Expected relative input:
    #
    # BLOCK_01::GF::Walls::Thickness
    # BLOCK_01::GF::Walls::Separate

    if len(parts) < 4:

        Debug.append(
            "Expected: BLOCK::FLOOR::Walls::Thickness/Separate"
        )

    else:

        block = parts[0]
        floor = parts[1]
        wall_type = parts[-1]

        full_path = (
            "L0_SITE"
            + "::L1_BLOCKS::"
            + block
            + "::L2_FLOORS::"
            + floor
            + "::02_Geometries::Walls::"
            + wall_type
        )

        lyr = find_layer_ci(
            full_path
        )

        if lyr is None:

            Debug.append(
                "Layer not found: {}".format(
                    full_path
                )
            )

        else:

            curves = get_curves(
                lyr
            )

            name = lyr.Name.strip().lower()

            # ---------------------------------------------
            # Thickness
            # ---------------------------------------------

            if name == "thickness":

                WallThickness = curves
                geoms = curves


            # ---------------------------------------------
            # Separate
            # ---------------------------------------------

            elif name == "separate":

                SeparateWalls = curves
                geoms = curves


            else:

                Debug.append(
                    "Expected Thickness or Separate"
                )

            Debug.append(
                "Found: {}".format(
                    lyr.FullPath
                )
            )


# ---------------------------------------------------------
# Debug
# ---------------------------------------------------------

Debug.append(
    "Thickness: {}".format(
        len(WallThickness)
    )
)

Debug.append(
    "Separate: {}".format(
        len(SeparateWalls)
    )
)

Debug.append(
    "Total geoms: {}".format(
        len(geoms)
    )
)
# ---------- end python_3_script_2 ----------
curve = Curve(python_3_script_2.geoms)
length = Length(Curve=curve)
sort_duplicate_values = SortDuplicateValues(ValueList=length)  # -> UniqueValues, Indices
number_5 = Number(sort_duplicate_values.UniqueValues)
sort_list = SortList(Keys=number_5)  # -> Keys, ValuesValuesA
list_length = ListLength(List=number_5)
subtraction = Subtraction(A=list_length, B=1)
list_item = ListItem(List=sort_list.Keys, Index=0, Wrap=True)
list_item_2 = ListItem(List=sort_list.Keys, Index=subtraction, Wrap=True)
number_6 = Number(list_item)
number_7 = Number(number_3)
number_8 = Number(number_4)
number_9 = Number(list_item_2)
replace_nulls = ReplaceNulls(Items=number_6, Replacements=number_7)  # -> Items, Count
replace_nulls_2 = ReplaceNulls(Items=number_9, Replacements=number_8)  # -> Items, Count
number_10 = Number(replace_nulls.Items)
number_11 = Number(replace_nulls_2.Items)

text_5 = Text(python_3_script.WMt)
text_6 = Text(python_3_script.BMt)
number_12 = Number(python_3_script.FH)
boolean_3 = Boolean(python_3_script.IsG)
text_7 = Text(python_3_script.Csec)
text_8 = Text(python_3_script.CMt)
python_3_script_3 = Python3Script(layer=concatenate_3, Refresh=boolean_2)  # -> out, geoms, SH, WH, DH, RT, ShH, ShT; inputs layer: String, Refresh: Boolean; same code as python_3_script_2
python_3_script_4 = Python3Script(layer=concatenate, Refresh=boolean_2)  # -> out, geoms, SH, WH, DH, RT, ShH, ShT; inputs layer: String, Refresh: Boolean; same code as python_3_script_2
python_3_script_5 = Python3Script(layer=concatenate_2, Refresh=boolean_2)  # -> out, geoms, Debug; inputs layer: String, Refresh: Boolean; same code as python_3_script_2
python_3_script_6 = Python3Script(layer=concatenate_4, Refresh=boolean_2)  # -> out, Columns, Debug; inputs layer: String, Refresh: Boolean
# ---------- python_3_script_6: Python ----------
import Rhino
import Rhino.Geometry as rg

doc = Rhino.RhinoDoc.ActiveDoc

# ---------------------------------------------------------
# Outputs
# ---------------------------------------------------------

Columns = []
Debug = []


# ---------------------------------------------------------
# Build new layer path
#
# Input example:
# BLOCK_01::GF::Columns
# ---------------------------------------------------------

if layer is None:

    Debug.append("Layer input is missing")

else:

    path = str(layer).strip()
    parts = path.split("::")

    if len(parts) < 2:

        Debug.append(
            "Expected at least: BLOCK::FLOOR"
        )

    else:

        block = parts[0]
        floor = parts[1]

        column_path = (
            "L0_SITE"
            + "::L1_BLOCKS::"
            + block
            + "::L2_FLOORS::"
            + floor
            + "::02_Geometries::Columns"
        )


        # -------------------------------------------------
        # Find layer ignoring capitalization
        # -------------------------------------------------

        column_layer = None

        for lyr in doc.Layers:

            if lyr is None or not lyr.FullPath:
                continue

            if lyr.FullPath.lower() == column_path.lower():

                column_layer = lyr
                break


        if column_layer is None:

            Debug.append(
                "Layer not found: {}".format(
                    column_path
                )
            )

        else:

            # ---------------------------------------------
            # Read objects regardless of visibility
            # ---------------------------------------------

            settings = Rhino.DocObjects.ObjectEnumeratorSettings()

            settings.NormalObjects = True
            settings.HiddenObjects = True
            settings.LockedObjects = True
            settings.ReferenceObjects = True

            all_objects = doc.Objects.GetObjectList(
                settings
            )

            objs = [
                obj for obj in all_objects
                if obj.Attributes.LayerIndex
                == column_layer.Index
            ]

            Debug.append(
                "Column objects found: {}".format(
                    len(objs)
                )
            )


            # ---------------------------------------------
            # Extract column points
            # ---------------------------------------------

            for obj in objs:

                geo = obj.Geometry


                # Existing point
                if isinstance(
                    geo,
                    rg.Point
                ):

                    Columns.append(
                        geo.Location
                    )


                # Curve / vertical line
                # use start point
                elif isinstance(
                    geo,
                    rg.Curve
                ):

                    Columns.append(
                        geo.PointAtStart
                    )


                # Brep
                elif isinstance(
                    geo,
                    rg.Brep
                ):

                    props = (
                        rg.VolumeMassProperties.Compute(
                            geo
                        )
                    )

                    if props:

                        Columns.append(
                            props.Centroid
                        )

                    else:

                        Columns.append(
                            geo.GetBoundingBox(
                                True
                            ).Center
                        )


            Debug.append(
                "Columns output: {}".format(
                    len(Columns)
                )
            )
# ---------- end python_3_script_6 ----------
curve_2 = Curve(python_3_script_3.geoms)
number_13 = Number(number_12)
text_9 = Text(python_3_script_4.RT)
curve_3 = Curve(python_3_script_4.geoms)
unit_z = UnitZ(Factor=number_13)
curve_4 = Curve(python_3_script_5.geoms)
move = Move(Geometry=curve_2, Motion=unit_z)  # -> Geometry, Transform
point = Point(python_3_script_6.Columns)
unit_z_2 = UnitZ(Factor=number_12)
move_2 = Move(Geometry=point, Motion=unit_z_2)  # -> Geometry, Transform
line = Line(StartPoint=point, EndPoint=move_2.Geometry)
extrude = Extrude(Base=curve_4, Direction=unit_z_2)
match_text = MatchText(Text="Core", Pattern=text_9, Case=True)
curve_5 = Curve(line)
curve_6 = Curve(curve_3)
dispatch = Dispatch(List=curve_6, DispatchPattern=match_text)  # -> ListA, ListB
curve_7 = Curve(dispatch.ListB)
region_union = RegionUnion(Curves=curve_7)
boundary_surfaces = BoundarySurfaces(Edges=region_union)
unit_z_3 = UnitZ(Factor=number_12)
geometry = Geometry(extrude)
geometry_2 = Geometry(move.Geometry)
point_2 = Point(point)
geometry_3 = Geometry(curve_5)
room_ids = ClusterInput()
dispatch_2 = Dispatch(GF_Slab=boundary_surfaces, DispatchPattern=boolean_3)  # -> ListA, ListB
move_3 = Move(Geometry=boundary_surfaces, Motion=unit_z_3)  # -> Geometry, Transform
curve_8 = Curve(curve_4)

# ----
# Walls_unique_centrelines
# Wall thicknesses
number_slider = Slider(0.225, range=0..1)
curve_9 = Curve(curve)
replace_nulls_3 = ReplaceNulls(Items=number_10, Replacements=Slider(0.115, range=0..1))  # -> Items, Count
replace_nulls_4 = ReplaceNulls(Items=number_11, Replacements=number_slider)  # -> Items, Count
curve_10 = Curve(curve_9)
curve_11 = Curve(curve_3)
python_3_script_7 = Python3Script(
    rooms=curve_11,
    room_ids=room_ids,
    separate_walls=curve_8,
    wall_T_lines=curve_10,
    IntT=replace_nulls_3.Items,
    ExtT=replace_nulls_4.Items)  # -> out, walls, wall_id, wall_type, thickness, T_source, room_a, room_b, room_ids, Debug; inputs rooms: list of Curve, room_ids: list of String, separate_walls: list, wall_T_lines: list of Curve
# ---------- python_3_script_7: Python ----------
import Rhino
import Rhino.Geometry as rg

doc = Rhino.RhinoDoc.ActiveDoc


# =========================================================
# OUTPUTS
# =========================================================

walls = []
wall_id = []
wall_type = []

thickness = []
T_source = []

room_a = []
room_b = []

Debug = []


# =========================================================
# HELPERS
# =========================================================

def flatten_input(x):
    """
    Flatten GH trees / nested lists into one list,
    while keeping geometry and strings as individual items.
    """

    if x is None:
        return []

    if isinstance(x, str):
        return [x]

    if isinstance(
        x,
        (
            rg.Curve,
            rg.Line,
            rg.Polyline,
            rg.Brep,
            rg.Point
        )
    ):
        return [x]

    # GH wrapper
    if hasattr(x, "Value"):
        return [x]

    # Grasshopper DataTree
    if hasattr(x, "Branches"):

        result = []

        for branch in x.Branches:

            for item in branch:

                result.extend(
                    flatten_input(item)
                )

        return result

    # Python list / tuple / iterable
    try:

        result = []

        for item in x:

            result.extend(
                flatten_input(item)
            )

        return result

    except:

        return [x]


def unwrap_curve(g):

    if g is None:
        return None

    if hasattr(g, "Value"):
        try:
            g = g.Value
        except:
            pass

    if isinstance(g, rg.Curve):
        return g

    if isinstance(g, rg.Line):
        return rg.LineCurve(g)

    if isinstance(g, rg.Polyline):
        return rg.PolylineCurve(g)

    return None


def interpolate_point(a, b, t):

    return rg.Point3d(
        a.X + (b.X - a.X) * t,
        a.Y + (b.Y - a.Y) * t,
        a.Z + (b.Z - a.Z) * t
    )


def point_on_segment_parameter(
    p,
    a,
    b,
    tolerance
):

    dx = b.X - a.X
    dy = b.Y - a.Y
    dz = b.Z - a.Z

    length_sq = (
        dx * dx +
        dy * dy +
        dz * dz
    )

    if length_sq <= 0:
        return None, None

    px = p.X - a.X
    py = p.Y - a.Y
    pz = p.Z - a.Z

    t = (
        px * dx +
        py * dy +
        pz * dz
    ) / length_sq

    length = length_sq ** 0.5

    t_tol = (
        tolerance /
        max(length, tolerance)
    )

    if (
        t < -t_tol
        or t > 1.0 + t_tol
    ):
        return None, None

    t = max(
        0.0,
        min(1.0, t)
    )

    closest = interpolate_point(
        a,
        b,
        t
    )

    distance = p.DistanceTo(
        closest
    )

    return t, distance


def point_key(pt):

    return (
        int(round(
            pt.X / tolerance
        )),
        int(round(
            pt.Y / tolerance
        )),
        int(round(
            pt.Z / tolerance
        ))
    )


def same_segment(
    curve_a,
    curve_b,
    tolerance
):

    a0 = curve_a.PointAtStart
    a1 = curve_a.PointAtEnd

    b0 = curve_b.PointAtStart
    b1 = curve_b.PointAtEnd


    same_direction = (
        a0.DistanceTo(b0) <= tolerance
        and
        a1.DistanceTo(b1) <= tolerance
    )

    reverse_direction = (
        a0.DistanceTo(b1) <= tolerance
        and
        a1.DistanceTo(b0) <= tolerance
    )

    return (
        same_direction
        or reverse_direction
    )


def average_points(points):

    n = float(
        len(points)
    )

    return rg.Point3d(
        sum(p.X for p in points) / n,
        sum(p.Y for p in points) / n,
        sum(p.Z for p in points) / n
    )


def curves_intersect(
    curve_a,
    curve_b
):

    try:

        events = (
            Rhino.Geometry.Intersect
            .Intersection
            .CurveCurve(
                curve_a,
                curve_b,
                tolerance,
                tolerance
            )
        )

        return (
            events is not None
            and events.Count > 0
        )

    except:

        return False


def curve_midpoint(crv):

    domain = crv.Domain

    t = (
        domain.T0 +
        domain.T1
    ) * 0.5

    return crv.PointAt(t)


def perpendicular_score(
    curve_a,
    curve_b
):
    """
    0 = perpendicular
    1 = parallel
    """

    a0 = curve_a.PointAtStart
    a1 = curve_a.PointAtEnd

    b0 = curve_b.PointAtStart
    b1 = curve_b.PointAtEnd


    ax = a1.X - a0.X
    ay = a1.Y - a0.Y
    az = a1.Z - a0.Z

    bx = b1.X - b0.X
    by = b1.Y - b0.Y
    bz = b1.Z - b0.Z


    length_a = (
        ax * ax +
        ay * ay +
        az * az
    ) ** 0.5

    length_b = (
        bx * bx +
        by * by +
        bz * bz
    ) ** 0.5


    if (
        length_a == 0
        or length_b == 0
    ):
        return 1.0


    dot = abs(
        ax * bx +
        ay * by +
        az * bz
    )


    return (
        dot /
        (length_a * length_b)
    )


# =========================================================
# INPUT PREPARATION
# =========================================================

room_curves = flatten_input(
    rooms
)

IDs = flatten_input(
    room_ids
)

separate_inputs = flatten_input(
    separate_walls
)

thickness_inputs = flatten_input(
    wall_T_lines
)


# ---------------------------------------------------------
# Tolerance
# ---------------------------------------------------------

try:
    tolerance = float(tol)
except:
    tolerance = 0.0


if tolerance <= 0:

    tolerance = (
        doc.ModelAbsoluteTolerance
    )


# ---------------------------------------------------------
# Check room / ID alignment
# ---------------------------------------------------------

if len(room_curves) != len(IDs):

    Debug.append(
        "WARNING: {} rooms but {} room IDs.".format(
            len(room_curves),
            len(IDs)
        )
    )


# =========================================================
# 1. RAW ROOM EDGES
# =========================================================

raw_edges = []


for room_index, item in enumerate(
    room_curves
):

    crv = unwrap_curve(
        item
    )

    if crv is None:

        Debug.append(
            "Room {} is not a valid curve.".format(
                room_index
            )
        )

        continue


    if room_index < len(IDs):

        rid = str(
            IDs[room_index]
        )

    else:

        rid = "UNSET_R{:03d}".format(
            room_index
        )


    if not crv.IsClosed:

        Debug.append(
            "{} is not closed.".format(
                rid
            )
        )


    segments = crv.DuplicateSegments()


    if not segments:

        Debug.append(
            "{} has no usable segments.".format(
                rid
            )
        )

        continue


    for edge_index, segment in enumerate(
        segments
    ):

        if not segment.IsLinear(
            tolerance
        ):

            Debug.append(
                "{} edge {} is non-linear and was skipped.".format(
                    rid,
                    edge_index
                )
            )

            continue


        p0 = segment.PointAtStart
        p1 = segment.PointAtEnd


        if (
            p0.DistanceTo(p1)
            <= tolerance
        ):
            continue


        raw_edges.append(
            {
                "room_id": rid,

                "room_index":
                    room_index,

                "edge_index":
                    edge_index,

                "p0": p0,
                "p1": p1
            }
        )


# =========================================================
# 2. COLLECT ROOM VERTICES
# =========================================================

room_vertices = []


for edge in raw_edges:

    room_vertices.append(
        edge["p0"]
    )

    room_vertices.append(
        edge["p1"]
    )


# =========================================================
# 3. DISCRETIZE ROOM EDGES
# =========================================================

atomic_edges = []


for edge in raw_edges:

    a = edge["p0"]
    b = edge["p1"]

    edge_length = (
        a.DistanceTo(b)
    )

    parameters = [
        0.0,
        1.0
    ]


    # -------------------------------------
    # Find all room vertices lying on edge
    # -------------------------------------

    for vertex in room_vertices:

        t, dist = (
            point_on_segment_parameter(
                vertex,
                a,
                b,
                tolerance
            )
        )

        if t is None:
            continue

        if dist <= tolerance:

            parameters.append(t)


    parameters.sort()


    # -------------------------------------
    # Remove duplicate split positions
    # -------------------------------------

    clean_parameters = []


    for t in parameters:

        if not clean_parameters:

            clean_parameters.append(t)

        else:

            previous = (
                clean_parameters[-1]
            )

            distance = (
                abs(t - previous)
                * edge_length
            )

            if distance > tolerance:

                clean_parameters.append(t)


    # -------------------------------------
    # Create atomic segments
    # -------------------------------------

    for i in range(
        len(clean_parameters) - 1
    ):

        ta = clean_parameters[i]
        tb = clean_parameters[i + 1]

        p0 = interpolate_point(
            a,
            b,
            ta
        )

        p1 = interpolate_point(
            a,
            b,
            tb
        )


        if (
            p0.DistanceTo(p1)
            <= tolerance
        ):
            continue


        atomic_edges.append(
            {
                "room_id":
                    edge["room_id"],

                "room_index":
                    edge["room_index"],

                "source_edge":
                    edge["edge_index"],

                "p0": p0,
                "p1": p1
            }
        )


# =========================================================
# 4. GROUP ROOM-BOUNDARY DUPLICATES
# =========================================================

groups = {}


for edge in atomic_edges:

    p0 = edge["p0"]
    p1 = edge["p1"]

    k0 = point_key(p0)
    k1 = point_key(p1)


    if k0 <= k1:

        key = (
            k0,
            k1
        )

        start = p0
        end = p1

    else:

        key = (
            k1,
            k0
        )

        start = p1
        end = p0


    occurrence = {
        "room_id":
            edge["room_id"],

        "room_index":
            edge["room_index"],

        "start": start,
        "end": end
    }


    if key not in groups:

        groups[key] = []


    groups[key].append(
        occurrence
    )


# =========================================================
# 5. CREATE NORMALIZED ROOM WALLS
# =========================================================

normalized = []


for key in sorted(
    groups.keys()
):

    occurrences = groups[key]


    start = average_points(
        [
            o["start"]
            for o in occurrences
        ]
    )

    end = average_points(
        [
            o["end"]
            for o in occurrences
        ]
    )


    physical_wall = (
        rg.Line(
            start,
            end
        ).ToNurbsCurve()
    )


    # -------------------------------------
    # Unique rooms touching this wall
    # -------------------------------------

    touching_rooms = []


    for occurrence in occurrences:

        rid = occurrence[
            "room_id"
        ]

        if rid not in touching_rooms:

            touching_rooms.append(
                rid
            )


    # -------------------------------------
    # Classification
    # -------------------------------------

    if len(touching_rooms) == 1:

        w_type = "Exterior"

        ra = touching_rooms[0]
        rb = None


    elif len(touching_rooms) == 2:

        w_type = "Interior"

        ra = touching_rooms[0]
        rb = touching_rooms[1]


    else:

        w_type = "NonManifold"

        ra = (
            touching_rooms[0]
            if touching_rooms
            else None
        )

        rb = (
            touching_rooms[1]
            if len(touching_rooms) > 1
            else None
        )


    normalized.append(
        {
            "curve":
                physical_wall,

            "type":
                w_type,

            "room_a":
                ra,

            "room_b":
                rb,

            "touching_rooms":
                touching_rooms
        }
    )


room_normalized_count = len(
    normalized
)


# =========================================================
# 6. READ SEPARATE WALLS
# =========================================================

separate_raw = []


for item in separate_inputs:

    crv = unwrap_curve(
        item
    )

    if crv is None:

        Debug.append(
            "Separate wall could not be converted to curve."
        )

        continue


    segments = crv.DuplicateSegments()


    if not segments:

        segments = [crv]


    for segment in segments:

        if not segment.IsLinear(
            tolerance
        ):

            Debug.append(
                "Separate wall is non-linear and was skipped."
            )

            continue


        p0 = segment.PointAtStart
        p1 = segment.PointAtEnd


        if (
            p0.DistanceTo(p1)
            <= tolerance
        ):
            continue


        separate_raw.append(
            {
                "p0": p0,
                "p1": p1
            }
        )


# =========================================================
# 7. DISCRETIZE SEPARATE WALLS
#
# Split them at:
# - room wall vertices
# - other separate wall endpoints
# =========================================================

split_vertices = []


# Room atomic endpoints
for edge in atomic_edges:

    split_vertices.append(
        edge["p0"]
    )

    split_vertices.append(
        edge["p1"]
    )


# Separate endpoints
for edge in separate_raw:

    split_vertices.append(
        edge["p0"]
    )

    split_vertices.append(
        edge["p1"]
    )


separate_atomic = []


for edge in separate_raw:

    a = edge["p0"]
    b = edge["p1"]

    edge_length = (
        a.DistanceTo(b)
    )

    parameters = [
        0.0,
        1.0
    ]


    for vertex in split_vertices:

        t, dist = (
            point_on_segment_parameter(
                vertex,
                a,
                b,
                tolerance
            )
        )

        if t is None:
            continue

        if dist <= tolerance:

            parameters.append(t)


    parameters.sort()


    clean_parameters = []


    for t in parameters:

        if not clean_parameters:

            clean_parameters.append(t)

        else:

            previous = (
                clean_parameters[-1]
            )

            distance = (
                abs(t - previous)
                * edge_length
            )

            if distance > tolerance:

                clean_parameters.append(t)


    for i in range(
        len(clean_parameters) - 1
    ):

        ta = clean_parameters[i]
        tb = clean_parameters[i + 1]


        p0 = interpolate_point(
            a,
            b,
            ta
        )

        p1 = interpolate_point(
            a,
            b,
            tb
        )


        if (
            p0.DistanceTo(p1)
            <= tolerance
        ):
            continue


        crv = (
            rg.Line(
                p0,
                p1
            ).ToNurbsCurve()
        )


        separate_atomic.append(
            crv
        )


        normalized.append(
            {
                "curve":
                    crv,

                "type":
                    "Separate",

                "room_a":
                    None,

                "room_b":
                    None,

                "touching_rooms":
                    []
            }
        )


# =========================================================
# 8. FINAL GEOMETRIC DEDUPLICATION
#
# This catches duplicates that escaped the rounded-key
# grouping because their endpoints landed in adjacent
# tolerance bins.
# =========================================================

before_final_dedup = len(
    normalized
)

final_normalized = []

duplicates_removed = 0


for wall in normalized:

    duplicate = None


    for existing in final_normalized:

        if same_segment(
            wall["curve"],
            existing["curve"],
            tolerance
        ):

            duplicate = existing
            break


    # -------------------------------------
    # Unique wall
    # -------------------------------------

    if duplicate is None:

        final_normalized.append(
            wall
        )

        continue


    # -------------------------------------
    # Duplicate wall
    # -------------------------------------

    duplicates_removed += 1


    # Merge room relationships
    merged_rooms = []


    for source in [
        duplicate,
        wall
    ]:

        for rid in source.get(
            "touching_rooms",
            []
        ):

            if (
                rid is not None
                and rid not in merged_rooms
            ):

                merged_rooms.append(
                    rid
                )


        for rid in [
            source.get("room_a"),
            source.get("room_b")
        ]:

            if (
                rid is not None
                and rid not in merged_rooms
            ):

                merged_rooms.append(
                    rid
                )


    # -------------------------------------
    # Reclassify merged physical wall
    # -------------------------------------

    if len(merged_rooms) == 0:

        duplicate["type"] = (
            "Separate"
        )

        duplicate["room_a"] = None
        duplicate["room_b"] = None


    elif len(merged_rooms) == 1:

        duplicate["type"] = (
            "Exterior"
        )

        duplicate["room_a"] = (
            merged_rooms[0]
        )

        duplicate["room_b"] = None


    elif len(merged_rooms) == 2:

        duplicate["type"] = (
            "Interior"
        )

        duplicate["room_a"] = (
            merged_rooms[0]
        )

        duplicate["room_b"] = (
            merged_rooms[1]
        )


    else:

        duplicate["type"] = (
            "NonManifold"
        )

        duplicate["room_a"] = (
            merged_rooms[0]
        )

        duplicate["room_b"] = (
            merged_rooms[1]
        )


    duplicate[
        "touching_rooms"
    ] = merged_rooms


normalized = final_normalized


# =========================================================
# 9. ASSIGN FINAL WALL IDs
# =========================================================

for i, wall in enumerate(
    normalized
):

    wall["id"] = (
        "W_{:04d}".format(i)
    )


# =========================================================
# 10. PREPARE THICKNESS LINES
# =========================================================

T_curves = []


for item in thickness_inputs:

    crv = unwrap_curve(
        item
    )

    if crv is not None:

        T_curves.append(
            crv
        )


# =========================================================
# 11. ASSIGN THICKNESS
# =========================================================

chosen_T_lines = []


for wall in normalized:

    wcurve = wall["curve"]

    candidates = []


    # -------------------------------------
    # Find intersecting thickness lines
    # -------------------------------------

    for T_index, T_curve in enumerate(
        T_curves
    ):

        if not curves_intersect(
            wcurve,
            T_curve
        ):
            continue


        angle_score = (
            perpendicular_score(
                wcurve,
                T_curve
            )
        )


        mid_distance = (
            curve_midpoint(
                wcurve
            ).DistanceTo(
                curve_midpoint(
                    T_curve
                )
            )
        )


        candidates.append(
            (
                angle_score,
                mid_distance,
                T_index,
                T_curve
            )
        )


    # -------------------------------------
    # Drawn thickness
    # -------------------------------------

    if candidates:

        candidates.sort(
            key=lambda x: (
                x[0],
                x[1]
            )
        )

        best = candidates[0]

        selected_index = best[2]
        selected_curve = best[3]


        wall_thickness = (
            selected_curve.GetLength()
        )

        source = "drawn"


        chosen_T_lines.append(
            (
                selected_index,
                wall["id"]
            )
        )


    # -------------------------------------
    # Default thickness
    # -------------------------------------

    else:

        if wall["type"] == "Exterior":

            try:

                wall_thickness = float(
                    ExtT
                )

            except:

                wall_thickness = None


            source = (
                "default_exterior"
            )


        else:

            try:

                wall_thickness = float(
                    IntT
                )

            except:

                wall_thickness = None


            source = (
                "default_interior"
            )


    # -------------------------------------
    # Outputs
    # -------------------------------------

    walls.append(
        wall["curve"]
    )

    wall_id.append(
        wall["id"]
    )

    wall_type.append(
        wall["type"]
    )

    thickness.append(
        wall_thickness
    )

    T_source.append(
        source
    )

    room_a.append(
        wall["room_a"]
    )

    room_b.append(
        wall["room_b"]
    )


# =========================================================
# 12. CHECK THICKNESS-LINE REUSE
# =========================================================

T_usage = {}


for T_index, wid in chosen_T_lines:

    if T_index not in T_usage:

        T_usage[T_index] = []


    T_usage[T_index].append(
        wid
    )


for T_index, wall_ids in (
    T_usage.items()
):

    if len(wall_ids) > 1:

        Debug.append(
            "Thickness line {} matched multiple walls: {}".format(
                T_index,
                wall_ids
            )
        )


# =========================================================
# DEBUG SUMMARY
# =========================================================

Debug.append(
    "Input rooms: {}".format(
        len(room_curves)
    )
)

Debug.append(
    "Room IDs: {}".format(
        len(IDs)
    )
)

Debug.append(
    "Raw room edges: {}".format(
        len(raw_edges)
    )
)

Debug.append(
    "Atomic room edges: {}".format(
        len(atomic_edges)
    )
)

Debug.append(
    "Normalized room walls before final check: {}".format(
        room_normalized_count
    )
)

Debug.append(
    "Separate wall inputs: {}".format(
        len(separate_inputs)
    )
)

Debug.append(
    "Separate raw segments: {}".format(
        len(separate_raw)
    )
)

Debug.append(
    "Separate atomic segments: {}".format(
        len(separate_atomic)
    )
)

Debug.append(
    "Walls before final geometric deduplication: {}".format(
        before_final_dedup
    )
)

Debug.append(
    "Final geometric duplicates removed: {}".format(
        duplicates_removed
    )
)

Debug.append(
    "Final unique walls: {}".format(
        len(walls)
    )
)

Debug.append(
    "Thickness lines: {}".format(
        len(T_curves)
    )
)
# ---------- end python_3_script_7 ----------
number_14 = Number(python_3_script_7.thickness)
curve_12 = Curve(python_3_script_7.walls)

geometry_4 = Geometry(dispatch_2.ListA)
geometry_5 = Geometry(move_3.Geometry)
run = ClusterInput()
floor_id = ClusterInput()
python_3_script_8 = Python3Script(
    FH=number_2,
    Rep=number,
    GF_Slab=geometry_4,
    Slab=geometry_5,
    Wall_unique=curve_12,
    Wall_thickness=number_14,
    Separate_wall_extr=geometry)  # -> out, Wall_unique_R, Separate_wall_extr_R, Wall_thickness_R, Slab_R, Rep_Index, DZ, Debug; inputs FH: Int32, Rep: Int32, GF_Slab: tree of GeometryBase, Slab: tree of GeometryBase, Wall_unique: tree of Curve, Wall_thickness: tree, Separate_wall_extr: tree of Double
# ---------- python_3_script_8: Python ----------
import Rhino.Geometry as rg
from Grasshopper import DataTree
from Grasshopper.Kernel.Data import GH_Path


# =========================================================
# OUTPUTS
# =========================================================

Slab_R = DataTree[object]()

Wall_unique_R = DataTree[object]()
Separate_wall_extr_R = DataTree[object]()
Wall_thickness_R = DataTree[object]()


Rep_Index = []
DZ = []
Debug = []


# =========================================================
# HELPERS
# =========================================================

def flatten_items(x):
    """
    Flatten lists / trees but preserve the actual
    Rhino geometry objects.
    """

    if x is None:
        return []

    # Grasshopper DataTree
    if hasattr(x, "Branches"):

        result = []

        for branch in x.Branches:
            for item in branch:
                result.extend(
                    flatten_items(item)
                )

        return result


    # GH wrapper
    if hasattr(x, "Value"):

        try:
            value = x.Value

            if value is not None:
                return [value]

        except:
            pass


    # Rhino geometry
    if isinstance(
        x,
        (
            rg.GeometryBase,
            rg.Point3d,
            rg.Line,
            rg.Polyline
        )
    ):
        return [x]


    # Normal list / tuple
    try:

        result = []

        for item in x:
            result.extend(
                flatten_items(item)
            )

        return result

    except:

        return [x]


def copy_geometry(g):
    """
    Duplicate geometry without rebuilding it.
    Preserves the incoming Rhino geometry type/topology.
    """

    if g is None:
        return None

    # GH wrapper
    if hasattr(g, "Value"):
        try:
            g = g.Value
        except:
            pass


    # -----------------------------------------------------
    # Point3d
    # -----------------------------------------------------

    if isinstance(g, rg.Point3d):

        return rg.Point3d(g)


    # -----------------------------------------------------
    # Line
    # -----------------------------------------------------

    if isinstance(g, rg.Line):

        return rg.Line(
            g.From,
            g.To
        )


    # -----------------------------------------------------
    # Polyline
    # -----------------------------------------------------

    if isinstance(g, rg.Polyline):

        return rg.Polyline(g)


    # -----------------------------------------------------
    # BrepFace
    #
    # Preserve trimming if the input happens to be a face.
    # -----------------------------------------------------

    if isinstance(g, rg.BrepFace):

        try:
            return g.DuplicateFace(True)
        except:
            return None


    # -----------------------------------------------------
    # Brep
    # -----------------------------------------------------

    if isinstance(g, rg.Brep):

        try:
            return g.DuplicateBrep()
        except:
            return None


    # -----------------------------------------------------
    # Curve
    # -----------------------------------------------------

    if isinstance(g, rg.Curve):

        try:
            return g.DuplicateCurve()
        except:
            return None


    # -----------------------------------------------------
    # Everything else derived from GeometryBase:
    #
    # PlaneSurface
    # NurbsSurface
    # Mesh
    # Extrusion
    # Point
    # etc.
    #
    # Do NOT rebuild it.
    # -----------------------------------------------------

    if isinstance(g, rg.GeometryBase):

        try:
            return g.Duplicate()
        except:
            return None


    return None

def copy_move(g, dz):

    c = copy_geometry(g)

    if c is None:
        return None

    move = rg.Transform.Translation(
        0,
        0,
        dz
    )

    c.Transform(move)

    return c


def repeat_geometry(
    source,
    output_tree,
    rep,
    fh
):

    items = flatten_items(
        source
    )

    for i in range(rep):

        path = GH_Path(i)
        dz = i * fh

        output_tree.EnsurePath(
            path
        )

        for item in items:

            c = copy_move(
                item,
                dz
            )

            if c is not None:

                output_tree.Add(
                    c,
                    path
                )

def repeat_data(
    source,
    output_tree,
    rep
):

    items = flatten_items(
        source
    )

    for i in range(rep):

        path = GH_Path(i)

        output_tree.EnsurePath(
            path
        )

        for item in items:

            output_tree.Add(
                item,
                path
            )
# =========================================================
# INPUTS
# =========================================================

try:
    fh = float(FH)
except:
    fh = None


try:
    rep = int(Rep)
except:
    rep = 1


if rep < 1:
    rep = 1


# =========================================================
# RUN
# =========================================================

if fh is None:

    Debug.append(
        "FH is missing or invalid."
    )

else:

    # -----------------------------------------------------
    # Repetition information
    # -----------------------------------------------------

    for i in range(rep):

        Rep_Index.append(i)
        DZ.append(i * fh)


    # =====================================================
    # NORMAL SLABS
    #
    # Repeated Rep times:
    #
    # {0} original position
    # {1} + FH
    # {2} + 2FH
    # ...
    # =====================================================

    repeat_geometry(
        Slab,
        Slab_R,
        rep,
        fh
    )


    # =====================================================
    # GF SLAB
    #
    # IMPORTANT:
    #
    # It is already generated in the correct location.
    # Do NOT move it.
    # Do NOT rebuild it.
    # Do NOT repeat it.
    #
    # Simply append the original geometry once.
    # =====================================================

    gf_items = flatten_items(
        GF_Slab
    )

    if gf_items:

        path = GH_Path(0)

        Slab_R.EnsurePath(
            path
        )

        for item in gf_items:

            # Directly preserve the source geometry
            Slab_R.Add(
                item,
                path
            )


    # =====================================================
    # WALLS
    # =====================================================

    repeat_geometry(
        Wall_unique,
        Wall_unique_R,
        rep,
        fh
    )


    repeat_geometry(
        Separate_wall_extr,
        Separate_wall_extr_R,
        rep,
        fh
    )


    # =====================================================
    # wall thickness
    # =====================================================



repeat_data(
    Wall_thickness,
    Wall_thickness_R,
    rep
)

# =========================================================
# DEBUG
# =========================================================

Debug.append(
    "Rep: {}".format(rep)
)

Debug.append(
    "Input GF slabs: {}".format(
        len(flatten_items(GF_Slab))
    )
)

Debug.append(
    "Input slabs: {}".format(
        len(flatten_items(Slab))
    )
)

Debug.append(
    "Total Slab_R: {}".format(
        Slab_R.DataCount
    )
)

Debug.append(
    "Walls: {}".format(
        Wall_unique_R.DataCount
    )
)

Debug.append(
    "Separate walls: {}".format(
        Separate_wall_extr_R.DataCount
    )
)
# ---------- end python_3_script_8 ----------
python_3_script_9 = Python3Script(
    Run=run,
    Floor_ID=floor_id,
    Wall_ID=python_3_script_7.wall_id,
    Wall_unique=curve_12,
    Wall_thickness=number_14,
    Room_A=python_3_script_7.room_a,
    Room_B=python_3_script_7.room_b)  # -> out, Wall_Data, File_Path, Debug; inputs Run: Boolean, Floor_ID: String, Wall_ID: list of String, Wall_unique: list of Curve, Wall_thickness: list of Double, Room_A: list of String, Room_B: list of String
# ---------- python_3_script_9: Python ----------
import os
import json


# =========================================================
# OUTPUTS
# =========================================================

Wall_Data = None
File_Path = None
Debug = []


# =========================================================
# HELPERS
# =========================================================

def unwrap(x):

    if x is None:
        return None

    try:
        return x.ScriptVariable()
    except:
        pass

    try:
        return x.Value
    except:
        pass

    return x


def xyz(pt):

    if pt is None:
        return None

    try:
        return [
            float(pt.X),
            float(pt.Y),
            float(pt.Z)
        ]
    except:
        return None


def curve_endpoints(crv):

    crv = unwrap(crv)

    if crv is None:
        return None

    try:
        return {
            "start": xyz(crv.PointAtStart),
            "end": xyz(crv.PointAtEnd)
        }
    except:
        return None


def preserve_list(data):
    """
    Preserve list length and None values.
    Important for Room_B, where exterior walls
    may intentionally have no second Room.
    """

    if data is None:
        return []

    result = []

    for item in data:
        result.append(
            unwrap(item)
        )

    return result


def clean_text(value):

    if value is None:
        return None

    text = str(value).strip()

    if text == "":
        return None

    return text


def get_dataset_folder():

    doc = ghenv.Component.OnPingDocument()

    if doc is None:
        return None

    gh_path = doc.FilePath

    if not gh_path:
        return None

    root = os.path.dirname(
        gh_path
    )

    dataset_folder = os.path.join(
        root,
        "Dataset_Results"
    )

    if not os.path.exists(
        dataset_folder
    ):
        os.makedirs(
            dataset_folder
        )

    return dataset_folder


def safe_name(text):

    return (
        str(text)
        .replace(" ", "_")
        .replace(":", "_")
        .replace("/", "_")
        .replace("\\", "_")
    )


# =========================================================
# INPUTS
# =========================================================

floor_id = (
    str(Floor_ID).strip()
    if Floor_ID
    else ""
)

wall_ids = preserve_list(
    Wall_ID
)

walls = preserve_list(
    Wall_unique
)

thicknesses = preserve_list(
    Wall_thickness
)

room_a = preserve_list(
    Room_A
)

room_b = preserve_list(
    Room_B
)


# =========================================================
# VALIDATION
# =========================================================

valid = True

wall_count = len(walls)


if not floor_id:

    Debug.append(
        "ERROR: Floor_ID is missing."
    )

    valid = False


if wall_count == 0:

    Debug.append(
        "ERROR: No unique walls found."
    )

    valid = False


datasets = {
    "Wall_ID": len(wall_ids),
    "Wall_thickness": len(thicknesses),
    "Room_A": len(room_a),
    "Room_B": len(room_b)
}


for name, count in datasets.items():

    if count != wall_count:

        Debug.append(
            "ERROR: {} count = {}, "
            "Wall_unique count = {}.".format(
                name,
                count,
                wall_count
            )
        )

        valid = False


# =========================================================
# BUILD WALL DATA
# =========================================================

if valid:

    wall_records = []


    for i in range(wall_count):

        try:
            thickness = float(
                thicknesses[i]
            )
        except:
            thickness = None


        wall = {

            "wall_id":
                clean_text(
                    wall_ids[i]
                ),

            "geometry":
                curve_endpoints(
                    walls[i]
                ),

            "thickness":
                thickness,

            "room_a":
                clean_text(
                    room_a[i]
                ),

            "room_b":
                clean_text(
                    room_b[i]
                )
        }


        wall_records.append(
            wall
        )


    Wall_Data = {

        "floor_id":
            floor_id,

        "walls":
            wall_records
    }


    Debug.append(
        "Floor: {}".format(
            floor_id
        )
    )

    Debug.append(
        "Unique walls: {}".format(
            len(wall_records)
        )
    )


# =========================================================
# SAVE
# =========================================================

if Run and valid:

    dataset_folder = (
        get_dataset_folder()
    )


    if dataset_folder is None:

        Debug.append(
            "ERROR: Grasshopper file "
            "must be saved first."
        )


    else:

        structural_folder = os.path.join(
            dataset_folder,
            "structural"
        )


        if not os.path.exists(
            structural_folder
        ):

            os.makedirs(
                structural_folder
            )


        File_Path = os.path.join(
            structural_folder,
            "{}_walls.json".format(
                safe_name(
                    floor_id
                )
            )
        )


        with open(
            File_Path,
            "w"
        ) as f:

            json.dump(
                Wall_Data,
                f,
                indent=2
            )


        Debug.append(
            "SAVED:"
        )

        Debug.append(
            File_Path
        )


elif not Run:

    Debug.append(
        "Ready. Set Run = True to save."
    )
# ---------- end python_3_script_9 ----------
curve_13 = Curve(python_3_script_8.Wall_unique_R)
separate_wall_extr_r = ClusterOutput(python_3_script_8.Separate_wall_extr_R)
slab_r = ClusterOutput(python_3_script_8.Slab_R)
gf_slab = ClusterOutput(geometry_4)  # Ground Floor slab
wall_thickness_r = ClusterOutput(python_3_script_8.Wall_thickness_R)
slab = ClusterOutput(geometry_5)  # Floor slab
walls_unique_r = ClusterOutput(curve_13)

# ==== cluster Cluster_5
brep = ClusterInput()

# ----
# Honeybee doors
boolean_toggle = BooleanToggle(False)
brep_2 = Brep(brep)
door = HBDoor(geo=brep_2, glass=boolean_toggle)  # -> out, doors; plug-in component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

brep_3 = ClusterInput()
brep_4 = ClusterInput()

# ----
# Honeybee shades
boolean_toggle_2 = BooleanToggle(True)
brep_5 = Brep(brep_4)
shade = HBShade(geo=brep_5, attached=boolean_toggle_2)  # -> out, shades; plug-in component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

panel = Panel("standard: => 50%")
brep_6 = ClusterInput()

# ----
# Honeybee rooms (solid)
hb_building_programs = HBBuildingPrograms({"LargeOffice", "MediumOffice", "SmallOffice", "MidriseApartment", "HighriseApartment", "Retail", "StripMall", "PrimarySchool", "SecondarySchool", "SmallHotel", "LargeHotel", "Hospital", "Outpatient", "Laboratory", "Warehouse", "SuperMarket", "FullServiceRestaurant", "QuickServiceRestaurant", "Courthouse", "College", "LargeDataCenterHighITE", "LargeDataCenterLowITE", "SmallDataCenterHighITE", "SmallDataCenterLowITE"}, selected="HighriseApartment")
searchprog = HBSearchPrograms(bldg_prog=hb_building_programs, vintage=2016)  # -> room_prog; plug-in component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
explode_tree = ExplodeTree(Data=simplify(graft(searchprog)))  # -> Branch0, Branch1, Branch2
programtype = HBProgramType(base_program=explode_tree.Branch0)  # -> program; plug-in component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
brep_7 = Brep(brep_6)
roomsolid = HBRoomFromSolid(geo=brep_7, program=programtype, conditioned=True)  # -> out, rooms; plug-in component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
intsolid = HBIntersectSolids(rooms=roomsolid.rooms, run=Toggle(True))  # -> int_rooms; plug-in component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

# ----
# Honeybee Apertures (windows)
number_slider = Slider(0.8, range=0..1)
brep_8 = Brep(brep_3)
python_3_script = Python3Script(Rooms=brep_7, Windows=brep_8)  # -> out, Windows_fixed, Flipped, Debug; inputs Rooms: tree of Brep, Windows: tree of Brep
# ---------- python_3_script: Python ----------
import Rhino.Geometry as rg
from Grasshopper import DataTree


# =========================================================
# OUTPUTS
# =========================================================

Windows_fixed = DataTree[object]()
Flipped = DataTree[object]()
Debug = []


# =========================================================
# HELPERS
# =========================================================

def unwrap(x):
    try:
        return x.Value
    except:
        return x


def get_brep(x):
    x = unwrap(x)

    if isinstance(x, rg.Brep):
        return x

    if isinstance(x, rg.BrepFace):
        return x.DuplicateFace(True)

    if isinstance(x, rg.Surface):
        try:
            return x.ToBrep()
        except:
            return None

    return None


def brep_centroid(brep):

    amp = rg.AreaMassProperties.Compute(brep)

    if amp is None:
        return None

    return amp.Centroid


def face_normal_at_point(face, pt):

    result = face.ClosestPoint(pt)

    if not result:
        return None, None

    success, u, v = result

    if not success:
        return None, None

    p = face.PointAt(u, v)
    n = face.NormalAt(u, v)

    if not n.Unitize():
        return None, None

    return p, n


def window_normal(brep):

    if brep is None or brep.Faces.Count == 0:
        return None

    face = brep.Faces[0]

    du = face.Domain(0)
    dv = face.Domain(1)

    u = 0.5 * (du.T0 + du.T1)
    v = 0.5 * (dv.T0 + dv.T1)

    n = face.NormalAt(u, v)

    if not n.Unitize():
        return None

    return n


# =========================================================
# COLLECT ROOM BREPS
# =========================================================

room_breps = []

if Rooms is not None:

    for branch in Rooms.Branches:

        for item in branch:

            b = get_brep(item)

            if b is not None:
                room_breps.append(b)


# =========================================================
# PROCESS WINDOWS
# =========================================================

checked = 0
flipped_count = 0
unmatched = 0


if Windows is not None:

    for i in range(Windows.BranchCount):

        path = Windows.Paths[i]
        branch = Windows.Branches[i]

        Windows_fixed.EnsurePath(path)
        Flipped.EnsurePath(path)


        for item in branch:

            win = get_brep(item)

            if win is None:
                continue


            w = win.DuplicateBrep()

            center = brep_centroid(w)

            if center is None:
                continue


            # -------------------------------------------------
            # Find nearest Room face
            # -------------------------------------------------

            best_normal = None
            best_distance = None


            for room in room_breps:

                for face in room.Faces:

                    p, n = face_normal_at_point(
                        face,
                        center
                    )

                    if p is None:
                        continue

                    d = center.DistanceTo(p)

                    if (
                        best_distance is None
                        or d < best_distance
                    ):

                        best_distance = d
                        best_normal = n


            # -------------------------------------------------
            # Compare normals
            # -------------------------------------------------

            wn = window_normal(w)

            was_flipped = False


            if (
                wn is not None
                and
                best_normal is not None
            ):

                dot = wn * best_normal

                # Opposite directions
                if dot < 0:

                    w.Flip()

                    was_flipped = True
                    flipped_count += 1

            else:

                unmatched += 1


            Windows_fixed.Add(
                w,
                path
            )

            Flipped.Add(
                was_flipped,
                path
            )

            checked += 1


# =========================================================
# DEBUG
# =========================================================

Debug.append(
    "Windows checked: {}".format(
        checked
    )
)

Debug.append(
    "Windows flipped: {}".format(
        flipped_count
    )
)

Debug.append(
    "Windows without reference normal: {}".format(
        unmatched
    )
)

Debug.append(
    "Reference Room Breps: {}".format(
        len(room_breps)
    )
)
# ---------- end python_3_script ----------
glassmod = HBGlassModifier(trans=number_slider)  # -> modifier; plug-in component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
aperture = HBAperture(geo=python_3_script.Windows_fixed, operable=True, rad_mod=glassmod)  # -> out, apertures; plug-in component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
viznorm = HBVisualizeNormals(hb_objs=aperture.apertures)  # -> points, vectors; plug-in component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
vector_display = VectorDisplay(Anchor=viznorm.points, Vector=viznorm.vectors)
opaquemod = HBOpaqueModifier(reflect=Slider(0.2, range=0..1))  # -> modifier; plug-in component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
bordershades = HBExtrudedBorderShades(hb_objs=aperture.apertures, depth=0.2, indoor=Toggle(False), rad_mod=opaquemod)  # -> out, hb_objs; plug-in component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

shades = ClusterOutput(shade.shades)
panel_2 = Panel("standard: =< 20%")
viznorm_2 = HBVisualizeNormals(hb_objs=roomsolid.rooms)  # -> points, vectors; plug-in component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
vector_display_2 = VectorDisplay(Anchor=viznorm_2.points, Vector=viznorm_2.vectors)
prefix = ClusterInput()
prefix_2 = HBAddPrefix(hb_objs=intsolid, prefix=prefix)  # -> hb_objs; plug-in component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

# ----
# Solve adjacency/subsurfaces
boolean_toggle_3 = BooleanToggle(True)
solveadj = HBSolveAdjacency(rooms=prefix_2, adiabatic=False, run=boolean_toggle_3)  # -> out, simplify(adj_rooms); plug-in component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
addsubface = HBAddSubface(hb_obj=solveadj.adj_rooms, sub_faces=[door.doors, bordershades.hb_objs], project_dist=0.05)  # -> out, hb_obj, unmatched; plug-in component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

hb_obj = ClusterOutput(addsubface.hb_obj)

# ==== cluster WallSupportedShellSimu
slab_res = ClusterInput()
wall_res = ClusterInput()
wall_curve = ClusterInput()
celiling_switch = ClusterInput()
floor_heights = ClusterInput()
wall_thickness = ClusterInput()
slab_brep = ClusterInput()
support_tolerance = ClusterInput()
mesh = Mesh(
    slab_res=slab_res,
    wall_res=wall_res,
    wall=wall_curve,
    ceilng=celiling_switch,
    height=floor_heights,
    wall_thickness=wall_thickness,
    slab=slab_brep,
    tolerance=support_tolerance)  # -> mesh_2, thickness, sup, z_0
actual_support = Panel(mesh.sup)
input_support = Panel(mesh.z_0)
boolean = ClusterInput()
ldist = ClusterInput()
model = Model(mesh=mesh.mesh_2, heights=mesh.thickness, pos_ind=mesh.sup, ldist=ldist)  # -> model, mass
boolean_2 = Boolean(boolean)
stream_filter = StreamFilter(Gate=boolean_2, Stream1=model.model)

# ---- group: FEM - Karamba
eigen_modes = EigenModesKaramba3D(Model=stream_filter, FromIndex=1, NumberOfModes=1, WithThIIEffects=False, MaximumNumberOfIterations=300, Epsilon=1e-07)  # -> ModelWithEigenModes, Eigenvalues
analyse = AnalyseKaramba3D(Model=stream_filter)  # -> AnalysedModel, MaximumDisplacement_cm, ResultingForce_kN, ChangeOfElasticEnergy_kNm
modelview = ModelViewKaramba3D(Model=analyse.AnalysedModel)  # -> Model, DeformedMesh, DeformedAxes, DeformedModel, MaximumDeformation

# ----
disassemble = DisassembleModelKaramba3D(Model=stream_filter)  # -> Model, Point, Beam, Shell, Support, Load, Line, Mesh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
maximum_displacement_cm = ClusterOutput(analyse.MaximumDisplacement_cm)
change_of_elastic_energy_knm = ClusterOutput(analyse.ChangeOfElasticEnergy_kNm)
mass = ClusterOutput(model.mass)
analysed_model = ClusterOutput(analyse.AnalysedModel)
panel = Panel(analyse.MaximumDisplacement_cm)

# ==== cluster Mesh

slab_res = ClusterInput()
wall_res = ClusterInput()
wall = ClusterInput()
ceilng = ClusterInput()
height = ClusterInput()
wall_thickness = ClusterInput()
slab = ClusterInput()
tolerance = ClusterInput()
num = Number(height)

subtraction = Subtraction(A=num, B=0.1)

Z = UnitZ(Factor=1)
crv = Curve(wall)
join = BrepJoin(Breps=slab)  # -> Breps, Closed
multiplication = Multiplication(A=Z, B=subtraction)

brep = Brep(graft(join.Breps))
move = Move(Geometry=slab, Motion=multiplication)  # -> Geometry, Transform
extr = Extrude(Base=crv, Direction=multiplication)
brep_2 = Brep(graft(extr))

brep_3 = Brep(graft(move.Geometry))

len = Length(Curve=crv)
division = Division(A=len, B=wall_res)
int = Integer(graft(division))

division_2 = Division(A=len, B=slab_res)
int_2 = Integer(graft(division_2))

mesh_breps = MeshBrepsKaramba3D(
    Brep=brep_3,
    MeshResolution=slab_res,
    EdgeRefinementFactor=0.67,
    PointReduction=False,
    SmoothingStepSize=0,
    SmoothingIterations=5)  # -> graft(Mesh), Info
mesh = MeshBrep(
    Brep=brep_3,
    Settings={GridMaxCount=0, GridMinCount=16, JaggedSeams=False, MaxEdgeLength=0, MinEdgeLength=0.0001, MinTolerance=0, Refine=True, RefineAngle=0, RelativeTolerance=0.65, SimplePlanes=True, Tolerance=0})  # -> graft(Mesh)
gate = StreamGate(Stream=mesh_breps.Mesh, Gate=flatten(ceilng))  # -> Target0, Target1

mesh_uv = MeshSurface(Surface=brep, UCount=int_2, VCount=int_2, Overhang=True, Equalize=False)  # -> flatten(Mesh)
mesh_uv_2 = MeshSurface(Surface=brep_2, UCount=int, VCount=5, Overhang=True, Equalize=False)  # -> flatten(Mesh)
merge = Merge(Data1=mesh_uv_2, Data2=mesh_uv, Data3=gate.Target1)
mjoin = MeshJoin(Meshes=merge)

multiplication_2 = Multiplication(A=wall_thickness, B=10)

tri = Triangulate(Mesh=mjoin)  # -> Mesh, Count
facen = FaceNormals(Mesh=tri.Mesh)  # -> Centers, Normals
devec = DeconstructVector(Vector=facen.Centers)  # -> XComponent, YComponent, ZComponent
abs = Absolute(Value=devec.ZComponent)
expression = Expression(x=abs, y=multiplication_2, Expression="If(x>0.9, 2.0, y)")

demesh = DeconstructMesh(Mesh=tri.Mesh)  # -> Vertices, Faces, Colours, Normals
pdecon = Deconstruct(Point=demesh.Vertices)  # -> XComponent, YComponent, ZComponent
smaller = SmallerThan(FirstNumber=pdecon.ZComponent, SecondNumber=0)  # -> SmallerThan, OrEqualTo
dispatch = Dispatch(List=demesh.Vertices, DispatchPattern=smaller.OrEqualTo)  # -> flatten(ListA), ListB
cullpt = CullDuplicates(Points=dispatch.ListA, Tolerance=tolerance, CullMode=1)  # -> Points, Indices, Valence

mesh_2 = ClusterOutput(tri.Mesh)
thickness = ClusterOutput(expression)
sup = ClusterOutput(cullpt.Points)
z_0 = ClusterOutput(dispatch.ListA)

# ==== cluster Model
heights = ClusterInput()
pos_ind = ClusterInput()
ldist = ClusterInput()
mesh = ClusterInput()

isotrop = MaterialPropertiesKaramba3D(
    FamilyOfMaterial="Steel",
    Name="S235",
    YoungsModulus_kN_cm²=21000,
    InPlaneShearModulus_kN_cm²=8076,
    TransverseShearModulus_kN_cm²=8076,
    SpecificWeight_kN_m³=78.5,
    CoefficientOfThermalExpansion_1=1.2e-05,
    TensileStrength_kN_cm²=23.5,
    CompressiveStrength_kN_cm²=-23.5,
    StrengthHypothesis="MISES",
    mode="Isotrop")
shell_var = CrossSectionKaramba3D(FamilyNameOfCrossSection="Slab cross section", Materials=isotrop, Heights_cm=heights, mode="Shell - Var")

supp = SupportKaramba3D(PosInd=pos_ind, Ct_kN_m=Vector(0, 0, 0), Cr_kNm_rad=Vector(0, 0, 0), menu=[buttons(on, on, on, on, on, on)])
gravity = LoadsKaramba3D(Vector=Vector(0, 0, -1), LCase="LC0", mode="Gravity")
mtoshell = CreateSurfaceElementKaramba3D(
    Mesh=mesh,
    CrossSection=shell_var,
    LimitDistance_m=0.005,
    Bending=True,
    mode="MeshToShell",
    GuidGeneratorSeed=-1874680299)  # -> Element, Points, Info

assemble = AssembleModelKaramba3D(Elem=flatten(mtoshell.Element), Support=flatten(supp), Load=flatten(gravity), LimitDistance_m=ldist)  # -> Model, Info, Mass_kg, CentreOfGravity, LoadCaseNames

model = ClusterOutput(assemble.Model)
mass = ClusterOutput(assemble.Mass_kg)
